# Grasshopper definition 20160913_triangle_growth_smoke.gh (Grasshopper 0.9.76)
# plug-ins: HoopSnake

edge_length = Slider(32, range=0..100)
expression = Expression(x=edge_length, Expression="x*3^½/3")
polygon = Polygon(Plane=PlaneXY(0, 0, 0), Radius=expression, Segments=Slider(3, range=0..10), FilletRadius=0)  # -> Polygon, Length

deconstruct_brep = DeconstructBrep(Brep=polygon.Polygon)  # -> Faces, Edges, Vertices
list_item = ListItem(List=deconstruct_brep.Edges, Index=2, Wrap=True)
list_item_2 = ListItem(List=deconstruct_brep.Vertices, Index=0, Wrap=True)
list_item_3 = ListItem(List=deconstruct_brep.Vertices, Index=Slider(1, range=0..1), Wrap=True)  # -> Item, Item1
area = Area(Geometry=deconstruct_brep.Faces)  # -> Area, Centroid
point_on_curve = PointOnCurve(list_item, parameter=0.5)
distance = Distance(PointA=list_item_2, PointB=point_on_curve)
vector_2pt = Vector2Pt(PointA=list_item_3.Item, PointB=list_item_3.Item1, Unitize=False)  # -> Vector, Length
unit_z = UnitZ(Factor=Slider(50, range=0..100))
move = Move(Geometry=area.Centroid, Motion=unit_z)  # -> Geometry, Transform
line = Line(StartPoint=area.Centroid, EndPoint=move.Geometry)
circle_cnr = CircleCNR(Center=point_on_curve, Normal=vector_2pt.Vector, Radius=distance)
curve_curve = CurveCurve(CurveA=line, CurveB=circle_cnr)  # -> Points, ParamsA, ParamsB
distance_2 = Distance(PointA=area.Centroid, PointB=curve_curve.Points)

area_2 = Area(Geometry=polygon.Polygon)  # -> Area, Centroid
panel = Panel(distance_2)
unit_z_2 = UnitZ(Factor=panel)
move_2 = Move(Geometry=area_2.Centroid, Motion=unit_z_2)  # -> Geometry, Transform
extrude_point = ExtrudePoint(Base=deconstruct_brep.Faces, Point=move_2.Geometry)
deconstruct_brep_2 = DeconstructBrep(Brep=extrude_point)  # -> Faces, Edges, Vertices
deconstruct_brep_3 = DeconstructBrep(Brep=deconstruct_brep_2.Faces)  # -> Faces, Edges, Vertices
volume = Volume(Geometry=extrude_point)  # -> Volume, Centroid
area_3 = Area(Geometry=deconstruct_brep_2.Faces)  # -> Area, Centroid
polyline = PolyLine(Vertices=deconstruct_brep_3.Vertices, Closed=True)
line_2 = Line(StartPoint=volume.Centroid, EndPoint=area_3.Centroid)
vector_2pt_2 = Vector2Pt(PointA=volume.Centroid, PointB=area_3.Centroid, Unitize=False)  # -> Vector, Length
amplitude = Amplitude(Vector=vector_2pt_2.Vector, Amplitude=1)
vector_display_ex = VectorDisplayEx(Point=area_3.Centroid, Vector=vector_2pt_2.Vector, Colour=RGB(0, 0, 0), Width=2)
multiplication = Multiplication(A=amplitude, B=96)
move_3 = Move(Geometry=flatten(polyline), Motion=multiplication)  # -> Geometry, Transform
rotate_axis = RotateAxis(Geometry=move_3.Geometry, Angle=3.141592654, Axis=line_2)  # -> Geometry, Transform
deconstruct_brep_4 = DeconstructBrep(Brep=polyline)  # -> Faces, Edges, Vertices
deconstruct_brep_5 = DeconstructBrep(Brep=rotate_axis.Geometry)  # -> simplify(Faces), Edges, simplify(Vertices)
list_item_4 = ListItem(List=deconstruct_brep_5.Vertices, Index=0, Wrap=True)  # -> Item, Item1, Item2
list_item_5 = ListItem(List=deconstruct_brep_4.Vertices, Index=0, Wrap=True)  # -> Item, Item1, Item2
_4point_surface = _4PointSurface(CornerA=list_item_5.Item1, CornerB=list_item_4.Item2, CornerC=list_item_4.Item)
_4point_surface_2 = _4PointSurface(CornerA=list_item_5.Item1, CornerB=list_item_4.Item, CornerC=list_item_5.Item2)
_4point_surface_3 = _4PointSurface(CornerA=list_item_5.Item2, CornerB=list_item_4.Item1, CornerC=list_item_5.Item)
_4point_surface_4 = _4PointSurface(CornerA=list_item_5.Item2, CornerB=list_item_4.Item, CornerC=list_item_4.Item1)
_4point_surface_5 = _4PointSurface(CornerA=list_item_5.Item, CornerB=list_item_4.Item1, CornerC=list_item_4.Item2)
_4point_surface_6 = _4PointSurface(CornerA=list_item_5.Item, CornerB=list_item_4.Item2, CornerC=list_item_5.Item1)
brep_join = BrepJoin(Breps=[_4point_surface, _4point_surface_2, _4point_surface_4, _4point_surface_3, _4point_surface_5, _4point_surface_6])  # -> Breps, Closed
cap_holes = CapHoles(Brep=brep_join.Breps)
deconstruct_brep_6 = DeconstructBrep(Brep=cap_holes)  # -> Faces, Edges, Vertices
list_item_6 = ListItem(List=deconstruct_brep_6.Faces, Index=Slider(1, range=0..1), Wrap=True)
area_4 = Area(Geometry=list_item_6)  # -> Area, Centroid
evaluate_surface = EvaluateSurface(Surface=list_item_6, Point=area_4.Centroid)  # -> Point, Normal, Frame
multiplication_2 = Multiplication(A=evaluate_surface.Normal, B=panel)
move_4 = Move(Geometry=area_4.Centroid, Motion=multiplication_2)  # -> Geometry, Transform
extrude_point_2 = ExtrudePoint(Base=list_item_6, Point=move_4.Geometry)  # -> simplify(Extrusion)

deconstruct_brep_7 = DeconstructBrep(Brep=extrude_point_2)  # -> Faces, Edges, Vertices
cull_index = CullIndex(List=deconstruct_brep_7.Faces, Indices=Slider(0, range=0..100), Wrap=True)
volume_2 = Volume(Geometry=extrude_point_2)  # -> Volume, Centroid
deconstruct_brep_8 = DeconstructBrep(Brep=cull_index)  # -> Faces, Edges, Vertices
area_5 = Area(Geometry=cull_index)  # -> Area, simplify(Centroid)
deconstruct_brep_9 = DeconstructBrep(Brep=deconstruct_brep_8.Faces)  # -> Faces, Edges, Vertices
vector_2pt_3 = Vector2Pt(PointA=volume_2.Centroid, PointB=area_5.Centroid, Unitize=False)  # -> Vector, Length
polyline_2 = PolyLine(Vertices=deconstruct_brep_9.Vertices, Closed=True)
amplitude_2 = Amplitude(Vector=vector_2pt_3.Vector, Amplitude=1)
line_3 = Line(StartPoint=volume_2.Centroid, EndPoint=area_5.Centroid)
multiplication_3 = Multiplication(A=amplitude_2, B=96)
move_5 = Move(Geometry=flatten(polyline_2), Motion=flatten(multiplication_3))  # -> Geometry, Transform
rotate_axis_2 = RotateAxis(Geometry=move_5.Geometry, Angle=3.141592654, Axis=flatten(line_3))  # -> Geometry, Transform
deconstruct_brep_10 = DeconstructBrep(Brep=polyline_2)  # -> Faces, Edges, Vertices
deconstruct_brep_11 = DeconstructBrep(Brep=rotate_axis_2.Geometry)  # -> Faces, Edges, Vertices
list_item_7 = ListItem(List=deconstruct_brep_11.Vertices, Index=0, Wrap=True)  # -> Item, Item1, Item2
list_item_8 = ListItem(List=deconstruct_brep_10.Vertices, Index=0, Wrap=True)  # -> Item, Item1, Item2
_4point_surface_7 = _4PointSurface(CornerA=list_item_8.Item1, CornerB=list_item_7.Item2, CornerC=list_item_7.Item)
_4point_surface_8 = _4PointSurface(CornerA=list_item_8.Item1, CornerB=list_item_7.Item, CornerC=list_item_8.Item2)
_4point_surface_9 = _4PointSurface(CornerA=list_item_8.Item2, CornerB=list_item_7.Item1, CornerC=list_item_8.Item)
_4point_surface_10 = _4PointSurface(CornerA=list_item_8.Item2, CornerB=list_item_7.Item, CornerC=list_item_7.Item1)
_4point_surface_11 = _4PointSurface(CornerA=list_item_8.Item, CornerB=list_item_7.Item1, CornerC=list_item_7.Item2)
_4point_surface_12 = _4PointSurface(CornerA=list_item_8.Item, CornerB=list_item_7.Item2, CornerC=list_item_8.Item1)
brep_join_2 = BrepJoin(Breps=[_4point_surface_7, _4point_surface_8, _4point_surface_10, _4point_surface_9, _4point_surface_11, _4point_surface_12])  # -> Breps, Closed
cap_holes_2 = CapHoles(Brep=brep_join_2.Breps)
deconstruct_brep_12 = DeconstructBrep(Brep=cap_holes_2)  # -> Faces, Edges, Vertices
list_item_9 = ListItem(List=deconstruct_brep_12.Faces, Index=Slider(1, range=0..1), Wrap=True)
area_6 = Area(Geometry=list_item_9)  # -> Area, Centroid
evaluate_surface_2 = EvaluateSurface(Surface=list_item_9, Point=area_6.Centroid)  # -> Point, Normal, Frame
multiplication_4 = Multiplication(A=evaluate_surface_2.Normal, B=panel)
move_6 = Move(Geometry=area_6.Centroid, Motion=multiplication_4)  # -> Geometry, Transform
extrude_point_3 = ExtrudePoint(Base=list_item_9, Point=move_6.Geometry)  # -> simplify(Extrusion)

hoopsnake = HoopSnake(
    StartingData=extrude_point_2,
    Data=extrude_point_4,
    Hoopsnake_Data_autoUpdate=False,
    Hoopsnake_Data_dataLimit=2147483647,
    Hoopsnake_Data_delay=0,
    Hoopsnake_Data_resetCounter=True,
    Hoopsnake_Data_updateView=True)  # -> Feedback, CumulativeFeedback, LoopsCounter, IterationsCounter

deconstruct_brep_13 = DeconstructBrep(Brep=hoopsnake.Feedback)  # -> Faces, Edges, Vertices
cull_index_2 = CullIndex(List=deconstruct_brep_13.Faces, Indices=Slider(0, range=0..100), Wrap=True)
volume_3 = Volume(Geometry=hoopsnake.Feedback)  # -> Volume, Centroid
deconstruct_brep_14 = DeconstructBrep(Brep=deconstruct_brep_13.Faces)  # -> Faces, Edges, Vertices
area_7 = Area(Geometry=deconstruct_brep_13.Faces)  # -> Area, simplify(Centroid)
deconstruct_brep_15 = DeconstructBrep(Brep=deconstruct_brep_14.Faces)  # -> Faces, Edges, Vertices
vector_2pt_4 = Vector2Pt(PointA=volume_3.Centroid, PointB=area_7.Centroid, Unitize=False)  # -> Vector, Length
polyline_3 = PolyLine(Vertices=deconstruct_brep_15.Vertices, Closed=True)
amplitude_3 = Amplitude(Vector=vector_2pt_4.Vector, Amplitude=1)
line_4 = Line(StartPoint=volume_3.Centroid, EndPoint=area_7.Centroid)
multiplication_5 = Multiplication(A=amplitude_3, B=96)
move_7 = Move(Geometry=flatten(polyline_3), Motion=flatten(multiplication_5))  # -> Geometry, Transform
rotate_axis_3 = RotateAxis(Geometry=move_7.Geometry, Angle=3.141592654, Axis=flatten(line_4))  # -> Geometry, Transform
deconstruct_brep_16 = DeconstructBrep(Brep=polyline_3)  # -> Faces, Edges, Vertices
deconstruct_brep_17 = DeconstructBrep(Brep=rotate_axis_3.Geometry)  # -> Faces, Edges, Vertices
list_item_10 = ListItem(List=deconstruct_brep_17.Vertices, Index=0, Wrap=True)  # -> Item, Item1, Item2
list_item_11 = ListItem(List=deconstruct_brep_16.Vertices, Index=0, Wrap=True)  # -> Item, Item1, Item2
_4point_surface_13 = _4PointSurface(CornerA=list_item_11.Item1, CornerB=list_item_10.Item2, CornerC=list_item_10.Item)
_4point_surface_14 = _4PointSurface(CornerA=list_item_11.Item1, CornerB=list_item_10.Item, CornerC=list_item_11.Item2)
_4point_surface_15 = _4PointSurface(CornerA=list_item_11.Item2, CornerB=list_item_10.Item1, CornerC=list_item_11.Item)
_4point_surface_16 = _4PointSurface(CornerA=list_item_11.Item2, CornerB=list_item_10.Item, CornerC=list_item_10.Item1)
_4point_surface_17 = _4PointSurface(CornerA=list_item_11.Item, CornerB=list_item_10.Item1, CornerC=list_item_10.Item2)
_4point_surface_18 = _4PointSurface(CornerA=list_item_11.Item, CornerB=list_item_10.Item2, CornerC=list_item_11.Item1)
brep_join_3 = BrepJoin(Breps=[_4point_surface_13, _4point_surface_14, _4point_surface_16, _4point_surface_15, _4point_surface_17, _4point_surface_18])  # -> Breps, Closed
cap_holes_3 = CapHoles(Brep=brep_join_3.Breps)
deconstruct_brep_18 = DeconstructBrep(Brep=cap_holes_3)  # -> Faces, Edges, Vertices
list_item_12 = ListItem(List=deconstruct_brep_18.Faces, Index=Slider(1, range=0..1), Wrap=True)
area_8 = Area(Geometry=list_item_12)  # -> Area, Centroid
evaluate_surface_3 = EvaluateSurface(Surface=list_item_12, Point=area_8.Centroid)  # -> Point, Normal, Frame
multiplication_6 = Multiplication(A=evaluate_surface_3.Normal, B=panel)
move_8 = Move(Geometry=area_8.Centroid, Motion=multiplication_6)  # -> Geometry, Transform
extrude_point_4 = ExtrudePoint(Base=list_item_12, Point=move_8.Geometry)  # -> simplify(Extrusion)
