# Grasshopper definition 20160924_iso_plan_front_right.gh (Grasshopper 0.9.76)

brep = Brep(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)

panel = Panel("inch")
number_slider = Slider(2, range=0..4)

panel_2 = Panel("hexgon tile")
polygon = Polygon(Plane=PlaneXY(0, 0, 0), Radius=number_slider, Segments=Slider(6, range=0..10), FilletRadius=0)  # -> Polygon, Length
division = Division(A=Slider(1, range=0..1), B=Slider(6, range=0..10))
boundary_surfaces = BoundarySurfaces(Edges=polygon.Polygon)
pi = Pi(Factor=division)
rotate = Rotate(Geometry=boundary_surfaces, Angle=pi, Plane=PlaneXY(0, 0, 0))  # -> Geometry, Transform

panel_3 = Panel("Octahedron")
geometry = Geometry(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)
division_2 = Division(A=Slider(1, range=0..1), B=Slider(6, range=0..10))
pi_2 = Pi(Factor=division_2)
xy_plane = XYPlane(Origin=Point(0, 0, 0))
construct_point = ConstructPoint(XCoordinate=0, YCoordinate=0, ZCoordinate=0)
rotate_2 = Rotate(Geometry=geometry, Angle=pi_2, Plane=xy_plane)  # -> Geometry, Transform
bounding_box = BoundingBox(Content=rotate_2.Geometry, Plane=PlaneXY(0, 0, 0))  # -> Box, Box_2
volume = Volume(Geometry=bounding_box.Box)  # -> Volume, Centroid
vector_2pt = Vector2Pt(PointA=volume.Centroid, PointB=construct_point, Unitize=False)  # -> Vector, Length
move = Move(Geometry=rotate_2.Geometry, Motion=vector_2pt.Vector)  # -> Geometry, Transform

geometry_2 = Geometry(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)
bounding_box_2 = BoundingBox(Content=geometry_2, Plane=PlaneXY(0, 0, 0))  # -> Box, Box_2
volume_2 = Volume(Geometry=bounding_box_2.Box)  # -> Volume, Centroid
construct_point_2 = ConstructPoint(XCoordinate=0, YCoordinate=0, ZCoordinate=0)
vector_2pt_2 = Vector2Pt(PointA=volume_2.Centroid, PointB=construct_point_2, Unitize=False)  # -> Vector, Length
move_2 = Move(Geometry=geometry_2, Motion=vector_2pt_2.Vector)  # -> Geometry, Transform

number_slider_2 = Slider(2, range=0..2)

# ----
# Smoke Cell center line
# plan
pi_3 = Pi(Factor=number_slider_2)
xy_plane_2 = XYPlane(Origin=Point(0, 0, 0))
rotate_3 = Rotate(Geometry=move_2.Geometry, Angle=pi_3, Plane=xy_plane_2)  # -> Geometry, Transform

brep_2 = Brep(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)
volume_3 = Volume(Geometry=brep_2)  # -> Volume, Centroid
box_corners = BoxCorners(Box=brep_2)  # -> CornerA, CornerB, CornerC, CornerD, CornerE, CornerF, CornerG, CornerH
panel_4 = Panel("iso_plan_front_right")
vector_2pt_3 = Vector2Pt(PointA=volume_3.Centroid, PointB=box_corners.CornerF, Unitize=Slider(1, range=0..1))  # -> Vector, Length
line_sdl = LineSDL(Start=volume_3.Centroid, Direction=vector_2pt_3.Vector, Length=1)
xy_plane_3 = XYPlane(Origin=Point(0, 0, 0))
xz_plane = XZPlane(Origin=Point(0, 0, 0))
plane_normal = PlaneNormal(Origin=Point(0, 0, 0), ZAxis=vector_2pt_3.Vector)
yz_plane = YZPlane(Origin=Point(0, 0, 0))
merge = Merge(Data1=xy_plane_3, Data2=xz_plane, Data3=yz_plane, Data4=plane_normal)

# ----
# Smoke Cell center line
# front
orient = Orient(Geometry=move_2.Geometry, Source=PlaneXY(0, 0, 0), Target=xz_plane)  # -> Geometry, Transform
pi_4 = Pi(Factor=number_slider_2)
rotate_4 = Rotate(Geometry=orient.Geometry, Angle=pi_4, Plane=xz_plane)  # -> Geometry, Transform

# ----
# Smoke Cell center line
# iso
orient_2 = Orient(Geometry=move_2.Geometry, Source=PlaneXY(0, 0, 0), Target=plane_normal)  # -> Geometry, Transform
pi_5 = Pi(Factor=number_slider_2)
rotate_5 = Rotate(Geometry=orient_2.Geometry, Angle=pi_5, Plane=plane_normal)  # -> Geometry, Transform

# ----
# Smoke Cell with leg
geometry_3 = Geometry(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)
bounding_box_3 = BoundingBox(Content=geometry_3, Plane=PlaneXY(0, 0, 0))  # -> Box, Box_2
volume_4 = Volume(Geometry=bounding_box_3.Box)  # -> Volume, Centroid
construct_point_3 = ConstructPoint(XCoordinate=0, YCoordinate=0, ZCoordinate=0)
vector_2pt_4 = Vector2Pt(PointA=volume_4.Centroid, PointB=construct_point_3, Unitize=False)  # -> Vector, Length
move_3 = Move(Geometry=geometry_3, Motion=vector_2pt_4.Vector)  # -> Geometry, Transform

panel_5 = Panel("""Smoke Cell leg
iso""")
orient_3 = Orient(Geometry=move_3.Geometry, Source=PlaneXY(0, 0, 0), Target=plane_normal)  # -> Geometry, Transform
pi_6 = Pi(Factor=number_slider_2)
rotate_6 = Rotate(Geometry=orient_3.Geometry, Angle=pi_6, Plane=plane_normal)  # -> Geometry, Transform

panel_6 = Panel("""Smoke Cell leg
plan""")
pi_7 = Pi(Factor=number_slider_2)
xy_plane_4 = XYPlane(Origin=Point(0, 0, 0))
rotate_7 = Rotate(Geometry=move_3.Geometry, Angle=pi_7, Plane=xy_plane_4)  # -> Geometry, Transform

geometry_4 = Geometry(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)
geometry_5 = Geometry(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)

panel_7 = Panel("cube on pt")
unit_x = UnitX(Factor=1)
brep_3 = Brep(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)
xy_plane_5 = XYPlane(Origin=Point(0, 0, 0))
vector = Vector(Vector(0.9659258263, 0.2588190451, 0))
angle = Angle(VectorA=unit_x, VectorB=vector, Plane=xy_plane_5)  # -> Angle, Reflex
rotate_8 = Rotate(Geometry=brep_3, Angle=angle.Angle, Plane=plane_normal)  # -> Geometry, Transform
brep_4 = Brep(rotate_8.Geometry)
unit_z = UnitZ(Factor=1)
pi_8 = Pi(Factor=number_slider_2)
xy_plane_6 = XYPlane(Origin=Point(0, 0, 0))

bounding_box_4 = BoundingBox(Content=brep_4, Plane=PlaneXY(0, 0, 0))  # -> Box, Box_2
volume_5 = Volume(Geometry=bounding_box_4.Box)  # -> Volume, Centroid
construct_point_4 = ConstructPoint(XCoordinate=0, YCoordinate=0, ZCoordinate=0)
vector_2pt_5 = Vector2Pt(PointA=volume_5.Centroid, PointB=construct_point_4, Unitize=False)  # -> Vector, Length
move_4 = Move(Geometry=brep_4, Motion=vector_2pt_5.Vector)  # -> Geometry, Transform

orient_direction = OrientDirection(
    Geometry=move_4.Geometry,
    PointA=Point(0, 0, 0),
    DirectionA=vector_2pt_3.Vector,
    PointB=Point(0, 0, 0),
    DirectionB=unit_z)  # -> Geometry, Transform
rotate_9 = Rotate(Geometry=orient_direction.Geometry, Angle=pi_8, Plane=xy_plane_6)  # -> Geometry, Transform

entwine = Entwine(
    Branch00=rotate.Geometry,
    Branch01=rotate_9.Geometry,
    Branch02=rotate_3.Geometry,
    Branch03=rotate_5.Geometry,
    Branch04=rotate_4.Geometry,
    Branch05=brep_3,
    Branch06=move.Geometry,
    FlattenInputs=True)  # -> simplify(Result)
project = Project(Geometry=simplify(graft(entwine)), Plane=merge)  # -> Geometry, Transform
number_slider_3 = Slider(1, range=0..10)
number_slider_4 = Slider(10, range=0..10)
orient_4 = Orient(Geometry=project.Geometry, Source=merge, Target=xy_plane_3)  # -> Geometry, Transform
square = Square(Plane=PlaneXY(0, 0, 0), Size=Slider(7, range=0..10), ExtentX=number_slider_3, ExtentY=number_slider_3)  # -> Cells, flatten(Points)
construct_domain = ConstructDomain(DomainStart=Slider(1, range=0..1), DomainEnd=number_slider_4)
move_5 = Move(Geometry=orient_4.Geometry, Motion=square.Points)  # -> Geometry, Transform
range = Range(Domain=construct_domain, Steps=number_slider_4)
multiplication = Multiplication(A=Slider(25, range=0..40), B=range)
unit_x_2 = UnitX(Factor=multiplication)
flip_matrix = FlipMatrix(Data=move_5.Geometry)
tree_branch = TreeBranch(Tree=flip_matrix, Path=Slider(0, range=0..100), MaintainPaths=True)
reverse_list = ReverseList(List=unit_x_2)  # -> flatten(List)
panel_8 = Panel(reverse_list)
shortest_list = ShortestList(ListListA=tree_branch, ListListB=reverse_list, TrimMode=2)  # -> ListListA, ListListB
move_6 = Move(Geometry=move_5.Geometry, Motion=simplify(graft(shortest_list.ListListB)))  # -> Geometry, Transform
panel_9 = Panel(shortest_list.ListListB)
custom_preview = CustomPreview(
    Geometry=move_6.Geometry,
    Shader={ambient=RGB(0, 0, 0), diffuse=RGB(255, 105, 180), emission=RGB(76, 32, 54), shine=0.5, specular=RGB(255, 255, 255), transparency=0})

tree_branch_2 = TreeBranch(Tree=move_6.Geometry, Path=Slider(0, range=0..100), MaintainPaths=True)

tree_branch_3 = TreeBranch(Tree=move_6.Geometry, Path=Slider(1, range=0..100), MaintainPaths=True)
cherry_picker = CherryPicker(tree_branch_3, ListIndex=0)
deconstruct_brep = DeconstructBrep(Brep=cherry_picker)  # -> Faces, Edges, Vertices
bounding_box_5 = BoundingBox(Content=tree_branch_3, Plane=PlaneXY(0, 0, 0))  # -> Box, Box_2
cherry_picker_2 = CherryPicker(deconstruct_brep.Edges, ListIndex=0)
area = Area(Geometry=bounding_box_5.Box)  # -> Area, Centroid
length = Length(Curve=cherry_picker_2)
division_3 = Division(A=number_slider, B=length)
scale = Scale(Geometry=tree_branch_3, Center=area.Centroid, Factor=division_3)  # -> Geometry, Transform

tree_branch_4 = TreeBranch(Tree=move_6.Geometry, Path=Slider(2, range=0..6), MaintainPaths=True)
cherry_picker_3 = CherryPicker(tree_branch_4, ListIndex=0)
deconstruct_brep_2 = DeconstructBrep(Brep=cherry_picker_3)  # -> Faces, Edges, Vertices
bounding_box_6 = BoundingBox(Content=tree_branch_4, Plane=PlaneXY(0, 0, 0))  # -> Box, Box_2
cherry_picker_4 = CherryPicker(deconstruct_brep_2.Edges, ListIndex=1)
area_2 = Area(Geometry=bounding_box_6.Box)  # -> Area, Centroid
length_2 = Length(Curve=cherry_picker_4)
division_4 = Division(A=number_slider, B=length_2)
scale_2 = Scale(Geometry=tree_branch_4, Center=area_2.Centroid, Factor=division_4)  # -> Geometry, Transform

list_length = ListLength(List=flatten(entwine))
minimum = Minimum(A=list_length, B=Slider(1, range=1..10))
panel_10 = Panel("debuger")
subtraction = Subtraction(A=list_length, B=minimum)
tree_branch_5 = TreeBranch(Tree=move_6.Geometry, Path=subtraction, MaintainPaths=True)
null_item = NullItem(Item=tree_branch_5)  # -> NullFlags, InvalidFlags, Description
custom_preview_2 = CustomPreview(
    Geometry=scale_2.Geometry,
    Shader={ambient=RGB(0, 0, 0), diffuse=RGB(255, 105, 180), emission=RGB(76, 32, 54), shine=0.5, specular=RGB(255, 255, 255), transparency=0})
panel_11 = Panel(null_item.Description)

tree_branch_6 = TreeBranch(Tree=move_6.Geometry, Path=Slider(3, range=0..6), MaintainPaths=True)
cherry_picker_5 = CherryPicker(tree_branch_6, ListIndex=3)
deconstruct_brep_3 = DeconstructBrep(Brep=cherry_picker_5)  # -> Faces, Edges, Vertices
bounding_box_7 = BoundingBox(Content=tree_branch_6, Plane=PlaneXY(0, 0, 0))  # -> Box, Box_2
cherry_picker_6 = CherryPicker(deconstruct_brep_3.Edges, ListIndex=1)
area_3 = Area(Geometry=bounding_box_7.Box)  # -> Area, Centroid
length_3 = Length(Curve=cherry_picker_6)
division_5 = Division(A=number_slider, B=length_3)
scale_3 = Scale(Geometry=tree_branch_6, Center=area_3.Centroid, Factor=division_5)  # -> Geometry, Transform

tree_branch_7 = TreeBranch(Tree=move_6.Geometry, Path=Slider(4, range=0..6), MaintainPaths=True)
cherry_picker_7 = CherryPicker(tree_branch_7, ListIndex=1)
deconstruct_brep_4 = DeconstructBrep(Brep=cherry_picker_7)  # -> Faces, Edges, Vertices
bounding_box_8 = BoundingBox(Content=tree_branch_7, Plane=PlaneXY(0, 0, 0))  # -> Box, Box_2
cherry_picker_8 = CherryPicker(deconstruct_brep_4.Edges, ListIndex=1)
area_4 = Area(Geometry=bounding_box_8.Box)  # -> Area, Centroid
length_4 = Length(Curve=cherry_picker_8)
division_6 = Division(A=number_slider, B=length_4)
scale_4 = Scale(Geometry=tree_branch_7, Center=area_4.Centroid, Factor=division_6)  # -> Geometry, Transform

tree_branch_8 = TreeBranch(Tree=move_6.Geometry, Path=Slider(5, range=0..6), MaintainPaths=True)
cherry_picker_9 = CherryPicker(tree_branch_8, ListIndex=3)
deconstruct_brep_5 = DeconstructBrep(Brep=cherry_picker_9)  # -> Faces, Edges, Vertices
bounding_box_9 = BoundingBox(Content=tree_branch_8, Plane=PlaneXY(0, 0, 0))  # -> Box, Box_2
cherry_picker_10 = CherryPicker(deconstruct_brep_5.Edges, ListIndex=0)
area_5 = Area(Geometry=bounding_box_9.Box)  # -> Area, Centroid
length_5 = Length(Curve=cherry_picker_10)
division_7 = Division(A=number_slider, B=length_5)
scale_5 = Scale(Geometry=tree_branch_8, Center=area_5.Centroid, Factor=division_7)  # -> Geometry, Transform

tree_branch_9 = TreeBranch(Tree=move_6.Geometry, Path=Slider(6, range=0..6), MaintainPaths=True)
cherry_picker_11 = CherryPicker(tree_branch_9, ListIndex=0)
deconstruct_brep_6 = DeconstructBrep(Brep=cherry_picker_11)  # -> Faces, Edges, Vertices
bounding_box_10 = BoundingBox(Content=tree_branch_9, Plane=PlaneXY(0, 0, 0))  # -> Box, Box_2
cherry_picker_12 = CherryPicker(deconstruct_brep_6.Edges, ListIndex=6)
area_6 = Area(Geometry=bounding_box_10.Box)  # -> Area, Centroid
length_6 = Length(Curve=cherry_picker_12)
division_8 = Division(A=number_slider, B=length_6)
scale_6 = Scale(Geometry=tree_branch_9, Center=area_6.Centroid, Factor=division_8)  # -> Geometry, Transform

transform = Transform(Geometry=geometry_4, Transform=scale.Transform)
entwine_2 = Entwine(
    Branch00=tree_branch_2,
    Branch01=scale.Geometry,
    Branch02=scale_2.Geometry,
    Branch03=scale_3.Geometry,
    Branch04=scale_4.Geometry,
    Branch05=scale_5.Geometry,
    Branch06=scale_6.Geometry,
    FlattenInputs=True)  # -> simplify(Result)
transform_2 = Transform(Geometry=geometry_5, Transform=scale_2.Transform)
custom_preview_3 = CustomPreview(
    Geometry=entwine_2,
    Shader={ambient=RGB(0, 0, 0), diffuse=RGB(255, 105, 180), emission=RGB(76, 32, 54), shine=0.5, specular=RGB(255, 255, 255), transparency=0})
