# Grasshopper definition 20170326-acoustic.gh (Grasshopper 0.9.76)

# ---- group: 21
curve = Curve([<curve referenced from the Rhino model> x3920])

# ---- group: 41
curve_2 = Curve([<curve referenced from the Rhino model> x3920])

# ---- group: 61
curve_3 = Curve([<curve referenced from the Rhino model> x3920])

# ---- group: 81
curve_4 = Curve([<curve referenced from the Rhino model> x3920])

# ----
curve_5 = Curve(curve_4)
length = Slider(3.4, range=0..10)
size = Slider(0.5, range=0..1)
length_2 = Slider(10, range=0..10)
end_points = EndPoints(Curve=curve_5)  # -> Start, End
length_3 = Length(Curve=curve_5)
multiplication = Multiplication(A=length_3, B=length)
vector = Vector(curve_5)
point = Point(end_points.Start)
plane_normal = PlaneNormal(Origin=point, ZAxis=vector)
amplitude = Amplitude(Vector=vector, Amplitude=multiplication)
multiplication_2 = Multiplication(A=length_3, B=size)
polygon = Polygon(Plane=plane_normal, Radius=multiplication_2, Segments=3, FilletRadius=0)  # -> Polygon, Length
move = Move(Geometry=end_points.End, Motion=amplitude)  # -> Geometry, Transform
extrude_point = ExtrudePoint(Base=polygon.Polygon, Point=move.Geometry)
