# Grasshopper definition 20170805_22Viewports.gh (Grasshopper 0.9.76)
# plug-ins: Python Interpreter, EleFront, LunchBox, MetaHopper, HDTTreeUtils

# ---- group: View
# Viewport control
# The selection effects the dropping performance.
# The fewer views switches on, the faster it could go.
edge_axonmetric = ValueList({"AxonEdgeS": 18, "AxonEdgeE": 19, "AxonEdgeN": 20, "AxonEdgeW": 21}, selected=["AxonEdgeS", "AxonEdgeE", "AxonEdgeN", "AxonEdgeW"])
distance_between_views = Slider(350, range=200..1000)
edge_isometric = ValueList({"EdgeIsoS": 10, "EdgeIsoE": 11, "EdgeIsoN": 12, "EdgeIsoW": 13}, selected=["EdgeIsoS", "EdgeIsoE", "EdgeIsoN", "EdgeIsoW"])
_45_axonmetric = ValueList({"AxonSE": 14, "AxonNE": 15, "AxonNW": 16, "AxonSW": 17}, selected=["AxonSE", "AxonNE", "AxonNW", "AxonSW"])
_45_isometric = ValueList({"IsoSE": 6, "IsoNE": 7, "IsoNW": 8, "IsoSW": 9}, selected=["IsoSE", "IsoNE", "IsoNW", "IsoSW"])
six_views = ValueList({"Top": 0, "Left": 1, "Right": 2, "Back": 3, "Front": 4, "Buttom": 5}, selected=["Top", "Left", "Right", "Back", "Front", "Buttom"])
show_the_labels = BooleanToggle(True)
show_the_site = BooleanToggle(True)
bake_text = Button()
merge = Merge(Data1=six_views, Data2=_45_isometric, Data3=edge_isometric, Data4=_45_axonmetric, Data5=edge_axonmetric)

# ----
# Bake
bake = Button()

# ---- group: Bake
colorseedadjustment = Slider(17, range=0..100)
layernametype = ValueList({"View": 0, "Type": 1, "Part": 2}, selected="Part")
color_space = ValueList({"HSL": 0, "RGB": 1, "XYZ": 2, "LAB": 3, "LCH": 4, "CMYK": 5}, selected="HSL")

# ----
geometry = Geometry(simplify(Tree({0;0}: [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], {0;1}: [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], {0;2}: [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], {0;3}: [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], {0;4}: [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], {0;5}: [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]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)))

# ----
# Primitives import
import_primitives_here = Geometry(geometry)

# ----
# Preprocess Primitives
# Visualization
geometry_2 = Geometry(import_primitives_here)
sort_list = SortList(Keys=geometry_2, ValuesValuesA=geometry_2)  # -> Keys, ValuesValuesA
breps = Data(simplify(flatten(sort_list.ValuesValuesA)))

# ----
# Initialize the Geometries & Points
options_selected = Integer(simplify(merge))
all_geometries = Geometry(breps)
bounding_box = BoundingBox(Content=flatten(all_geometries), Plane=PlaneXY(0, 0, 0), UnionBox=True)  # -> Box, Box_2
gap = Number(distance_between_views)
area = Area(Geometry=bounding_box.Box)  # -> Area, Centroid
deconstruct_box = DeconstructBox(Box=bounding_box.Box)  # -> Plane, X, Y, Z
number = Number(deconstruct_box.Y)
number_2 = Number(deconstruct_box.X)
number_3 = Number(deconstruct_box.Z)
box_corners = BoxCorners(Box=bounding_box.Box)  # -> CornerA, CornerB, CornerC, CornerD, CornerE, CornerF, CornerG, CornerH
xy_plane = XYPlane(Origin=Point(0, 0, 0))
vector_xyz = VectorXYZ(XComponent=gap, YComponent=gap, ZComponent=0)  # -> expr("-x", Vector), Length
move = Move(Geometry=xy_plane, Motion=vector_xyz.Vector)  # -> Geometry, Transform
vector_2pt = Vector2Pt(PointA=box_corners.CornerD, PointB=move.Geometry, Unitize=False)  # -> Vector, Length
move_2 = Move(Geometry=all_geometries, Motion=vector_2pt.Vector)  # -> Geometry, Transform
move_3 = Move(Geometry=area.Centroid, Motion=vector_2pt.Vector)  # -> Geometry, Transform
move_4 = Move(Geometry=area.Centroid, Motion=vector_2pt.Vector)  # -> Geometry, Transform
extremes = Extremes(A=number_2, B=number, C=number_3)  # -> Mininum, Maximum
addition = Addition(A=extremes.Mininum, B=extremes.Maximum)
reference_point_for_geometries = Point(move_3.Geometry)
filter_by_type = FilterByType(Geometry=all_geometries, ObjectType="brep")
get_rhino_attributes = GetRhinoAttributes(Geometry=filter_by_type)  # -> Name, Layer, Color
text_join = TextJoin(Text=[get_rhino_attributes.Name, get_rhino_attributes.Layer])
selected_geometries = Geometry(move_2.Geometry)
maxdimension = Number(addition)
objectname = Text(text_join)
refpt = Point(move_4.Geometry)
boxnm = Box(bounding_box.Box)
vector = Data(vector_2pt.Vector)

# ---- group: GH manager
# Text Pad Color Control
colour_picker = ColourPicker(PickedColour=RGBA(128, 128, 128, 150))  # disabled
set_panel_properties = SetPanelProperties(
    Panel=["Grasshopper.Kernel.Types.GH_ObjectWrapper", "Grasshopper.Kernel.Types.GH_ObjectWrapper", "Grasshopper.Kernel.Types.GH_ObjectWrapper", "Grasshopper.Kernel.Types.GH_ObjectWrapper", "Grasshopper.Kernel.Types.GH_ObjectWrapper"],
    Color=colour_picker)  # disabled

# ---- group: GH manager / Grasshopper Wire display control
# Grasshopper Wire display control
type_of_wire_in_gh = ValueList({"Thick": 1, "Thin": 2, "Invisible": 3}, selected="Invisible")  # disabled
change_only_selected = BooleanToggle(False)  # disabled
button = Button()  # disabled
wire_display = WireDisplay(wire=type_of_wire_in_gh, selected=change_only_selected, trig=button)  # -> out, A; disabled
# ---------- wire_display: VB ----------
    Dim document As GH_Document = owner.OnPingDocument()
    If (document Is Nothing) Then Return

    For Each att As IGH_Attributes In document.Attributes
      Dim param As IGH_Param = TryCast(att.DocObject, IGH_Param)
      If (param Is Nothing) Then Continue For
      If (trig) Then
        If (selected And Not param.Attributes.GetTopLevel.Selected) Then Continue For
        Select Case wire
          Case 2
            param.WireDisplay = GH_ParamWireDisplay.faint
          Case 3
            param.WireDisplay = GH_ParamWireDisplay.hidden
          Case Else
            param.WireDisplay = GH_ParamWireDisplay.Default
        End Select
      End If
    Next
# ---------- end wire_display ----------

# ---- group: GH manager
# Group Color Control
colour_picker_2 = ColourPicker(PickedColour=RGBA(0, 255, 255, 150))  # disabled
set_group_properties = SetGroupProperties(
    Group=["Grasshopper.Kernel.Types.GH_ObjectWrapper", "Grasshopper.Kernel.Types.GH_ObjectWrapper", "Grasshopper.Kernel.Types.GH_ObjectWrapper"],
    Color=colour_picker_2)  # disabled

# ---- group: GH manager / ScribblesControl
# ScribblesControl
get_scribbles = GetScribbles()  # -> Scribbles, ScribbleText, ScribblePlane, ScribbleSize; disabled
get_groups = GetGroups()  # -> Groups, GroupStyles, Nickname, Color; disabled
panel = Panel("Arial")  # disabled
button_2 = Button()  # disabled
label_groups = LabelGroups(Groups=get_groups.Groups, Run=button_2)  # disabled
set_scribble_properties = SetScribbleProperties(Scribble=get_scribbles.Scribbles, ScribbleFont=panel)  # disabled

# ----
# Essential Data
shear = Panel("""0
0
0
0
0
0
0
0
0
0
0
0
0
0
1
1
1
1
1
1
1
1""")
X = Panel("""0
-1
1
0
0
0
1
1
-1
-1
0
1
0
-1
0
0
0
0
0
0
0
0""")
Y = Panel("""0
0
0
1
-1
0
-1
1
1
-1
-1
0
1
0
0
0
0
0
0
0
0
0""")
Z = Panel("""1
0
0
0
0
-1
1
1
1
1
1
1
1
1
1
1
1
1
1
1
1
1""")
roz = Panel("""0
0
0
.5
1.5
0
0
0
0
0
1.5
.5
.5
1.5
1.75
1.25
0.75
0.25
0
1.5
1
0.5""")
list_keep_null = ListKeepNull(data=X, selection=options_selected)
list_keep_null_2 = ListKeepNull(data=Y, selection=options_selected)
list_keep_null_3 = ListKeepNull(data=Z, selection=options_selected)
list_keep_null_4 = ListKeepNull(data=roz, selection=options_selected)
list_keep_null_5 = ListKeepNull(data=shear, selection=options_selected)
Y_2 = Data(list_keep_null_2)
Z_2 = Data(list_keep_null_3)
roz_2 = Data(list_keep_null_4)
shear_2 = Data(list_keep_null_5)
X_2 = Data(list_keep_null)
X_3 = Panel(list_keep_null)
Y_3 = Panel(Y_2)
Z_3 = Panel(Z_2)
roz_3 = Panel(list_keep_null_4)
shear_3 = Panel(shear_2)

# ---- group: GH manager / 3rd Party Assemblies
# 3rd Party Assemblies
document_info = DocumentInfo(AutoUpdate=True, Recursive=True)  # -> DocumentName, DocumentFilePath, Components, Params, _3rdPartyAssemblies; disabled
assembly_info = AssemblyInfo(Assembly=document_info._3rdPartyAssemblies)  # -> FullName, FilePath, AuthorName, Core, Version, Types; disabled
text = Text(["LunchBox, Version=2016.3.21.0, Culture=neutral, PublicKeyToken=null", "GhPython, Version=0.6.0.3, Culture=neutral, PublicKeyToken=null", "MetaHopper, Version=1.0.5.0, Culture=neutral, PublicKeyToken=null", "HDTTreeUtils, Version=1.0.0.0, Culture=neutral, PublicKeyToken=null", "EleFront, Version=0.3.0.0, Culture=neutral, PublicKeyToken=null"])
panel_2 = Panel(text)

# ---- group: GH manager / ComponentTracing
# ComponentTracing
component_info = ComponentInfo(Component=document_info.Components)  # -> Name, NickName, Guid, ComponentGuid, Inputs, Outputs, Pivot, Bounds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; disabled
number_slider = Slider(1, range=0..10)  # disabled
list_item = ListItem(List=assembly_info.FullName, Index=number_slider, Wrap=True)  # disabled
text_split = TextSplit(Text=component_info.Assembly, Separators=", ")  # disabled
text_split_2 = TextSplit(Text=list_item, Separators=",")  # disabled
panel_3 = Panel(text_split)  # disabled
list_item_2 = ListItem(List=text_split, Index=0, Wrap=True)  # -> flatten(Item); disabled
list_item_3 = ListItem(List=text_split_2, Index=0, Wrap=True)  # -> flatten(Item); disabled
panel_4 = Panel(list_item_3)  # disabled
text_distance = TextDistance(TextA=list_item_2, TextB=list_item_3, Case=True)  # disabled
boolean = Boolean(text_distance)  # disabled
gate_not = GateNot(A=boolean)  # -> graft(Result); disabled
dispatch = Dispatch(List=gate_not, DispatchPattern=gate_not)  # -> ListA, ListB; disabled
clean_tree = CleanTree(RemoveNulls=True, RemoveInvalid=True, RemoveEmpty=True, Tree=dispatch.ListA)  # disabled
tree_statistics = TreeStatistics(Tree=clean_tree)  # -> Paths, Length, Count; disabled
deconstruct_path = DeconstructPath(Branch=tree_statistics.Paths)  # disabled
list_item_4 = ListItem(List=deconstruct_path, Index=1, Wrap=True)  # -> flatten(Item); disabled
list_item_5 = ListItem(List=component_info.Pivot, Index=list_item_4, Wrap=True)  # -> flatten(Item); disabled
panel_5 = Panel(list_item_5)  # disabled
panel_6 = Panel(clean_tree)  # disabled

# ----
# Position
gap_2 = Number(distance_between_views)
shift_x = Panel("0")
shift_y = Panel("0")
shift_z = Panel("""0
1
2
3
4
5
6
7
8
9
10
11
12
13
14
15
16
17
18
19
20
21""")
max_dimension = Number(maxdimension)
addition_2 = Addition(A=gap_2, B=max_dimension)
multiplication = Multiplication(A=addition_2, B=shift_x)
distance_shift_x = Integer(simplify(multiplication))
list_keep_null_6 = ListKeepNull(data=distance_shift_x, selection=options_selected)
multiplication_2 = Multiplication(A=addition_2, B=shift_y)
distance_shift_y = Integer(simplify(multiplication_2))
list_keep_null_7 = ListKeepNull(data=distance_shift_y, selection=options_selected)
multiplication_3 = Multiplication(A=addition_2, B=shift_z)
distance_shift_z = Integer(simplify(multiplication_3))
list_keep_null_8 = ListKeepNull(data=distance_shift_z, selection=options_selected)
vector_xyz_2 = VectorXYZ(XComponent=list_keep_null_6, YComponent=list_keep_null_7, ZComponent=list_keep_null_8)  # -> expr("-x", Vector), Length
vectors = Data(vector_xyz_2.Vector)

# ---- group: Label
# Viewports Label
viewports = ValueList({"Top": 0, "Left": 1, "Right": 2, "Back": 3, "Front": 4, "Buttom": 5, "IsoSE": 6, "IsoNE": 7, "IsoNW": 8, "IsoSW": 9, "EdgeIsoS": 10, "EdgeIsoE": 11, "EdgeIsoN": 12, "EdgeIsoW": 13, "AxonSE": 14, "AxonNE": 15, "AxonNW": 16, "AxonSW": 17, "AxonEdgeS": 18, "AxonEdgeE": 19, "AxonEdgeN": 20, "AxonEdgeW": 21}, selected=["Top", "Left", "Right", "Back", "Front", "Buttom", "IsoSE", "IsoNE", "IsoNW", "IsoSW", "EdgeIsoS", "EdgeIsoE", "EdgeIsoN", "EdgeIsoW", "AxonSE", "AxonNE", "AxonNW", "AxonSW", "AxonEdgeS", "AxonEdgeE", "AxonEdgeN", "AxonEdgeW"])
get_connected_objects = GetConnectedObjects(Objects=viewports)  # disabled
refpt_2 = Point(refpt)
vector_2 = Data(vector_xyz_2.Vector)
bakelayer = Panel("Txt")
maxdimension_2 = Number(maxdimension)
show_label = Boolean(show_the_labels)
bake_text_2 = Boolean(bake_text)
stream_filter = StreamFilter(Gate=show_label, Stream1=maxdimension_2)
vector_xyz_3 = VectorXYZ(XComponent=maxdimension_2, YComponent=0, ZComponent=maxdimension_2)  # -> expr("-0.5*x", Vector), Length
xz_plane = XZPlane(Origin=refpt_2)
move_5 = Move(Geometry=xz_plane, Motion=vector_2)  # -> Geometry, Transform
get_list_data = GetListData(ObjectToSet=get_connected_objects)  # -> NickName, Keys, Values, SelectedIndex; disabled
move_6 = Move(Geometry=move_5.Geometry, Motion=vector_xyz_3.Vector)  # -> Geometry, Transform
rectangle = Rectangle(Plane=move_6.Geometry, XSize=stream_filter, YSize=stream_filter, Radius=0)  # -> Rectangle, Length
text_2 = Text(["Top", "Left", "Right", "Back", "Front", "Buttom", "IsoSE", "IsoNE", "IsoNW", "IsoSW", "EdgeIsoS", "EdgeIsoE", "EdgeIsoN", "EdgeIsoW", "AxonSE", "AxonNE", "AxonNW", "AxonSW", "AxonEdgeS", "AxonEdgeE", "AxonEdgeN", "AxonEdgeW"])
viewnames = Panel(text_2)
stream_filter_2 = StreamFilter(Gate=show_label, Stream1=viewnames)  # -> simplify(graft(Stream))
text_tag = TextTag(Location=move_6.Geometry, Text=stream_filter_2)
bake_text_3 = DotNETVBScriptLEGACY(L=bakelayer, P=move_6.Geometry, T=stream_filter_2, H=20, E=bake_text_2)  # -> out
# ---------- bake_text_3: VB ----------
    'Make sure Bake toggle is set to true
    If( E) Then
      'Call Create Layer Function
      Call CreateLayer(L)

      'Call Add Text Function
      Call AddText(P, T, H, F, S)
    End If
# ---------- bake_text_3: VB additional code ----------
  'Function to create new layer and set as current
  Sub CreateLayer (ByVal L As String)

    'decalere a variable to hold current layer index
    Dim current_layer_i As Integer
    current_layer_i = doc.m_layer_table.CurrentLayerIndex()

    'check if input layer already exist, otherwise create new layer
    Dim layer_i As Integer
    layer_i = doc.m_layer_table.FindLayer(L)

    'Create new layer
    If layer_i = -1 Then

      'Declare and instentiate new layer
      Dim new_layer As New OnLayer()

      'Set layer name
      new_layer.SetLayerName(L)

      'Add layer to document and get its index
      layer_i = RhUtil.RhinoApp().ActiveDoc().m_layer_table.AddLayer(new_layer)

    End If

    'Set current layer to the new layer index
    doc.m_layer_table.SetCurrentLayerIndex(layer_i)

  End Sub

  'Function to Add Text to Doc
  Sub AddText (ByVal P As On3dPoint, ByVal T As String, ByVal H As Double, ByVal F As String, ByVal S As Integer)

    If (H <= 0) Then H = 1.0
    If (String.IsNullOrEmpty(F)) Then F = "Arial"
    If (S < 0 Or S > 3) Then S = 0

    Dim plane As New OnPlane(RhUtil.RhinoActiveCPlane())
    plane.SetOrigin(P)

    Dim text_entity As New OnTextEntity2()
    Dim text_object As New MRhinoAnnotationText()
    text_object.SetAnnotation(text_entity)
    text_object.SetTextHeight(H)
    text_object.SetString(T)
    text_object.SetPlane(plane)

    Dim bold As Boolean = False
    If (S = 1 Or S = 3) Then bold = True
    Dim italic As Boolean = False
    If (S = 2 Or S = 3) Then italic = True
    Dim idx As Integer = doc.m_font_table.FindOrCreateFont(F, bold, italic)
    text_object.SetFontIndex(idx)

    If (doc.AddObject(text_object)) Then
      doc.Redraw()
    End If
  End Sub
# ---------- end bake_text_3 ----------

# ---- group: LAB
L = Slider(0, range=0..1)
L_2 = Slider(1, range=0..1)
A = Slider(0, range=0..1)
A_2 = Slider(1, range=0..1)
B = Slider(0, range=0..1)
B_2 = Slider(1, range=0..1)
construct_domain = ConstructDomain(DomainStart=L, DomainEnd=L_2)
construct_domain_2 = ConstructDomain(DomainStart=A, DomainEnd=A_2)
construct_domain_3 = ConstructDomain(DomainStart=B, DomainEnd=B_2)
entwine = Entwine(Branch00=construct_domain, Branch01=construct_domain_2, Branch02=construct_domain_3, FlattenInputs=True)  # -> simplify(Result)

# ----
# Color Control
integer = Integer(color_space)

# ---- group: HSL
hue = Slider(0, range=0..1)
hue_2 = Slider(0.36, range=0..1)
saturation = Slider(0.5, range=0..1)
saturation_2 = Slider(1, range=0..1)
luminance = Slider(0.3, range=0..1)
luminance_2 = Slider(0.6, range=0..1)
construct_domain_4 = ConstructDomain(DomainStart=hue, DomainEnd=hue_2)
construct_domain_5 = ConstructDomain(DomainStart=saturation, DomainEnd=saturation_2)
construct_domain_6 = ConstructDomain(DomainStart=luminance, DomainEnd=luminance_2)
entwine_2 = Entwine(Branch00=construct_domain_4, Branch01=construct_domain_5, Branch02=construct_domain_6, FlattenInputs=True)  # -> simplify(Result)

# ---- group: RGB
R = Slider(244.14, range=0..255)
R_2 = Slider(255, range=0..255)
G = Slider(0, range=0..255)
G_2 = Slider(255, range=0..255)
B_3 = Slider(0, range=0..255)
B_4 = Slider(255, range=0..255)
construct_domain_7 = ConstructDomain(DomainStart=R, DomainEnd=R_2)
construct_domain_8 = ConstructDomain(DomainStart=G, DomainEnd=G_2)
construct_domain_9 = ConstructDomain(DomainStart=B_3, DomainEnd=B_4)
entwine_3 = Entwine(Branch00=construct_domain_7, Branch01=construct_domain_8, Branch02=construct_domain_9, FlattenInputs=True)  # -> simplify(Result)

# ---- group: LCH
H = Slider(1, range=0..1)
L_3 = Slider(0.44, range=0..1)
L_4 = Slider(1, range=0..1)
construct_domain_10 = ConstructDomain(DomainStart=L_3, DomainEnd=L_4)
C = Slider(0.03, range=0..1)
C_2 = Slider(1, range=0..1)
construct_domain_11 = ConstructDomain(DomainStart=C, DomainEnd=C_2)
H_2 = Slider(0, range=0..1)
construct_domain_12 = ConstructDomain(DomainStart=H_2, DomainEnd=H)
entwine_4 = Entwine(Branch00=construct_domain_10, Branch01=construct_domain_11, Branch02=construct_domain_12, FlattenInputs=True)  # -> simplify(Result)

# ----
# Bakery
text_3 = Text(viewnames)
number_4 = Number(colorseedadjustment)
integer_2 = Integer(layernametype)
comma = Panel(",")

# ---- group: XYZ
X_4 = Slider(0, range=0..1)
X_5 = Slider(1, range=0..1)
Y_4 = Slider(0, range=0..1)
Y_5 = Slider(1, range=0..1)
Z_4 = Slider(0, range=0..1)
Z_5 = Slider(1, range=0..1)
construct_domain_13 = ConstructDomain(DomainStart=X_4, DomainEnd=X_5)
construct_domain_14 = ConstructDomain(DomainStart=Y_4, DomainEnd=Y_5)
construct_domain_15 = ConstructDomain(DomainStart=Z_4, DomainEnd=Z_5)
entwine_5 = Entwine(Branch00=construct_domain_13, Branch01=construct_domain_14, Branch02=construct_domain_15, FlattenInputs=True)  # -> simplify(Result)

# ---- group: CMYK
Y_6 = Slider(0, range=0..1)
C_3 = Slider(0, range=0..1)
C_4 = Slider(1, range=0..1)
construct_domain_16 = ConstructDomain(DomainStart=C_3, DomainEnd=C_4)
M = Slider(0, range=0..1)
M_2 = Slider(1, range=0..1)
construct_domain_17 = ConstructDomain(DomainStart=M, DomainEnd=M_2)
Y_7 = Slider(1, range=0..1)
construct_domain_18 = ConstructDomain(DomainStart=Y_6, DomainEnd=Y_7)
entwine_6 = Entwine(Branch00=construct_domain_16, Branch01=construct_domain_17, Branch02=construct_domain_18, FlattenInputs=True)  # -> simplify(Result)

# ----
# Orient
dist = Data(X_2)
dist_2 = Data(Z_2)
dist_3 = Data(shear_2)
dist_4 = Data(Y_2)
dist_5 = Data(roz_2)
selected_geometries_2 = Data(selected_geometries)
reference_points_for_geometries = Data(reference_point_for_geometries)
objectname_2 = Text(objectname)
vectors_2 = Data(vectors)
cluster = Cluster_2(geoms=selected_geometries_2, dist=vectors_2)  # -> geomstree, disttree
cluster_2 = Cluster_2(geoms=selected_geometries_2, dist=dist)  # -> geomstree, disttree
cluster_3 = Cluster_2(geoms=selected_geometries_2, dist=dist_4)  # -> geomstree, disttree
cluster_4 = Cluster_2(geoms=selected_geometries_2, dist=dist_2)  # -> geomstree, disttree
cluster_5 = Cluster_2(geoms=selected_geometries_2, dist=dist_5)  # -> geomstree, disttree
cluster_6 = Cluster_2(geoms=selected_geometries_2, dist=dist_3)  # -> geomstree, disttree
vector_xyz_4 = VectorXYZ(XComponent=cluster_2.disttree, YComponent=cluster_3.disttree, ZComponent=cluster_4.disttree)  # -> Vector, Length
pi = Pi(Factor=cluster_5.disttree)
refpts = Point(reference_points_for_geometries)
xy_plane_2 = XYPlane(Origin=refpts)
plane_normal = PlaneNormal(Origin=refpts, ZAxis=vector_xyz_4.Vector)
orient = Orient(Geometry=cluster.geomstree, Source=plane_normal, Target=xy_plane_2)  # -> Geometry, Transform
rotate = Rotate(Geometry=orient.Geometry, Angle=pi, Plane=xy_plane_2)  # -> Geometry, Transform
geometry_3 = Data(rotate.Geometry)
vector_3 = Data(cluster.disttree)
shear_4 = Data(cluster_6.disttree)

# ----
# Viewports Generator
cluster_7 = Cluster_2(geoms=objectname_2, dist=vectors_2)  # -> geomstree, disttree

objectname_3 = Text(cluster_7.geomstree)

# ----
# Shear the Axons
geoms = Data(selected_geometries)
B_5 = Data(shear_4)
tree = Data(geometry_3)
tree_statistics_2 = TreeStatistics(Tree=tree)  # -> Paths, Length, Count
list_item_6 = ListItem(List=tree_statistics_2.Paths, Index=0, Wrap=True)
deconstruct_path_2 = DeconstructPath(Branch=list_item_6)
list_length = ListLength(List=deconstruct_path_2)
trim_tree = TrimTree(Tree=tree, Depth=expr("x-1", list_length))
bounding_box_2 = BoundingBox(Content=trim_tree, Plane=PlaneXY(0, 0, 0), UnionBox=True)  # -> Box, Box_2
cluster_8 = Cluster_2(geoms=geoms, dist=bounding_box_2.Box)  # -> geomstree, disttree
box_corners_2 = BoxCorners(Box=cluster_8.disttree)  # -> CornerA, CornerB, CornerC, CornerD, CornerE, CornerF, CornerG, CornerH
deconstruct_box_2 = DeconstructBox(Box=cluster_8.disttree)  # -> Plane, X, Y, Z
point = Point(box_corners_2.CornerB)
xz_plane_2 = XZPlane(Origin=point)
point_2 = Point(box_corners_2.CornerC)
deconstruct = Deconstruct(Point=point_2)  # -> XComponent, YComponent, ZComponent
number_5 = Number(deconstruct_box_2.Y)
multiplication_4 = Multiplication(A=number_5, B=B_5)
addition_3 = Addition(A=deconstruct.ZComponent, B=multiplication_4)
construct_point = ConstructPoint(XCoordinate=deconstruct.XComponent, YCoordinate=deconstruct.YComponent, ZCoordinate=addition_3)
shear_5 = Shear(Geometry=tree, Base=xz_plane_2, Grip=point_2, Target=construct_point)  # -> Geometry, Transform
geometry_4 = Data(shear_5.Geometry)

# ----
# Output
geometry_5 = Data(vector_3)
B_6 = Data(shear_4)
origin = Data(refpts)
geometry_6 = Data(geometry_4)
pi_2 = Pi(Factor=-0.5)
multiplication_5 = Multiplication(A=pi_2, B=B_6)
yz_plane = YZPlane(Origin=origin)
rotate_2 = Rotate(Geometry=geometry_6, Angle=multiplication_5, Plane=yz_plane)  # -> Geometry, Transform
move_7 = Move(Geometry=rotate_2.Geometry, Motion=geometry_5)  # -> Geometry, Transform
wellpositionedgeometry = Data(move_7.Geometry)

geometry_7 = Geometry(wellpositionedgeometry)
objectname_4 = Text(objectname_3)
tree_control = TreeControl(inTree=objectname_4, viewNames=text_3, layerNameType=integer_2, adjustment=number_4)  # -> names, layers, seeds; inputs inTree: tree, viewNames: list, layerNameType: list
# ---------- tree_control: Python ----------
###### Tree Control ######
# Script written by Addin Cui, June 20th 2017
# Script copyrighted by TESTA & WEISER

#Essential library import
from Grasshopper.Kernel.Data import GH_Path
from Grasshopper import DataTree
from System import Array as ar
import math
import random as ra

layers = DataTree[object]()
names = DataTree[object]()
seeds = DataTree[object]()

for i in range(inTree.BranchCount):
    bList = inTree.Branch(i)
    bPath = inTree.Path(i)
    
    # Modified: June 27th 2017
    # Modified: July 23rd 2017
    view = str(viewNames[bPath[0]]) + 'View'
    if bPath[1] == 0: 
        type = 'Mass'
        part = bList[0]
    else: 
        type = 'Curve'
        part = 'ProjSet'+ str(bPath[2])
        
    #Modified : July 29th 2017. Removed Iteration without Kangaroo.
    names.AddRange([view,type,part],bPath)
    print [view,type,part]
    
    # Modified June 28th 2017
    seed = 1
    layerName = []
    if len(layerNameType):
        #print i
        for j in layerNameType:
            if j == 0:
                seed *= math.pow(2,bPath[0])
                layerName.append(view)
            elif j == 1:
                seed *= math.pow(3,bPath[1])
                layerName.append(type)
            elif j == 2:
                seed *= math.pow(5,bPath[2])
                layerName.append(part)
    else: layerName.append('Default')
    #print 'Seed ',seed
    layers.AddRange(layerName, bPath)
    seeds.AddRange([seed+adjustment], bPath)
# ---------- end tree_control ----------
text_join_2 = TextJoin(Text=tree_control.names, Join=comma)
text_join_3 = TextJoin(Text=tree_control.layers, Join=comma)
layername_selected_info = Panel(text_join_3)
geometries = Panel(geometry_7)
objectname_full_info = Panel(text_join_2)

number_6 = Number(tree_control.seeds)
number_7 = Number(flatten(number_6))
sort_duplicate_values = SortDuplicateValues(ValueList=number_7)  # -> UniqueValues, simplify(Indices)
panel_7 = Panel(number_6)
list_length_2 = ListLength(List=sort_duplicate_values.Indices)  # -> flatten(Length)
list_length_3 = ListLength(List=sort_duplicate_values.UniqueValues)
series = Series(Start=0, Step=1, Count=list_length_3)
sort_list_2 = SortList(Keys=sort_duplicate_values.UniqueValues, ValuesA=series)  # -> Keys, ValuesA
repeat_data = RepeatData(Data=graft(sort_list_2.ValuesA), Length=graft(list_length_2))  # -> simplify(Data)
integer_3 = Integer(flatten(repeat_data))
integer_4 = Integer(flatten(sort_duplicate_values.Indices))
replace_items = ReplaceItems(List=number_7, Item=integer_3, Indices=integer_4, Wrap=False)
matchpaths = MatchPaths(TargetData=flatten(replace_items), SourceData=number_6)  # -> RestructuredData, IndexMap
integer_5 = Integer(matchpaths.RestructuredData)
panel_8 = Panel(integer_5)

packs_of_seeds = Data(integer_5)
stream_gate = StreamGate(Stream=packs_of_seeds, Gate=integer)  # -> Target0, Target1, Target2, Target3, Target4, Target5
stream_filter_3 = StreamFilter(
    Gate=integer,
    Stream0=entwine_2,
    Stream1=entwine_3,
    Stream2=entwine_5,
    Stream3=entwine,
    Stream4=entwine_4,
    Stream5=entwine_6)

# ---- group: LAB (continued)
random = Random(Range=construct_domain, Number=1, Seed=expr("x*3", stream_gate.Target3))
random_2 = Random(Range=construct_domain_3, Number=1, Seed=expr("x*2", stream_gate.Target3))
random_3 = Random(Range=construct_domain_2, Number=1, Seed=stream_gate.Target3)
entwine_7 = Entwine(Branch00=random, Branch01=random_3, Branch02=random_2, FlattenInputs=True)  # -> simplify(Result)
colour_l_ab = ColourLAb(Alpha=1, Luminance=random, A=random_3, B=random_2)
split_argb = SplitARGB(Colour=colour_l_ab, IntegerChannels=True)  # -> Alpha, Red, Green, Blue
colour_rgb = ColourRGB(Alpha=255, Red=split_argb.Red, Green=split_argb.Green, Blue=split_argb.Blue)
colour = Colour(colour_rgb)

# ---- group: HSL (continued)
random_4 = Random(Range=construct_domain_5, Number=1, Seed=expr("x*2", stream_gate.Target0))
random_5 = Random(Range=construct_domain_6, Number=1, Seed=expr("x*3", stream_gate.Target0))
random_6 = Random(Range=construct_domain_4, Number=1, Seed=stream_gate.Target0)
entwine_8 = Entwine(Branch00=random_6, Branch01=random_4, Branch02=random_5, FlattenInputs=True)  # -> simplify(Result)
colour_hsl = ColourHSL(Alpha=1, Hue=random_6, Saturation=random_4, Luminance=random_5)
colour_2 = Colour(colour_hsl)

# ---- group: RGB (continued)
random_7 = Random(Range=construct_domain_8, Number=1, Seed=expr("x*2", stream_gate.Target1))
random_8 = Random(Range=construct_domain_9, Number=1, Seed=expr("x*3", stream_gate.Target1))
random_9 = Random(Range=construct_domain_7, Number=1, Seed=stream_gate.Target1)
entwine_9 = Entwine(Branch00=random_9, Branch01=random_7, Branch02=random_8, FlattenInputs=True)  # -> simplify(Result)
colour_rgb_2 = ColourRGB(Alpha=255, Red=random_9, Green=random_7, Blue=random_8)
colour_3 = Colour(colour_rgb_2)

# ---- group: LCH (continued)
random_10 = Random(Range=construct_domain_10, Number=1, Seed=expr("x*3", stream_gate.Target4))
random_11 = Random(Range=construct_domain_11, Number=1, Seed=expr("x*2", stream_gate.Target4))
random_12 = Random(Range=construct_domain_12, Number=1, Seed=stream_gate.Target4)
entwine_10 = Entwine(Branch00=random_10, Branch01=random_11, Branch02=random_12, FlattenInputs=True)  # -> simplify(Result)
colour_lch = ColourLCH(Alpha=1, Luminance=random_10, Chroma=random_11, Hue=random_12)
split_argb_2 = SplitARGB(Colour=colour_lch, IntegerChannels=True)  # -> Alpha, Red, Green, Blue
colour_rgb_3 = ColourRGB(Alpha=255, Red=split_argb_2.Red, Green=split_argb_2.Green, Blue=split_argb_2.Blue)
colour_4 = Colour(colour_rgb_3)

# ---- group: CMYK (continued)
random_13 = Random(Range=construct_domain_17, Number=1, Seed=expr("x*2", stream_gate.Target5))
random_14 = Random(Range=construct_domain_18, Number=1, Seed=expr("x*3", stream_gate.Target5))
random_15 = Random(Range=construct_domain_16, Number=1, Seed=stream_gate.Target5)
entwine_11 = Entwine(Branch00=random_15, Branch01=random_13, Branch02=random_14, FlattenInputs=True)  # -> simplify(Result)
colour_cmyk = ColourCMYK(Cyan=random_15, Magenta=random_13, Yellow=random_14, Key=0)
colour_5 = Colour(colour_cmyk)

# ---- group: XYZ (continued)
random_16 = Random(Range=construct_domain_14, Number=1, Seed=expr("x*2", stream_gate.Target2))
random_17 = Random(Range=construct_domain_15, Number=1, Seed=expr("x*3", stream_gate.Target2))
random_18 = Random(Range=construct_domain_13, Number=1, Seed=stream_gate.Target2)
entwine_12 = Entwine(Branch00=random_18, Branch01=random_16, Branch02=random_17, FlattenInputs=True)  # -> simplify(Result)
colour_xyz = ColourXYZ(Alpha=1, X=random_18, Y=random_16, Z=random_17)
colour_6 = Colour(colour_xyz)

# ----
stream_filter_4 = StreamFilter(
    Gate=integer,
    Stream0=entwine_8,
    Stream1=entwine_9,
    Stream2=entwine_12,
    Stream3=entwine_7,
    Stream4=entwine_10,
    Stream5=entwine_11)
stream_filter_5 = StreamFilter(Gate=integer, Stream0=colour_2, Stream1=colour_3, Stream2=colour_6, Stream3=colour, Stream4=colour_4, Stream5=colour_5)
colour_7 = Colour(stream_filter_5)

colour_8 = Colour(colour_7)
path_mapper = PathMapper(colour_8, source="{A;B;C;D}", target="{A;B;C}")
custom_preview = CustomPreview(Geometry=simplify(geometry_7), Shader=simplify(colour_8))
bake_attributes = BakeAttributes(
    objs=geometry_7,
    names=text_join_2,
    layers=text_join_3,
    colors=path_mapper,
    materials=path_mapper,
    activate=bake,
    groupListTgthr=False)  # inputs objs: list, names: list of String, layers: list of String, colors: list of Color, pWidths: list of Double, wiresEach: list of Int32, materials: list, activate: Boolean, groupListTgthr: Boolean
# ---------- bake_attributes: C# ----------
    //Inserts geometry into the Rhino document, with custom attributes
    //Written by Giulio Piacentino
    //Version written 2011 10 18 - for Grasshopper 0.8.52

    if (activate)
    {
      int groupIndex = -1;
      if(groupListTgthr)
        groupIndex = doc.Groups.Add();

      for(int i = 0; i < objs.Count; i++)
      {
        object obj = objs[i];
        if(obj == null)
        {
          Print("No object to bake");
          return;
        }

        //Make new attribute to set name
        Rhino.DocObjects.ObjectAttributes att = new Rhino.DocObjects.ObjectAttributes();

        string name = names.Count > 0 ? names[i % names.Count] : null;
        //Set object name
        if(!string.IsNullOrEmpty(name))
        {
          att.Name = name;
        }

        Color color = colors.Count > 0 ? colors[i % colors.Count] : new Color();
        //Set color
        if(!color.IsEmpty)
        {
          att.ColorSource = Rhino.DocObjects.ObjectColorSource.ColorFromObject; //Make the color type "by object"
          att.ObjectColor = color;

          att.PlotColorSource = Rhino.DocObjects.ObjectPlotColorSource.PlotColorFromObject; //Make the plot color type "by object"
          att.PlotColor = color;
        }

        string layer = layers.Count > 0 ? layers[i % layers.Count] : null;
        //Set layer
        if(!string.IsNullOrEmpty(layer) && Rhino.DocObjects.Layer.IsValidName(layer))
        {
          //Get the current layer index
          Rhino.DocObjects.Tables.LayerTable layerTable = doc.Layers;
          int layerIndex = layerTable.Find(layer, true);

          if(layerIndex < 0) //This layer does not exist, we add it
          {
            Rhino.DocObjects.Layer onlayer = new Rhino.DocObjects.Layer(); //Make a new layer
            onlayer.Name = layer;

            layerIndex = layerTable.Add(onlayer); //Add the layer to the layer table
            if (layerIndex > -1) //We manged to add layer!
            {
              att.LayerIndex = layerIndex;
              Print("Added new layer to the document at position " + layerIndex + " named " + layer + ". ");
            } else
              Print("Layer did not add. Try cleaning up your layers."); //This never happened to me.
          }
          else
            att.LayerIndex = layerIndex; //We simply add to the existing layer
        }


        double pWidth = pWidths.Count > 0 ? pWidths[i % pWidths.Count] : 0;
        //Set plotweight
        if(pWidth > 0)
        {
          att.PlotWeightSource = Rhino.DocObjects.ObjectPlotWeightSource.PlotWeightFromObject;
          att.PlotWeight = pWidth;
        }


        object material = materials.Count > 0 ? materials[i % materials.Count] : null;
        //Set material
        bool materialByName = !string.IsNullOrEmpty(material as string);
        Rhino.Display.DisplayMaterial inMaterial = material as Rhino.Display.DisplayMaterial;
        if(material is Color)
        {
          inMaterial = new Rhino.Display.DisplayMaterial((Color) material);
        }
        if(material != null && inMaterial == null && !materialByName)
        {
          if(!(material is string))
          {
            try //We also resort to try with IConvertible
            {
              inMaterial = (Rhino.Display.DisplayMaterial) Convert.ChangeType(material, typeof(Rhino.Display.DisplayMaterial));
            }
            catch(InvalidCastException)
            {
            }
          }
        }
        if(inMaterial != null || materialByName)
        {
          string matName;

          if(!materialByName)
          {
            matName = string.Format("A:{0}-D:{1}-E:{2}-S:{3},{4}-T:{5}",
              Format(inMaterial.Ambient),
              Format(inMaterial.Diffuse),
              Format(inMaterial.Emission),
              Format(inMaterial.Specular),
              inMaterial.Shine.ToString(),
              inMaterial.Transparency.ToString()
              );
          }
          else
          {
            matName = (string) material;
          }

          int materialIndex = doc.Materials.Find(matName, true);
          if(materialIndex < 0 && !materialByName) //Material does not exist and we have its specs
          {
            materialIndex = doc.Materials.Add(); //Let's add it
            if(materialIndex > -1)
            {
              Print("Added new material at position " + materialIndex + " named \"" + matName + "\". ");
              Rhino.DocObjects.Material m = doc.Materials[materialIndex];
              m.Name = matName;
              m.AmbientColor = inMaterial.Ambient;
              m.DiffuseColor = inMaterial.Diffuse;
              m.EmissionColor = inMaterial.Emission;
              //m.ReflectionColor = no equivalent
              m.SpecularColor = inMaterial.Specular;
              m.Shine = inMaterial.Shine;
              m.Transparency = inMaterial.Transparency;
              //m.TransparentColor = no equivalent
              m.CommitChanges();

              att.MaterialSource = Rhino.DocObjects.ObjectMaterialSource.MaterialFromObject;
              att.MaterialIndex = materialIndex;
            }
            else
              Print("Material did not add. Try cleaning up your materials."); //This never happened to me.
          }
          else if(materialIndex < 0 && materialByName) //Material does not exist and we do not have its specs. We do nothing
          {
            Print("Warning: material name not found. I cannot set the source to this material name. Add a material with name: " + matName);
          }
          else
          {
            //If this material exists, we do not replace it!
            att.MaterialSource = Rhino.DocObjects.ObjectMaterialSource.MaterialFromObject;
            att.MaterialIndex = materialIndex;
          }
        }


        int wires = wiresEach.Count > 0 ? wiresEach[i % wiresEach.Count] : 0;
        //Set wire density
        if(wires == -1 || wires > 0)
        {
          att.WireDensity = wires;
        }

        Bake(obj, att, groupIndex);
      }
    }
    else
    {
      Print("Inactive");
    }

  }

  //<Custom additional code>

  void Bake(object obj, Rhino.DocObjects.ObjectAttributes att, int groupIndex)
  {
    if(obj == null)
      return;

    Guid id;

    //Bake to the right type of object
    if(obj is GeometryBase)
    {
      GeometryBase geomObj = obj as GeometryBase;

      switch(geomObj.ObjectType)
      {
        case Rhino.DocObjects.ObjectType.Brep:
          id = doc.Objects.AddBrep(obj as Brep, att);
          break;
        case Rhino.DocObjects.ObjectType.Curve:
          id = doc.Objects.AddCurve(obj as Curve, att);
          break;
        case Rhino.DocObjects.ObjectType.Point:
          id = doc.Objects.AddPoint((obj as Rhino.Geometry.Point).Location, att);
          break;
        case Rhino.DocObjects.ObjectType.Surface:
          id = doc.Objects.AddSurface(obj as Surface, att);
          break;
        case Rhino.DocObjects.ObjectType.Mesh:
          id = doc.Objects.AddMesh(obj as Mesh, att);
          break;
        case (Rhino.DocObjects.ObjectType) 1073741824://Rhino.DocObjects.ObjectType.Extrusion:
          id = (Guid) typeof(Rhino.DocObjects.Tables.ObjectTable).InvokeMember("AddExtrusion", BindingFlags.Instance | BindingFlags.InvokeMethod, null, doc.Objects, new object[]{obj, att});
          break;
        case Rhino.DocObjects.ObjectType.PointSet:
          id = doc.Objects.AddPointCloud(obj as Rhino.Geometry.PointCloud, att); //This is a speculative entry
          break;
        default:
          Print("The script does not know how to handle this type of geometry: " + obj.GetType().FullName);
          return;
      }
    }
    else
    {
      Type objectType = obj.GetType();

      if(objectType == typeof(Arc))
      {
        id = doc.Objects.AddArc((Arc) obj, att);
      }
      else if(objectType == typeof(Box))
      {
        id = doc.Objects.AddBrep(((Box) obj).ToBrep(), att);
      }
      else if(objectType == typeof(Circle))
      {
        id = doc.Objects.AddCircle((Circle) obj, att);
      }
      else if(objectType == typeof(Ellipse))
      {
        id = doc.Objects.AddEllipse((Ellipse) obj, att);
      }
      else if(objectType == typeof(Polyline))
      {
        id = doc.Objects.AddPolyline((Polyline) obj, att);
      }
      else if(objectType == typeof(Sphere))
      {
        id = doc.Objects.AddSphere((Sphere) obj, att);
      }
      else if(objectType == typeof(Point3d))
      {
        id = doc.Objects.AddPoint((Point3d) obj, att);
      }
      else if(objectType == typeof(Line))
      {
        id = doc.Objects.AddLine((Line) obj, att);
      }
      else if(objectType == typeof(Vector3d))
      {
        Print("Impossible to bake vectors");
        return;
      }
      else if(obj is IEnumerable)
      {
        int newGroupIndex;
        if(groupIndex == -1)
          newGroupIndex = doc.Groups.Add();
        else
          newGroupIndex = groupIndex;
        foreach(object o in obj as IEnumerable)
        {
          Bake(o, att, newGroupIndex);
        }
        return;
      }
      else
      {
        Print("Unhandled type: " + objectType.FullName);
        return;
      }
    }

    if(groupIndex != -1)
    {
      doc.Groups.AddToGroup(groupIndex, id);
      Print("Added " + obj.GetType().Name + " to group number " + groupIndex);
    }
    else
      Print("Added " + obj.GetType().Name);
  }

  static string Format(Color c)
  {
    return (new System.Text.StringBuilder("A")).Append(c.A.ToString()).Append("R").Append(c.R.ToString()).Append("G")
      .Append(c.G.ToString()).Append("B").Append(c.B.ToString()).ToString();
# ---------- end bake_attributes ----------
color = Panel(path_mapper)

# ----
# Color Uniqueness
data = Data(stream_filter_4)
explode_tree = ExplodeTree(Data=data)  # -> Branch0, Branch1, Branch2
domain = Domain(stream_filter_3)
number_8 = Number(domain)
explode_tree_2 = ExplodeTree(Data=number_8)  # -> Branch0, Branch1, Branch2
cluster_9 = Cluster(value_list=explode_tree.Branch0)  # -> difference_2, length
cluster_10 = Cluster(value_list=explode_tree.Branch1)  # -> difference_2, length
cluster_11 = Cluster(value_list=explode_tree.Branch2)  # -> difference_2, length
multiplication_6 = Multiplication(A=cluster_9.difference_2, B=explode_tree_2.Branch0)
multiplication_7 = Multiplication(A=cluster_10.difference_2, B=explode_tree_2.Branch1)
multiplication_8 = Multiplication(A=cluster_11.difference_2, B=explode_tree_2.Branch2)
addition_4 = Addition(A=multiplication_6, B=multiplication_7, C=multiplication_8)
difference_indicator_the_larger_the_bett = Panel(cluster_9.difference_2)  # "Difference Indicator, the larger the better"
number_of_unique_colors = Panel(cluster_9.length)
number_of_unique_colors_2 = Panel(cluster_10.length)
number_of_unique_colors_3 = Panel(cluster_11.length)
difference_indicator_the_larger_the_bett_2 = Panel(cluster_11.difference_2)  # "Difference Indicator, the larger the better"
difference_indicator_the_larger_the_bett_3 = Panel(cluster_10.difference_2)  # "Difference Indicator, the larger the better"
galapagos = Galapagos(fitness=addition_4, gene=colorseedadjustment)
difference_indicator_the_larger_the_bett_4 = Panel(addition_4)  # "Difference Indicator, the larger the better"

# ==== cluster ListKeepNull
data = ClusterInput()
selection = ClusterInput()
data_2 = Data(data)
selection_2 = Integer(selection)
item_index = ItemIndex(List=data_2, Item=data_2)
replace_items = ReplaceItems(List=data_2, Indices=selection_2, Wrap=False)
null_item = NullItem(Item=replace_items)  # -> NullFlags, InvalidFlags, Description
dispatch = Dispatch(List=item_index, DispatchPattern=null_item.NullFlags)  # -> ListA, ListB
replace_items_2 = ReplaceItems(List=data_2, Indices=dispatch.ListB, Wrap=False)  # -> simplify(graft(List))
panel = Panel(replace_items_2)
data_3 = Data(replace_items_2)
data_4 = ClusterOutput(data_3)

# ==== cluster Cluster
value_list = ClusterInput()
sort_duplicate_values = SortDuplicateValues(ValueList=flatten(value_list))  # -> UniqueValues, Indices
sort_list = SortList(Keys=sort_duplicate_values.UniqueValues, ValuesValuesA=sort_duplicate_values.UniqueValues)  # -> Keys, ValuesValuesA
relative_differences = RelativeDifferences(Values=sort_list.Keys)
sort_list_2 = SortList(Keys=relative_differences, ValuesValuesA=relative_differences)  # -> Keys, ValuesValuesA
list_length = ListLength(List=sort_duplicate_values.UniqueValues)
list_item = ListItem(List=sort_list_2.Keys, Index=1, Wrap=True)
length = ClusterOutput(list_length)
difference = Data(list_item)
difference_2 = ClusterOutput(difference)

# ==== cluster Cluster_2
geoms = ClusterInput()
dist = ClusterInput()
tree_control = TreeControl(geoms=geoms, dist=simplify(dist))  # -> out, geomsTree, distTree; inputs geoms: tree, dist: tree
# ---------- tree_control: Python ----------
import Rhino
from Grasshopper.Kernel.Data import GH_Path
from Grasshopper import DataTree
from System import Array as ar

geomsTree = DataTree[object]()
distTree = DataTree[object]()

for d in range(dist.BranchCount):
    distList = dist.Branch(d)
    distPath = dist.Path(d)
    #print distPath
    #print distList
    dp0 = distPath[0]
    le = GH_Path.Length.GetValue(geoms.Path(0))
    for g in range(geoms.BranchCount):
        geomsList = geoms.Branch(g)
        geomsPath = geoms.Path(g)
        p0 = geomsPath[0]
        if le == 2:
            p1 = geomsPath[1]
        else: p1 = 0
        path = GH_Path(ar[int]([dp0, p0, p1]))
        #print type(geomsPath)
        if distList[0] != None:
            for i in range(len(geomsList)):
                geomsTree.Add(geomsList[i], path)
                distTree.Add(distList[0],path)
        else:
            for i in range(len(geomsList)):
                geomsTree.Add(None, path)
                distTree.Add(None,path)
            #print 'No distance'
        #print len(geomsList)

    
#print geomsTree
# ---------- end tree_control ----------
geomstree = ClusterOutput(tree_control.geomsTree)
disttree = ClusterOutput(tree_control.distTree)
