# Grasshopper definition 20170930_Drop.gh (Grasshopper 0.9.76)
# plug-ins: Python Interpreter, EleFront, FalseStartToggle, LunchBox, MetaHopper, Kangaroo2 Components, HDTTreeUtils

# ----
# 1_Switch the blue toggle on
# 2_Switch the Grey toggle on
switch_kangaroo_to_animationmood = FalseStartToggle(False)
produceanimation = BooleanToggle(False)

# ----
# 3_Press this Square button
group_toggle = GroupToggle(ToggleActive=True, ToggleVisible=False)  # disabled

# ---- group: View
# Viewport control
# The selection effects the dropping performance.
# The fewer views switches on, the faster it could go.
site_display_seletion = ValueList({"Hide Site": 0, "Show Site with Walls": 1, "Show Site Bottom Only": 2}, selected="Show Site Bottom Only")
_45_isometric = ValueList({"IsoSE": 6, "IsoNE": 7, "IsoNW": 8, "IsoSW": 9}, selected=[])
six_views = ValueList({"Top": 0, "Left": 1, "Right": 2, "Back": 3, "Front": 4, "Buttom": 5}, selected="Top")
edge_isometric = ValueList({"EdgeIsoS": 10, "EdgeIsoE": 11, "EdgeIsoN": 12, "EdgeIsoW": 13}, selected=[])
_45_axonmetric = ValueList({"AxonSE": 14, "AxonNE": 15, "AxonNW": 16, "AxonSW": 17}, selected=[])
edge_axonmetric = ValueList({"AxonEdgeS": 18, "AxonEdgeE": 19, "AxonEdgeN": 20, "AxonEdgeW": 21}, selected=[])
distance_between_views = Slider(400, range=200..1000)
show_the_labels = BooleanToggle(True)
bake_text = Button()
merge = Merge(Data1=six_views, Data2=_45_isometric, Data3=edge_isometric, Data4=_45_axonmetric, Data5=edge_axonmetric)

# ----
# Primitives import
showlocalcoordinate = BooleanToggle(True)
import_primitives_here = Brep([<brep referenced from the Rhino model> x5])

# ----
# Bake
bake = Button()

# ---- group: Bake
colorseedadjustment = Slider(45, range=0..100)
layernametype = ValueList({"View": 0, "Type": 1, "Part": 2, "Iteration": 3}, selected="Part")
color_space = ValueList({"HSL": 0, "RGB": 1, "XYZ": 2, "LAB": 3, "LCH": 4, "CMYK": 5}, selected="HSL")
group = BooleanToggle(False)

# ----
# Site import
list = ValueList({"FULL WALL": 0, "NO WALL": 1, "BUENA VISTA WALL": 2}, selected="FULL WALL")
onewall = Geometry(<brep referenced from the Rhino model>)
fullwall = Geometry(<brep referenced from the Rhino model>)
nowall = Geometry(<brep referenced from the Rhino model>)

# ----
# Projection Curve Control
a_bug = ValueList({"Keeping most crvs on curvy srfs, Slightly through": 0, "Not through at all. Missing some of the crvs on curvy srfs": 1}, selected="Keeping most crvs on curvy srfs, Slightly through")
pick_to_display_in_setup_booth = ValueList({"Projection Pad": 0, "Drawing Pad": 1, "Pattern Curves On Drawing Pad": 2, "Pattern Curves On Projection Pad": 3, "Projections On Primtive Breps": 4}, selected=[])
pick_what_to_project_on_breps = ValueList({"Projection Pad Frame": 0, "Pattern Curves": 1}, selected="Pattern Curves")
bake_booth_view_projection_curves = Button()
one_side_projection_not_perfect = BooleanToggle(False)
projection_indicator = Slider(500, range=0..1000)
group_projection_curves = BooleanToggle(True)

# ----
# Reset!
reset = Button()

# ----
# Projection Input
corner_type = ValueList({"Sharp": 1, "Round": 2, "Smooth": 3, "Champer": 4}, selected="Round")
projection_pad = Curve(<curve referenced from the Rhino model>)
drawing_pad = Curve(<curve referenced from the Rhino model>)
pattern_crvs = Curve([<curve referenced from the Rhino model> x99])
number_slider = Slider(1, range=1..10)
width = Slider(0.6, range=-1..1)
patterntreatment = PatternTreatment(curves=pattern_crvs, distance=width, corners=corner_type)

# ----
# Projection Input
corner_type_2 = ValueList({"Sharp": 1, "Round": 2, "Smooth": 3, "Champer": 4}, selected="Sharp")
number_slider_2 = Slider(2, range=1..10)
projection_pad_2 = Curve(<curve referenced from the Rhino model>)
drawing_pad_2 = Curve(<curve referenced from the Rhino model>)
pattern_crvs_2 = Curve([<curve referenced from the Rhino model> x46])
width_2 = Slider(0, range=-1..1)
patterntreatment_2 = PatternTreatment_2(curves=pattern_crvs_2, distance=width_2, corners=corner_type_2)

# ----
# Projection Input
projection_pad_3 = Curve(<curve referenced from the Rhino model>)
corner_type_3 = ValueList({"Sharp": 1, "Round": 2, "Smooth": 3, "Champer": 4}, selected="Sharp")
number_slider_3 = Slider(3, range=1..10)
drawing_pad_3 = Curve(<curve referenced from the Rhino model>)
pattern_crvs_3 = Curve([<curve referenced from the Rhino model> x173])
width_3 = Slider(0, range=-1..1)
patterntreatment_3 = PatternTreatment_2(curves=pattern_crvs_3, distance=width_3, corners=corner_type_3)

# ---- group: GH manager / 3rd Party Assemblies
# 3rd Party Assemblies
document_info = DocumentInfo(AutoUpdate=True, Recursive=True)  # -> DocumentName, DocumentFilePath, Components, Params, _3rdPartyAssemblies; disabled
assembly_info = AssemblyInfo(Assembly=document_info._3rdPartyAssemblies)  # -> FullName, FilePath, AuthorName, Core, Version, Types; disabled
text = Text(["GhPython, Version=0.6.0.3, Culture=neutral, PublicKeyToken=null", "HDTTreeUtils, Version=1.0.0.0, Culture=neutral, PublicKeyToken=null", "LunchBox, Version=2016.3.21.0, Culture=neutral, PublicKeyToken=null", "Kangaroo2Component, Version=2.3.3.0, Culture=neutral, PublicKeyToken=null", "MetaHopper, Version=1.0.5.0, Culture=neutral, PublicKeyToken=null", "EleFront, Version=0.3.0.0, Culture=neutral, PublicKeyToken=null", "FalseStartToggle, Version=1.0.0.0, Culture=neutral, PublicKeyToken=null"])
panel = Panel(text)  # disabled

# ---- group: GH manager / Grasshopper Wire display control
# Grasshopper Wire display control
type_of_wire_in_gh = ValueList({"Thick": 1, "Thin": 2, "Invisible": 3}, selected="Invisible")  # disabled
change_only_selected = BooleanToggle(True)  # disabled
button = Button()  # disabled
wire_display = WireDisplay(wire=type_of_wire_in_gh, selected=change_only_selected, trig=button)  # -> out, A; disabled
# ---------- wire_display: VB ----------
    Dim document As GH_Document = owner.OnPingDocument()
    If (document Is Nothing) Then Return

    For Each att As IGH_Attributes In document.Attributes
      Dim param As IGH_Param = TryCast(att.DocObject, IGH_Param)
      If (param Is Nothing) Then Continue For
      If (trig) Then
        If (selected And Not param.Attributes.GetTopLevel.Selected) Then Continue For
        Select Case wire
          Case 2
            param.WireDisplay = GH_ParamWireDisplay.faint
          Case 3
            param.WireDisplay = GH_ParamWireDisplay.hidden
          Case Else
            param.WireDisplay = GH_ParamWireDisplay.Default
        End Select
      End If
    Next
# ---------- end wire_display ----------

# ---- group: Choose the way to preview geometry
geometry_preview = ValueList({"Initial Geometry": 0, "Use Recordered Geometry": 1, "Use REC + Adjustment": 2}, selected="Initial Geometry")

# ---- group: Kangaroo Strength
gravitydirectiondeviation = Slider(0.1, range=0..3)
boxcollisionstrength = Slider(5, range=0..5)
rigidbodystrength = Slider(2, range=0..5)
gravitystrength = Slider(0, range=0..5)
damping = Slider(0.99, range=0.9..0.99)

# ----
process_to_projection = FalseStartToggle(False)

projection = Boolean(process_to_projection)
integer = Integer(pick_what_to_project_on_breps)
integer_2 = Integer(pick_to_display_in_setup_booth)
boolean = Boolean(group_projection_curves)
boolean_2 = Boolean(one_side_projection_not_perfect)
boolean_3 = Boolean(bake_booth_view_projection_curves)
integer_3 = Integer(a_bug)
number = Number(projection_indicator)

# ---- group: GH manager / ScribblesControl
# ScribblesControl
get_scribbles = GetScribbles()  # -> Scribbles, ScribbleText, ScribblePlane, ScribbleSize; disabled
get_groups = GetGroups()  # -> Groups, GroupStyles, Nickname, Color; disabled
panel_2 = Panel("Arial")  # disabled
button_2 = Button()  # disabled
label_groups = LabelGroups(Groups=get_groups.Groups, Run=button_2)  # disabled
set_scribble_properties = SetScribbleProperties(Scribble=get_scribbles.Scribbles, ScribbleFont=panel_2)  # disabled

# ----
# Design Strategy
volume = Volume(Geometry=import_primitives_here)  # -> Volume, Centroid
target_volume_brep = Brep(<brep referenced from the Rhino model>)
volume_2 = Volume(Geometry=target_volume_brep)  # -> Volume, Centroid
mass_addition = MassAddition(Input=volume.Volume)  # -> Result, PartialResults
division = Division(A=volume_2.Volume, B=mass_addition.Result)
the_ratio_of_volume_between_parts_target = Panel(division)

# ----
# Site Type Selection
filter = StreamFilter(Gate=list, Stream0=fullwall, Stream1=nowall, Stream2=onewall)
site_w_walls_in_solid = Brep(filter)
site_bottom_in_solid = Brep(<brep referenced from the Rhino model>)

# ----
# Define Primitives & Site
brep = Brep(import_primitives_here)
brep_2 = Brep(site_w_walls_in_solid)
mesh_brep = MeshBrep(
    Brep=brep_2,
    Settings={GridMaxCount=0, GridMinCount=16, JaggedSeams=False, MaxEdgeLength=0, MinEdgeLength=0.0001, MinTolerance=0, Refine=True, RefineAngle=0, RelativeTolerance=0.65, SimplePlanes=True, Tolerance=0})
sort_list = SortList(Keys=brep, ValuesValuesA=brep)  # -> Keys, ValuesValuesA
brep_3 = Brep(simplify(graft(sort_list.ValuesValuesA)))
mesh = Mesh(mesh_brep)

# ----
# Define points on Primitives
density_of_pts = Slider(3.7, range=0..10)
brep_4 = Brep(brep_3)
deconstruct_brep = DeconstructBrep(Brep=brep_4)  # -> Faces, Edges, simplify(Vertices)
bounding_box = BoundingBox(Content=brep_4, Plane=PlaneXY(0, 0, 0))  # -> simplify(Box), Box_2
volume_3 = Volume(Geometry=bounding_box.Box)  # -> Volume, Centroid
power_of_10 = PowerOf10(Value=density_of_pts)
list_length = ListLength(List=deconstruct_brep.Vertices)
division_2 = Division(A=volume_3.Volume, B=power_of_10)
subtraction = Subtraction(A=division_2, B=list_length)
maximum = Maximum(A=subtraction, B=0)
centerpoint = Point(volume_3.Centroid)
integer_4 = Integer(maximum)
populate_geometry = PopulateGeometry(Geometry=brep_4, Count=integer_4, Seed=1, Points=deconstruct_brep.Vertices)  # -> simplify(Population)
mass_multiplication = MassMultiplication(Input=flatten(integer_4))  # -> Result, PartialResults
logarithm = Logarithm(Value=mass_multiplication.Result)
no_pts = Panel(logarithm)
merge_2 = Merge(Data1=centerpoint, Data2=populate_geometry, Data3=deconstruct_brep.Vertices)
sort_duplicate_points = SortDuplicatePoints(Points=merge_2)  # -> UniquePoints, Indices
pointcloud = Point(sort_duplicate_points.UniquePoints)

# ---- group: GH manager / ComponentTracing
# ComponentTracing
component_info = ComponentInfo(Component=document_info.Components)  # -> Name, NickName, Guid, ComponentGuid, Inputs, Outputs, Pivot, Bounds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; disabled
number_slider_4 = Slider(0, range=0..10)  # disabled
list_item = ListItem(List=assembly_info.FullName, Index=number_slider_4, Wrap=True)  # disabled
text_split = TextSplit(Text=component_info.Assembly, Separators=", ")  # disabled
text_split_2 = TextSplit(Text=list_item, Separators=",")  # disabled
list_item_2 = ListItem(List=text_split, Index=0, Wrap=True)  # -> flatten(Item); disabled
list_item_3 = ListItem(List=text_split_2, Index=0, Wrap=True)  # -> flatten(Item); disabled
panel_3 = Panel(list_item_3)  # disabled
panel_4 = Panel(text_split)  # disabled
text_distance = TextDistance(TextA=list_item_2, TextB=list_item_3, Case=True)  # disabled
boolean_4 = Boolean(text_distance)  # disabled
gate_not = GateNot(A=boolean_4)  # -> graft(Result); disabled
dispatch = Dispatch(List=gate_not, DispatchPattern=gate_not)  # -> ListA, ListB; disabled
clean_tree = CleanTree(RemoveNulls=True, RemoveInvalid=True, RemoveEmpty=True, Tree=dispatch.ListA)  # disabled
tree_statistics = TreeStatistics(Tree=clean_tree)  # -> Paths, Length, Count; disabled
deconstruct_path = DeconstructPath(Branch=tree_statistics.Paths)  # disabled
list_item_4 = ListItem(List=deconstruct_path, Index=1, Wrap=True)  # -> flatten(Item); disabled
list_item_5 = ListItem(List=component_info.Pivot, Index=list_item_4, Wrap=True)  # -> flatten(Item); disabled
panel_5 = Panel(list_item_5)  # disabled
panel_6 = Panel(clean_tree)  # disabled

# ---- group: GH manager
# Text Pad Color Control
colour_picker = ColourPicker(PickedColour=RGBA(128, 128, 128, 150))  # disabled
set_panel_properties = SetPanelProperties(
    Panel=["Grasshopper.Kernel.Types.GH_ObjectWrapper", "Grasshopper.Kernel.Types.GH_ObjectWrapper", "Grasshopper.Kernel.Types.GH_ObjectWrapper", "Grasshopper.Kernel.Types.GH_ObjectWrapper", "Grasshopper.Kernel.Types.GH_ObjectWrapper"],
    Color=colour_picker)  # disabled

# ---- group: Box Primitives Collision
point = Point(pointcloud)
mesh_2 = Mesh(mesh)
number_2 = Number(boxcollisionstrength)
power_of_10_2 = PowerOf10(Value=number_2)
solidpointcollide = SolidPointCollide(Points=flatten(point), Solid=mesh_2, Interior=False, Unidirectional=True, Strength=power_of_10_2)
data = Data(solidpointcollide)

# ---- group: Primitives rigid body
# Kangroo Input Goals
brep_5 = Brep(brep_3)
point_2 = Point(centerpoint)
point_3 = Point(pointcloud)
number_3 = Number(rigidbodystrength)
power_of_10_3 = PowerOf10(Value=number_3)
rigidbody = RigidBody(Part=simplify(brep_5), Plane=point_2, Points=point_3, Strength=power_of_10_3)  # -> simplify(RigidBody), Planes
data_2 = Data(rigidbody.RigidBody)

# ---- group: Gravity
number_4 = Number(gravitydirectiondeviation)
point_4 = Point(pointcloud)
list_length_2 = ListLength(List=point_4)
negative = Negative(Value=number_4)
construct_domain = ConstructDomain(DomainStart=negative, DomainEnd=number_4)
tree_statistics_2 = TreeStatistics(Tree=list_length_2)  # -> Paths, Length, Count
deconstruct_path_2 = DeconstructPath(Branch=tree_statistics_2.Paths)  # -> simplify(Indices)
random = Random(Range=construct_domain, Number=list_length_2, Seed=expr("x+1", deconstruct_path_2))  # -> simplify(Random)
random_2 = Random(Range=construct_domain, Number=list_length_2, Seed=expr("x^2", deconstruct_path_2))  # -> simplify(Random)
number_5 = Number(random)
number_6 = Number(random_2)

number_7 = Number(gravitystrength)
number_8 = Number(number_5)
number_9 = Number(number_6)
point_5 = Point(point_4)
power_of_10_4 = PowerOf10(Value=number_7)
vector_xyz = VectorXYZ(XComponent=number_8, YComponent=number_9, ZComponent=power_of_10_4)  # -> Vector, Length
clean_tree_2 = CleanTree(RemoveNulls=True, RemoveInvalid=True, RemoveEmpty=True, Tree=point_5, SynchronousTree1=vector_xyz.Vector)  # -> Tree, SynchronousTree1
reverse = Reverse(Vector=clean_tree_2.SynchronousTree1)
load = Load(Point=clean_tree_2.Tree, ForceVector=reverse)
data_3 = Data(load)

# ---- group: GH manager
# Group Color Control
colour_picker_2 = ColourPicker(PickedColour=RGBA(0, 255, 255, 150))  # disabled
set_group_properties = SetGroupProperties(
    Group=["Grasshopper.Kernel.Types.GH_ObjectWrapper", "Grasshopper.Kernel.Types.GH_ObjectWrapper", "Grasshopper.Kernel.Types.GH_ObjectWrapper"],
    Color=colour_picker_2)  # disabled

# ----
# VrayRender Animation Production
coefficientofrendering = Slider(2, range=0..3)
totalframesdesired = Slider(100, range=0..500)
iterations_per_frame = Slider(2, range=1..50)
resolutionheight = Slider(100, range=0..5000)
resolutionwidth = Slider(100, range=0..5000)
file_path_vray_material = Panel("C:\ProgramData\ASGvis\Materials\Velvet\Velvet White.vrmat")
file_saving_destination = Panel("C:\Users\Desktop\AnimationTest")

# ---- group: Kangaroo Control
# Kangaroo Physics Control
iterations_per_step = Slider(50, range=1..500)
doubleclicktokeepplaying = FalseStartToggle(False)
clicktoplayonestep = Button()
entwine = Entwine(
    Branch00=reset,
    Branch01=clicktoplayonestep,
    Branch02=doubleclicktokeepplaying,
    Branch03=damping,
    Branch04=iterations_per_step,
    FlattenInputs=True)

# ----
# Recorder
# Note: 1. Clear Recorder (press X below)
# 2. Reset Kangaroo
# 3. Make sure it is recording
# 4. Run Kangaroo
# 5. Select Used Recorderd Geometry
# 6. Use slider to choose result
iteration = Slider(0, range=0..500)

# ---- group: Random color assignment
random_3 = Random(Range=Domain(0, 1), Number=3, Seed=number_slider)
explode_tree = ExplodeTree(Data=simplify(graft(random_3)))  # -> Branch0, Branch1, Branch2
colour_xyz = ColourXYZ(Alpha=1, X=explode_tree.Branch0, Y=explode_tree.Branch1, Z=explode_tree.Branch2)

# ----
# Projection Direction
boolean_5 = Boolean(projection)
number_10 = Number(number)
stream_filter = StreamFilter(Gate=boolean_5, Stream1=projection_pad)
projection_pad_4 = Curve(stream_filter)
control_points = ControlPoints(Curve=projection_pad_4)  # -> Points, Weights, Knots
is_planar = IsPlanar(Surface=projection_pad_4, Interior=True)  # -> Planar, Plane
plane = Plane(is_planar.Plane)
amplitude = Amplitude(Vector=plane, Amplitude=expr("-x", number_10))

boolean_6 = Boolean(boolean_2)
curve = Curve(patterntreatment)
boolean_7 = Boolean(integer_3)
boolean_8 = Boolean(integer)

# ----
# Projection Curve
group_toggle_2 = GroupToggle(ToggleActive=True, ToggleVisible=False)  # disabled

# ---- group: Bakery
boolean_9 = Boolean(boolean)
integer_5 = Integer(number_slider)
boolean_10 = Boolean(boolean_3)
concatenate = Concatenate(FragmentA="Pattern ", FragmentB=integer_5)

# ---- group: Random color assignment
random_4 = Random(Range=Domain(0, 1), Number=3, Seed=number_slider_2)
explode_tree_2 = ExplodeTree(Data=simplify(graft(random_4)))  # -> Branch0, Branch1, Branch2
colour_xyz_2 = ColourXYZ(Alpha=1, X=explode_tree_2.Branch0, Y=explode_tree_2.Branch1, Z=explode_tree_2.Branch2)

# ----
# Projection Direction
boolean_11 = Boolean(projection)
number_11 = Number(number)
stream_filter_2 = StreamFilter(Gate=boolean_11, Stream1=projection_pad_2)
projection_pad_5 = Curve(stream_filter_2)
control_points_2 = ControlPoints(Curve=projection_pad_5)  # -> Points, Weights, Knots
is_planar_2 = IsPlanar(Surface=projection_pad_5, Interior=True)  # -> Planar, Plane
plane_2 = Plane(is_planar_2.Plane)
amplitude_2 = Amplitude(Vector=plane_2, Amplitude=expr("-x", number_11))

boolean_12 = Boolean(boolean_2)
curve_2 = Curve(patterntreatment_2)
boolean_13 = Boolean(integer_3)
boolean_14 = Boolean(integer)

# ----
# Move into projection booth
gap = Number(distance_between_views)
showsite = Boolean(site_display_seletion)

# ---- group: Bakery
boolean_15 = Boolean(boolean_3)
integer_6 = Integer(number_slider_2)
boolean_16 = Boolean(boolean)
concatenate_2 = Concatenate(FragmentA="Pattern ", FragmentB=integer_6)

# ----
# Kangaroo Brain
ctrldata = Data(entwine)
boolean_17 = Boolean(switch_kangaroo_to_animationmood)
boxcollide = Data(data)
rigidbody_2 = Data(data_2)
gravity = Data(data_3)
explode_tree_3 = ExplodeTree(Data=ctrldata)  # -> Branch0, Branch1, Branch2, Branch3, Branch4
gate_or = GateOr(A=explode_tree_3.Branch1, B=explode_tree_3.Branch2)
merge_3 = Merge(Data1=boxcollide, Data2=gravity, Data3=rigidbody_2)
stream_gate = StreamGate(Stream=merge_3, Gate=boolean_17)  # -> Target0, Target1
bouncysolver = BouncySolver(
    GoalObjects=stream_gate.Target0,
    Reset=explode_tree_3.Branch0,
    Threshold=0.01,
    Tolerance=0.01,
    Damping=explode_tree_3.Branch3,
    Iterations=explode_tree_3.Branch4,
    On=gate_or)  # -> I, V, O
sitebottom = Brep(site_bottom_in_solid)
sitebrep = Brep(site_w_walls_in_solid)
iteration_2 = Data(bouncysolver.I)

# ---- group: Kangaroo Control (continued)
total_current_iterations = Panel(iteration_2)

# ----
sitebrep_2 = Brep(sitebrep)

# ----
# Recorder
list_length_3 = ListLength(List=import_primitives_here)

align_axis = ValueList({"NONE": 0, "X": 1, "Y": 2, "Z": 3, "XY": 4, "XZ": 5, "YZ": 6, "XYZ": 7}, selected="NONE")
geometryindex = Slider(3, range=0..10)

subtraction_2 = Subtraction(A=iteration, B=2)
multiplication = Multiplication(A=subtraction_2, B=total_current_iterations)

frame = Panel(multiplication)

# ---- group: Random color assignment
random_5 = Random(Range=Domain(0, 1), Number=3, Seed=number_slider_3)
explode_tree_4 = ExplodeTree(Data=simplify(graft(random_5)))  # -> Branch0, Branch1, Branch2
colour_xyz_3 = ColourXYZ(Alpha=1, X=explode_tree_4.Branch0, Y=explode_tree_4.Branch1, Z=explode_tree_4.Branch2)

# ----
# Projection Direction
boolean_18 = Boolean(projection)
number_12 = Number(number)
stream_filter_3 = StreamFilter(Gate=boolean_18, Stream1=projection_pad_3)
projection_pad_6 = Curve(stream_filter_3)
control_points_3 = ControlPoints(Curve=projection_pad_6)  # -> Points, Weights, Knots
is_planar_3 = IsPlanar(Surface=projection_pad_6, Interior=True)  # -> Planar, Plane
plane_3 = Plane(is_planar_3.Plane)
amplitude_3 = Amplitude(Vector=plane_3, Amplitude=expr("-x", number_12))

boolean_19 = Boolean(boolean_2)
curve_3 = Curve(patterntreatment_3)
boolean_20 = Boolean(integer_3)
boolean_21 = Boolean(integer)

# ---- group: Projection booth size indicator
boolean_22 = Boolean(projection)
integer_7 = Integer(integer_2)
mass_multiplication_2 = MassMultiplication(Input=integer_7)  # -> Result, PartialResults
gate_and = GateAnd(A=invert(mass_multiplication_2.Result), B=boolean_22)
boolean_23 = Boolean(mass_multiplication_2.Result)

# ----
boolean_24 = Boolean(boolean_23)
stream_filter_4 = StreamFilter(Gate=boolean_24, Stream0=control_points.Points)
vector_display = VectorDisplay(Anchor=stream_filter_4, Vector=amplitude)

boolean_25 = Boolean(boolean_23)
stream_filter_5 = StreamFilter(Gate=boolean_25, Stream0=control_points_2.Points)
vector_display_2 = VectorDisplay(Anchor=stream_filter_5, Vector=amplitude_2)

boolean_26 = Boolean(boolean_23)
stream_filter_6 = StreamFilter(Gate=boolean_26, Stream0=control_points_3.Points)
vector_display_3 = VectorDisplay(Anchor=stream_filter_6, Vector=amplitude_3)

entwine_2 = Entwine(Branch00=projection_pad, Branch01=projection_pad_2, Branch02=projection_pad_3, FlattenInputs=True)
projection_curves = Curve(entwine_2)

# ---- group: Projection booth size indicator (continued)
projection_curves_2 = Curve(projection_curves)
stream_filter_7 = StreamFilter(Gate=gate_and, Stream1=flatten(projection_curves_2))
bounding_box_2 = BoundingBox(Content=stream_filter_7, Plane=PlaneXY(0, 0, 0), UnionBox=True)  # -> Box, Box_2
brep_edges = BrepEdges(Brep=bounding_box_2.Box)  # -> Naked, Interior, NonManifold
list_item_6 = ListItem(List=brep_edges.Interior, Index=0, Wrap=True)  # -> Item, Item1
length = Length(Curve=list_item_6.Item)
length_2 = Length(Curve=list_item_6.Item1)
list_item_7 = ListItem(List=brep_edges.Interior, Index=8, Wrap=True)
length_3 = Length(Curve=list_item_7)
curve_4 = Curve(brep_edges.Interior)
integer_8 = Integer(length)
integer_9 = Integer(length_3)
integer_10 = Integer(length_2)
line_dimension = LineDimension(Line=list_item_6.Item, Text=integer_8, Size=expr("x/20", integer_8))
line_dimension_2 = LineDimension(Line=list_item_6.Item1, Text=integer_10, Size=expr("x/20", integer_10))
line_dimension_3 = LineDimension(Line=list_item_7, Text=integer_9, Size=expr("x/20", integer_9))

# ---- group: Bakery
integer_11 = Integer(number_slider_3)
boolean_27 = Boolean(boolean_3)
boolean_28 = Boolean(boolean)
concatenate_3 = Concatenate(FragmentA="Pattern ", FragmentB=integer_11)

# ----
# Initialize the Geometries & Points
options_selected = Integer(simplify(merge))
site_display_seletion_2 = Integer(site_display_seletion)
sitebottom_2 = Brep(simplify(sitebottom))
sitebrep_3 = Brep(simplify(sitebrep))
brepsnm = Brep(brep_3)
gap_2 = Number(distance_between_views)
bounding_box_3 = BoundingBox(Content=flatten([brepsnm, sitebrep_3]), Plane=PlaneXY(0, 0, 0), UnionBox=True)  # -> Box, Box_2
stream_filter_8 = StreamFilter(Gate=site_display_seletion_2, Stream1=sitebrep_3, Stream2=sitebottom_2)
area = Area(Geometry=bounding_box_3.Box)  # -> Area, Centroid
box_corners = BoxCorners(Box=bounding_box_3.Box)  # -> CornerA, CornerB, CornerC, CornerD, CornerE, CornerF, CornerG, CornerH
deconstruct_box = DeconstructBox(Box=bounding_box_3.Box)  # -> Plane, X, Y, Z
number_13 = Number(deconstruct_box.X)
number_14 = Number(deconstruct_box.Y)
number_15 = Number(deconstruct_box.Z)
xy_plane = XYPlane(Origin=Point(0, 0, 0))
vector_xyz_2 = VectorXYZ(XComponent=gap_2, YComponent=gap_2, ZComponent=0)  # -> expr("-x", Vector), Length
move = Move(Geometry=xy_plane, Motion=vector_xyz_2.Vector)  # -> Geometry, Transform
vector_2pt = Vector2Pt(PointA=box_corners.CornerC, PointB=move.Geometry, Unitize=False)  # -> Vector, Length
move_2 = Move(Geometry=area.Centroid, Motion=vector_2pt.Vector)  # -> Geometry, Transform
extremes = Extremes(A=number_13, B=number_14, C=number_15)  # -> Mininum, Maximum
pointonboxnm_forprojbooth = Point(box_corners.CornerB)
maxdimension = Number(extremes.Maximum)
boxnm = Box(bounding_box_3.Box)
vector = Data(vector_2pt.Vector)
refpt = Point(move_2.Geometry)

# ----
# Essential Data
shear = Panel("""0
0
0
0
0
0
0
0
0
0
0
0
0
0
1
1
1
1
1
1
1
1""")
X = Panel("""0
-1
1
0
0
0
1
1
-1
-1
0
1
0
-1
0
0
0
0
0
0
0
0""")
Y = Panel("""0
0
0
1
-1
0
-1
1
1
-1
-1
0
1
0
0
0
0
0
0
0
0
0""")
Z = Panel("""1
0
0
0
0
-1
1
1
1
1
1
1
1
1
1
1
1
1
1
1
1
1""")
roz = Panel("""0
0
0
.5
1.5
0
0
0
0
0
1.5
.5
.5
1.5
1.75
1.25
0.75
0.25
0
1.5
1
0.5""")
list_keep_null = ListKeepNull(data=X, selection=options_selected)
list_keep_null_2 = ListKeepNull(data=Y, selection=options_selected)
list_keep_null_3 = ListKeepNull(data=Z, selection=options_selected)
list_keep_null_4 = ListKeepNull(data=roz, selection=options_selected)
list_keep_null_5 = ListKeepNull(data=shear, selection=options_selected)
X_2 = Data(list_keep_null)
Y_2 = Data(list_keep_null_2)
Z_2 = Data(list_keep_null_3)
roz_2 = Data(list_keep_null_4)
shear_2 = Data(list_keep_null_5)
X_3 = Panel(X_2)
Y_3 = Panel(Y_2)
Z_3 = Panel(Z_2)
roz_3 = Panel(list_keep_null_4)
shear_3 = Panel(shear_2)

# ----
# Position
shift_y = Panel("""0
0
0
0
0
0
1
1
1
1
2
2
2
2
3
3
3
3
4
4
4
4""")
max_dimension = Number(maxdimension)
shift_x = Panel("""0
1
2
3
4
5
0
1
2
3
0
1
2
3
0
1
2
3
0
1
2
3""")
gap_3 = Number(distance_between_views)
addition = Addition(A=gap_3, B=max_dimension)
multiplication_2 = Multiplication(A=addition, B=shift_x)
distance_shift_x = Integer(simplify(multiplication_2))
list_keep_null_6 = ListKeepNull(data=distance_shift_x, selection=options_selected)
addition_2 = Addition(A=gap_3, B=max_dimension)
multiplication_3 = Multiplication(A=addition_2, B=shift_y)
distance_shift_y = Integer(simplify(multiplication_3))
list_keep_null_7 = ListKeepNull(data=distance_shift_y, selection=options_selected)
vector_xyz_3 = VectorXYZ(XComponent=list_keep_null_6, YComponent=list_keep_null_7, ZComponent=0)  # -> expr("-x", Vector), Length
vectors = Data(vector_xyz_3.Vector)

# ---- group: Label
# Visualization
# Viewports Label
viewports = ValueList({"Top": 0, "Left": 1, "Right": 2, "Back": 3, "Front": 4, "Buttom": 5, "IsoSE": 6, "IsoNE": 7, "IsoNW": 8, "IsoSW": 9, "EdgeIsoS": 10, "EdgeIsoE": 11, "EdgeIsoN": 12, "EdgeIsoW": 13, "AxonSE": 14, "AxonNE": 15, "AxonNW": 16, "AxonSW": 17, "AxonEdgeS": 18, "AxonEdgeE": 19, "AxonEdgeN": 20, "AxonEdgeW": 21}, selected=["Top", "Left", "Right", "Back", "Front", "Buttom", "IsoSE", "IsoNE", "IsoNW", "IsoSW", "EdgeIsoS", "EdgeIsoE", "EdgeIsoN", "EdgeIsoW", "AxonSE", "AxonNE", "AxonNW", "AxonSW", "AxonEdgeS", "AxonEdgeE", "AxonEdgeN", "AxonEdgeW"])
get_connected_objects = GetConnectedObjects(Objects=viewports)  # disabled
refpt_2 = Point(refpt)
vector_2 = Data(vector_xyz_3.Vector)
bakelayer = Panel("Txt")
maxdimension_2 = Number(maxdimension)
show_label = Boolean(show_the_labels)
# Viewports Generator
bake_text_2 = Boolean(bake_text)
stream_filter_9 = StreamFilter(Gate=show_label, Stream1=maxdimension_2)
vector_xyz_4 = VectorXYZ(XComponent=maxdimension_2, YComponent=maxdimension_2, ZComponent=0)  # -> expr("-0.5*x", Vector), Length
move_3 = Move(Geometry=refpt_2, Motion=vector_2)  # -> Geometry, Transform
get_list_data = GetListData(ObjectToSet=get_connected_objects)  # -> NickName, Keys, Values, SelectedIndex; disabled
move_4 = Move(Geometry=move_3.Geometry, Motion=vector_xyz_4.Vector)  # -> Geometry, Transform
rectangle = Rectangle(Plane=move_4.Geometry, XSize=stream_filter_9, YSize=stream_filter_9, Radius=0)  # -> Rectangle, Length
text_2 = Text(["Top", "Left", "Right", "Back", "Front", "Buttom", "IsoSE", "IsoNE", "IsoNW", "IsoSW", "EdgeIsoS", "EdgeIsoE", "EdgeIsoN", "EdgeIsoW", "AxonSE", "AxonNE", "AxonNW", "AxonSW", "AxonEdgeS", "AxonEdgeE", "AxonEdgeN", "AxonEdgeW"])
viewnames = Panel(text_2)
stream_filter_10 = StreamFilter(Gate=show_label, Stream1=viewnames)  # -> simplify(graft(Stream))
text_tag = TextTag(Location=move_4.Geometry, Text=stream_filter_10)
bake_text_3 = DotNETVBScriptLEGACY(L=bakelayer, P=move_4.Geometry, T=stream_filter_10, H=20, E=bake_text_2)  # -> out
# ---------- bake_text_3: VB ----------
    'Make sure Bake toggle is set to true
    If( E ) Then 
    'Call Create Layer Function
      Call CreateLayer(L)

    'Call Add Text Function
      Call AddText(P, T, H, F, S)
    End If
# ---------- bake_text_3: VB additional code ----------
  'Function to create new layer and set as current
  Sub CreateLayer (ByVal L As String)

    'decalere a variable to hold current layer index
    Dim current_layer_i As Integer
    current_layer_i = doc.m_layer_table.CurrentLayerIndex()

    'check if input layer already exist, otherwise create new layer
    Dim layer_i As Integer
    layer_i = doc.m_layer_table.FindLayer(L)

    'Create new layer
    If layer_i = -1 Then

      'Declare and instentiate new layer
      Dim new_layer As New OnLayer()

      'Set layer name
      new_layer.SetLayerName(L)

      'Add layer to document and get its index
      layer_i = RhUtil.RhinoApp().ActiveDoc().m_layer_table.AddLayer(new_layer)

    End If

    'Set current layer to the new layer index
    doc.m_layer_table.SetCurrentLayerIndex(layer_i)

  End Sub

  'Function to Add Text to Doc
  Sub AddText (ByVal P As On3dPoint, ByVal T As String, ByVal H As Double, ByVal F As String, ByVal S As Integer)

    If (H <= 0) Then H = 1.0
    If (String.IsNullOrEmpty(F)) Then F = "Arial"
    If (S < 0 Or S > 3) Then S = 0

    Dim plane As New OnPlane(RhUtil.RhinoActiveCPlane())
    plane.SetOrigin(P)

    Dim text_entity As New OnTextEntity2()
    Dim text_object As New MRhinoAnnotationText()
    text_object.SetAnnotation(text_entity)
    text_object.SetTextHeight(H)
    text_object.SetString(T)
    text_object.SetPlane(plane)

    Dim bold As Boolean = False
    If (S = 1 Or S = 3) Then bold = True
    Dim italic As Boolean = False
    If (S = 2 Or S = 3) Then italic = True
    Dim idx As Integer = doc.m_font_table.FindOrCreateFont(F, bold, italic)
    text_object.SetFontIndex(idx)

    If (doc.AddObject(text_object)) Then
      doc.Redraw()
    End If
  End Sub
# ---------- end bake_text_3 ----------

# ----
maxdimension_3 = Number(maxdimension)
boxcpointnm = Point(pointonboxnm_forprojbooth)
vector_3 = Vector(boxcpointnm)
integer_division = IntegerDivision(A=maxdimension_3, B=gap)  # -> expr("x+1", Result)
multiplication_4 = Multiplication(A=gap, B=integer_division)
vector_xyz_5 = VectorXYZ(XComponent=expr("-x", multiplication_4), YComponent=multiplication_4, ZComponent=0)  # -> Vector, Length
subtraction_3 = Subtraction(A=vector_xyz_5.Vector, B=vector_3)
vector_4 = Vector(subtraction_3)

vector_5 = Vector(vector_4)

# ---- group: LAB
A = Slider(0, range=0..1)
A_2 = Slider(1, range=0..1)
construct_domain_2 = ConstructDomain(DomainStart=A, DomainEnd=A_2)
B = Slider(0, range=0..1)
B_2 = Slider(1, range=0..1)
construct_domain_3 = ConstructDomain(DomainStart=B, DomainEnd=B_2)
L = Slider(0, range=0..1)
L_2 = Slider(1, range=0..1)
construct_domain_4 = ConstructDomain(DomainStart=L, DomainEnd=L_2)
entwine_3 = Entwine(Branch00=construct_domain_4, Branch01=construct_domain_2, Branch02=construct_domain_3, FlattenInputs=True)  # -> simplify(Result)

# ---- group: HSL
hue = Slider(0.2, range=0..1)
luminance = Slider(0, range=0..1)
hue_2 = Slider(0, range=0..1)
construct_domain_5 = ConstructDomain(DomainStart=hue_2, DomainEnd=hue)
saturation = Slider(1, range=0..1)
saturation_2 = Slider(0.85, range=0..1)
construct_domain_6 = ConstructDomain(DomainStart=saturation, DomainEnd=saturation_2)
luminance_2 = Slider(1, range=0..1)
construct_domain_7 = ConstructDomain(DomainStart=luminance, DomainEnd=luminance_2)
entwine_4 = Entwine(Branch00=construct_domain_5, Branch01=construct_domain_6, Branch02=construct_domain_7, FlattenInputs=True)  # -> simplify(Result)

# ----
# Color Control
integer_12 = Integer(color_space)

# ---- group: LCH
C = Slider(0.03, range=0..1)
C_2 = Slider(1, range=0..1)
construct_domain_8 = ConstructDomain(DomainStart=C, DomainEnd=C_2)
H = Slider(0, range=0..1)
H_2 = Slider(1, range=0..1)
construct_domain_9 = ConstructDomain(DomainStart=H, DomainEnd=H_2)
L_3 = Slider(0.44, range=0..1)
L_4 = Slider(1, range=0..1)
construct_domain_10 = ConstructDomain(DomainStart=L_3, DomainEnd=L_4)
entwine_5 = Entwine(Branch00=construct_domain_10, Branch01=construct_domain_8, Branch02=construct_domain_9, FlattenInputs=True)  # -> simplify(Result)

# ---- group: RGB
B_3 = Slider(0, range=0..255)
B_4 = Slider(255, range=0..255)
construct_domain_11 = ConstructDomain(DomainStart=B_3, DomainEnd=B_4)
R = Slider(244.14, range=0..255)
R_2 = Slider(255, range=0..255)
construct_domain_12 = ConstructDomain(DomainStart=R, DomainEnd=R_2)
G = Slider(0, range=0..255)
G_2 = Slider(255, range=0..255)
construct_domain_13 = ConstructDomain(DomainStart=G, DomainEnd=G_2)
entwine_6 = Entwine(Branch00=construct_domain_12, Branch01=construct_domain_13, Branch02=construct_domain_11, FlattenInputs=True)  # -> simplify(Result)

# ----
# Local Coordinate System
show_the_local_coordinate = Boolean(showlocalcoordinate)
brepsnm_2 = Brep(brep_3)
boxnm_2 = Box(boxnm)
sitebrep_4 = Geometry(sitebrep)
maxdimension_4 = Number(expr("0.02*x", maxdimension))
unit_z = UnitZ(Factor=1)
unit_x = UnitX(Factor=1)
unit_y = UnitY(Factor=1)
list_length_4 = ListLength(List=brepsnm_2)
stream_filter_11 = StreamFilter(Gate=show_the_local_coordinate, Stream1=brepsnm_2)
brepsnm_3 = Brep(simplify(graft(stream_filter_11)))
bounding_box_4 = BoundingBox(Content=brepsnm_3, Plane=PlaneXY(0, 0, 0))  # -> simplify(Box), Box_2
area_2 = Area(Geometry=bounding_box_4.Box)  # -> Area, Centroid
merge_4 = Merge(Data1=unit_x, Data2=unit_y, Data3=unit_z)
project_point = ProjectPoint(Point=area_2.Centroid, Direction=expr("-x", merge_4), Geometry=boxnm_2)  # -> Point, Index
series = Series(Start=0, Step=1, Count=list_length_4)
stream_filter_12 = StreamFilter(Gate=show_the_local_coordinate, Stream1=sitebrep_4)
line = Line(StartPoint=area_2.Centroid, EndPoint=project_point.Point)  # -> simplify(Line)
get_rhino_attributes = GetRhinoAttributes(Geometry=brepsnm_3)  # -> Name, Layer, Color
point_on_curve = PointOnCurve(line, parameter=0.797)
length_4 = Length(Curve=line)
split_argb = SplitARGB(Colour=get_rhino_attributes.Color, IntegerChannels=True)  # -> Alpha, Red, Green, Blue
colour_rgb = ColourRGB(Alpha=255, Red=split_argb.Red, Green=split_argb.Green, Blue=split_argb.Blue)
integer_13 = Integer(length_4)
get_rhino_attributes_2 = GetRhinoAttributes(Geometry=stream_filter_12)  # -> Name, Layer, Color
split_argb_2 = SplitARGB(Colour=get_rhino_attributes_2.Color, IntegerChannels=True)  # -> Alpha, Red, Green, Blue
colour_rgb_2 = ColourRGB(Alpha=255, Red=split_argb_2.Red, Green=split_argb_2.Green, Blue=split_argb_2.Blue)
brep_wireframe = BrepWireframe(Brep=boxnm_2, Density=-1)
define_text = DefineText(Text=integer_13, Plane=point_on_curve, Size=maxdimension_4, Font="Arial", Justification=0)
define_text_dot = DefineTextDot(Text=" ", Location=project_point.Point, Font="Arial", Size=maxdimension_4)
text_join = TextJoin(Text=[get_rhino_attributes.Layer, get_rhino_attributes.Name])
define_text_dot_2 = DefineTextDot(Text=text_join, Location=area_2.Centroid, Font="Arial", Size=maxdimension_4)
line_2 = Line(line)
curve_5 = Curve(flatten(brep_wireframe))
shader = Shader(colour_rgb)
shader_2 = Shader(colour_rgb_2)
custom_preview = CustomPreview(Geometry=curve_5, Shader=shader_2)

layer_name_of_imported_parts = Panel(get_rhino_attributes.Layer)

boundingboxcurve = Curve(curve_5)

# ---- group: XYZ
Y_4 = Slider(1, range=0..1)
Z_4 = Slider(0, range=0..1)
X_4 = Slider(0, range=0..1)
X_5 = Slider(1, range=0..1)
construct_domain_14 = ConstructDomain(DomainStart=X_4, DomainEnd=X_5)
Y_5 = Slider(0, range=0..1)
construct_domain_15 = ConstructDomain(DomainStart=Y_5, DomainEnd=Y_4)
Z_5 = Slider(1, range=0..1)
construct_domain_16 = ConstructDomain(DomainStart=Z_4, DomainEnd=Z_5)
entwine_7 = Entwine(Branch00=construct_domain_14, Branch01=construct_domain_15, Branch02=construct_domain_16, FlattenInputs=True)  # -> simplify(Result)

# ---- group: CMYK
M = Slider(0, range=0..1)
M_2 = Slider(1, range=0..1)
construct_domain_17 = ConstructDomain(DomainStart=M, DomainEnd=M_2)
Y_6 = Slider(0, range=0..1)
C_3 = Slider(0, range=0..1)
C_4 = Slider(1, range=0..1)
construct_domain_18 = ConstructDomain(DomainStart=C_3, DomainEnd=C_4)
Y_7 = Slider(1, range=0..1)
construct_domain_19 = ConstructDomain(DomainStart=Y_6, DomainEnd=Y_7)
entwine_8 = Entwine(Branch00=construct_domain_18, Branch01=construct_domain_17, Branch02=construct_domain_19, FlattenInputs=True)  # -> simplify(Result)

# ----
stream_filter_13 = StreamFilter(
    Gate=integer_12,
    Stream0=entwine_4,
    Stream1=entwine_6,
    Stream2=entwine_7,
    Stream3=entwine_3,
    Stream4=entwine_5,
    Stream5=entwine_8)

# ----
# Color Uniqueness
domain = Domain(stream_filter_13)
number_16 = Number(domain)
explode_tree_5 = ExplodeTree(Data=number_16)  # -> Branch0, Branch1, Branch2
galapagos = Galapagos(fitness=addition_4, gene=colorseedadjustment)

# ----
# Orient
vectors_2 = Data(vectors)
dist = Data(X_2)
dist_2 = Data(Z_2)
dist_3 = Data(shear_2)
dist_4 = Data(Y_2)
dist_5 = Data(roz_2)

# ----
# Bakery
integer_14 = Integer(iteration_2)
integer_15 = Integer(layernametype)
text_3 = Text(viewnames)
comma = Panel(",")

# ----
# Vray Render
# Animation production
filepathofvraymaterial = FilePath(file_path_vray_material)  # disabled
filesavingdestination = FilePath(file_saving_destination)  # disabled
totalframesint = Integer(totalframesdesired)  # disabled
range = Range(Domain=totalframesint, Steps=totalframesint)  # disabled
multiplication_5 = Multiplication(A=resolutionwidth, B=coefficientofrendering)  # disabled
multiplication_6 = Multiplication(A=resolutionheight, B=coefficientofrendering)  # disabled
multiplication_7 = Multiplication(A=iterations_per_frame, B=totalframesdesired)  # disabled
boolean_29 = Boolean(produceanimation)  # disabled
vb_script = VBScript(x=boolean_29)  # -> out, A; disabled
# ---------- vb_script: VB ----------
    If (x) Then
      c += 1
    Else
      c = 0
    End If

    A = c
# ---------- vb_script: VB additional code ----------
  Dim c As int32 = 0
# ---------- end vb_script ----------
timer = Timer(TimerInterval=1000, Target=[v_ray_animation, vb_script])  # disabled
integer_16 = Integer(range)  # disabled
list_item_8 = ListItem(List=integer_16, Index=vb_script.A, Wrap=True)  # disabled

current_frame = Panel(list_item_8)
iterationattheend = Panel(multiplication_7)

stepsolver = StepSolver(
    GoalObjects=stream_gate.Target1,
    Tolerance=0.01,
    Momentum=True,
    Damping=0.99,
    SubIterations=iterations_per_frame,
    Animate=current_frame)  # -> I, V, O
stream_filter_14 = StreamFilter(Gate=boolean_17, Stream0=bouncysolver.O, Stream1=stepsolver.O)
clean_tree_3 = CleanTree(RemoveNulls=True, RemoveInvalid=True, RemoveEmpty=False, Tree=stream_filter_14)

data_recorder = DataRecorder(clean_tree_3, DataLimit=-10, RecordData=True)

partition_list = PartitionList(List=data_recorder, Size=list_length_3)  # -> simplify(Chunks)
tree_statistics_3 = TreeStatistics(Tree=partition_list)  # -> Paths, Length, Count
list_item_9 = ListItem(List=tree_statistics_3.Paths, Index=iteration, Wrap=True)
tree_branch = TreeBranch(Tree=partition_list, Path=list_item_9, MaintainPaths=True)

breps = Data(tree_branch)

adjustment = Adjustment(adjustment=align_axis, initialgeometry=import_primitives_here, selectedgeoindex=geometryindex, resultgeometry=breps)  # -> geometryadjusted, initialstatus_2

replace_items = ReplaceItems(List=breps, Item=adjustment.geometryadjusted, Indices=geometryindex, Wrap=False)
stream_filter_15 = StreamFilter(Gate=geometry_preview, Stream0=clean_tree_3, Stream1=tree_branch, Stream2=replace_items)
breps_2 = Data(stream_filter_15)

breps_3 = Data(breps_2)
insert_items = InsertItems(List=breps_3, Item=sitebrep_2, Indices=-1, Wrap=True)  # -> simplify(List)
brep_site = Geometry(insert_items)
move_5 = Move(Geometry=breps_3, Motion=subtraction_3)  # -> Geometry, Transform
stream_filter_16 = StreamFilter(Gate=showsite, Stream0=breps_3, Stream1=brep_site)
move_6 = Move(Geometry=stream_filter_16, Motion=subtraction_3)  # -> Geometry, Transform
list_length_5 = ListLength(List=move_6.Geometry)
series_2 = Series(Start=0, Step=1, Count=list_length_5)
brep_6 = Geometry(flatten(move_5.Geometry))

primitivebrepsforprojection = Brep(brep_6)

brep_7 = Brep(primitivebrepsforprojection)
projection_one_side = ProjectionOneSide(
    one_side_projection=boolean_6,
    project_frame_or_pattern=boolean_8,
    drawingpadcrv=drawing_pad,
    projection_pad_crv=projection_pad_4,
    patterncrvs=curve,
    targetbreps=brep_7)  # -> curve_6, simplify(s_0)

# ---- group: Random color assignment (continued)
curvesonbreps = Curve(flatten(projection_one_side.s_0))
curvesinprojection = Curve(projection_one_side.curve_6)
curve_6 = Curve(curvesonbreps)

# ----
entwine_9 = Entwine(
    Branch00=projection_pad_4,
    Branch01=drawing_pad,
    Branch02=curve,
    Branch03=curvesinprojection,
    Branch04=curvesonbreps,
    FlattenInputs=True)  # -> simplify(Result)
tree_branch_2 = TreeBranch(Tree=entwine_9, Path=integer_2, MaintainPaths=True)

# ---- group: Random color assignment (continued)
custom_preview_2 = CustomPreview(Geometry=tree_branch_2, Shader=colour_xyz)

# ---- group: Bakery (continued)
curve_7 = Curve(curvesonbreps)
bake_attributes = BakeAttributes(objs=curve_7, layers=concatenate, colors=colour_xyz, activate=boolean_10, groupListTgthr=boolean_9)  # -> out; inputs objs: list, names: list of String, layers: list of String, colors: list of Color, pWidths: list of Double, wiresEach: list of Int32, materials: list, activate: Boolean, groupListTgthr: Boolean
# ---------- bake_attributes: C# ----------
    //Inserts geometry into the Rhino document, with custom attributes
    //Written by Giulio Piacentino
    //Version written 2011 10 18 - for Grasshopper 0.8.52

    if (activate)
    {
      int groupIndex = -1;
      if(groupListTgthr)
        groupIndex = doc.Groups.Add();

      for(int i = 0; i < objs.Count; i++)
      {
        object obj = objs[i];
        if(obj == null)
        {
          Print("No object to bake");
          return;
        }

        //Make new attribute to set name
        Rhino.DocObjects.ObjectAttributes att = new Rhino.DocObjects.ObjectAttributes();

        string name = names.Count > 0 ? names[i % names.Count] : null;
        //Set object name
        if(!string.IsNullOrEmpty(name))
        {
          att.Name = name;
        }

        Color color = colors.Count > 0 ? colors[i % colors.Count] : new Color();
        //Set color
        if(!color.IsEmpty)
        {
          att.ColorSource = Rhino.DocObjects.ObjectColorSource.ColorFromObject; //Make the color type "by object"
          att.ObjectColor = color;

          att.PlotColorSource = Rhino.DocObjects.ObjectPlotColorSource.PlotColorFromObject; //Make the plot color type "by object"
          att.PlotColor = color;
        }

        string layer = layers.Count > 0 ? layers[i % layers.Count] : null;
        //Set layer
        if(!string.IsNullOrEmpty(layer) && Rhino.DocObjects.Layer.IsValidName(layer))
        {
          //Get the current layer index
          Rhino.DocObjects.Tables.LayerTable layerTable = doc.Layers;
          int layerIndex = layerTable.Find(layer, true);

          if(layerIndex < 0) //This layer does not exist, we add it
          {
            Rhino.DocObjects.Layer onlayer = new Rhino.DocObjects.Layer(); //Make a new layer
            onlayer.Name = layer;

            layerIndex = layerTable.Add(onlayer); //Add the layer to the layer table
            if (layerIndex > -1) //We manged to add layer!
            {
              att.LayerIndex = layerIndex;
              Print("Added new layer to the document at position " + layerIndex + " named " + layer + ". ");
            } else
              Print("Layer did not add. Try cleaning up your layers."); //This never happened to me.
          }
          else
            att.LayerIndex = layerIndex; //We simply add to the existing layer
        }


        double pWidth = pWidths.Count > 0 ? pWidths[i % pWidths.Count] : 0;
        //Set plotweight
        if(pWidth > 0)
        {
          att.PlotWeightSource = Rhino.DocObjects.ObjectPlotWeightSource.PlotWeightFromObject;
          att.PlotWeight = pWidth;
        }


        object material = materials.Count > 0 ? materials[i % materials.Count] : null;
        //Set material
        bool materialByName = !string.IsNullOrEmpty(material as string);
        Rhino.Display.DisplayMaterial inMaterial = material as Rhino.Display.DisplayMaterial;
        if(material is Color)
        {
          inMaterial = new Rhino.Display.DisplayMaterial((Color) material);
        }
        if(material != null && inMaterial == null && !materialByName)
        {
          if(!(material is string))
          {
            try //We also resort to try with IConvertible
            {
              inMaterial = (Rhino.Display.DisplayMaterial) Convert.ChangeType(material, typeof(Rhino.Display.DisplayMaterial));
            }
            catch(InvalidCastException)
            {
            }
          }
        }
        if(inMaterial != null || materialByName)
        {
          string matName;

          if(!materialByName)
          {
            matName = string.Format("A:{0}-D:{1}-E:{2}-S:{3},{4}-T:{5}",
              Format(inMaterial.Ambient),
              Format(inMaterial.Diffuse),
              Format(inMaterial.Emission),
              Format(inMaterial.Specular),
              inMaterial.Shine.ToString(),
              inMaterial.Transparency.ToString()
              );
          }
          else
          {
            matName = (string) material;
          }

          int materialIndex = doc.Materials.Find(matName, true);
          if(materialIndex < 0 && !materialByName) //Material does not exist and we have its specs
          {
            materialIndex = doc.Materials.Add(); //Let's add it
            if(materialIndex > -1)
            {
              Print("Added new material at position " + materialIndex + " named \"" + matName + "\". ");
              Rhino.DocObjects.Material m = doc.Materials[materialIndex];
              m.Name = matName;
              m.AmbientColor = inMaterial.Ambient;
              m.DiffuseColor = inMaterial.Diffuse;
              m.EmissionColor = inMaterial.Emission;
              //m.ReflectionColor = no equivalent
              m.SpecularColor = inMaterial.Specular;
              m.Shine = inMaterial.Shine;
              m.Transparency = inMaterial.Transparency;
              //m.TransparentColor = no equivalent
              m.CommitChanges();

              att.MaterialSource = Rhino.DocObjects.ObjectMaterialSource.MaterialFromObject;
              att.MaterialIndex = materialIndex;
            }
            else
              Print("Material did not add. Try cleaning up your materials."); //This never happened to me.
          }
          else if(materialIndex < 0 && materialByName) //Material does not exist and we do not have its specs. We do nothing
          {
            Print("Warning: material name not found. I cannot set the source to this material name. Add a material with name: " + matName);
          }
          else
          {
            //If this material exists, we do not replace it!
            att.MaterialSource = Rhino.DocObjects.ObjectMaterialSource.MaterialFromObject;
            att.MaterialIndex = materialIndex;
          }
        }


        int wires = wiresEach.Count > 0 ? wiresEach[i % wiresEach.Count] : 0;
        //Set wire density
        if(wires == -1 || wires > 0)
        {
          att.WireDensity = wires;
        }

        Bake(obj, att, groupIndex);
      }
    }
    else
    {
      Print("Inactive");
    }

  }

  //<Custom additional code>

  void Bake(object obj, Rhino.DocObjects.ObjectAttributes att, int groupIndex)
  {
    if(obj == null)
      return;

    Guid id;

    //Bake to the right type of object
    if(obj is GeometryBase)
    {
      GeometryBase geomObj = obj as GeometryBase;

      switch(geomObj.ObjectType)
      {
        case Rhino.DocObjects.ObjectType.Brep:
          id = doc.Objects.AddBrep(obj as Brep, att);
          break;
        case Rhino.DocObjects.ObjectType.Curve:
          id = doc.Objects.AddCurve(obj as Curve, att);
          break;
        case Rhino.DocObjects.ObjectType.Point:
          id = doc.Objects.AddPoint((obj as Rhino.Geometry.Point).Location, att);
          break;
        case Rhino.DocObjects.ObjectType.Surface:
          id = doc.Objects.AddSurface(obj as Surface, att);
          break;
        case Rhino.DocObjects.ObjectType.Mesh:
          id = doc.Objects.AddMesh(obj as Mesh, att);
          break;
        case (Rhino.DocObjects.ObjectType) 1073741824://Rhino.DocObjects.ObjectType.Extrusion:
          id = (Guid) typeof(Rhino.DocObjects.Tables.ObjectTable).InvokeMember("AddExtrusion", BindingFlags.Instance | BindingFlags.InvokeMethod, null, doc.Objects, new object[]{obj, att});
          break;
        case Rhino.DocObjects.ObjectType.PointSet:
          id = doc.Objects.AddPointCloud(obj as Rhino.Geometry.PointCloud, att); //This is a speculative entry
          break;
        default:
          Print("The script does not know how to handle this type of geometry: " + obj.GetType().FullName);
          return;
      }
    }
    else
    {
      Type objectType = obj.GetType();

      if(objectType == typeof(Arc))
      {
        id = doc.Objects.AddArc((Arc) obj, att);
      }
      else if(objectType == typeof(Box))
      {
        id = doc.Objects.AddBrep(((Box) obj).ToBrep(), att);
      }
      else if(objectType == typeof(Circle))
      {
        id = doc.Objects.AddCircle((Circle) obj, att);
      }
      else if(objectType == typeof(Ellipse))
      {
        id = doc.Objects.AddEllipse((Ellipse) obj, att);
      }
      else if(objectType == typeof(Polyline))
      {
        id = doc.Objects.AddPolyline((Polyline) obj, att);
      }
      else if(objectType == typeof(Sphere))
      {
        id = doc.Objects.AddSphere((Sphere) obj, att);
      }
      else if(objectType == typeof(Point3d))
      {
        id = doc.Objects.AddPoint((Point3d) obj, att);
      }
      else if(objectType == typeof(Line))
      {
        id = doc.Objects.AddLine((Line) obj, att);
      }
      else if(objectType == typeof(Vector3d))
      {
        Print("Impossible to bake vectors");
        return;
      }
      else if(obj is IEnumerable)
      {
        int newGroupIndex;
        if(groupIndex == -1)
          newGroupIndex = doc.Groups.Add();
        else
          newGroupIndex = groupIndex;
        foreach(object o in obj as IEnumerable)
        {
          Bake(o, att, newGroupIndex);
        }
        return;
      }
      else
      {
        Print("Unhandled type: " + objectType.FullName);
        return;
      }
    }

    if(groupIndex != -1)
    {
      doc.Groups.AddToGroup(groupIndex, id);
      Print("Added " + obj.GetType().Name + " to group number " + groupIndex);
    }
    else
      Print("Added " + obj.GetType().Name);
  }

  static string Format(Color c)
  {
    return (new System.Text.StringBuilder("A")).Append(c.A.ToString()).Append("R").Append(c.R.ToString()).Append("G")
      .Append(c.G.ToString()).Append("B").Append(c.B.ToString()).ToString();
# ---------- end bake_attributes ----------

# ----
brep_8 = Brep(primitivebrepsforprojection)
projection_one_side_2 = ProjectionOneSide(
    one_side_projection=boolean_12,
    project_frame_or_pattern=boolean_14,
    drawingpadcrv=drawing_pad_2,
    projection_pad_crv=projection_pad_5,
    patterncrvs=curve_2,
    targetbreps=brep_8)  # -> curve_6, simplify(s_0)

# ---- group: Random color assignment (continued)
curvesonbreps_2 = Curve(flatten(projection_one_side_2.s_0))
curvesinprojection_2 = Curve(projection_one_side_2.curve_6)
curve_8 = Curve(curvesonbreps_2)

# ----
entwine_10 = Entwine(
    Branch00=projection_pad_5,
    Branch01=drawing_pad_2,
    Branch02=curve_2,
    Branch03=curvesinprojection_2,
    Branch04=curvesonbreps_2,
    FlattenInputs=True)  # -> simplify(Result)
tree_branch_3 = TreeBranch(Tree=entwine_10, Path=integer_2, MaintainPaths=True)

# ---- group: Random color assignment (continued)
custom_preview_3 = CustomPreview(Geometry=tree_branch_3, Shader=colour_xyz_2)

# ---- group: Bakery (continued)
curve_9 = Curve(curvesonbreps_2)
bake_attributes_2 = BakeAttributes(objs=curve_9, layers=concatenate_2, colors=colour_xyz_2, activate=boolean_15, groupListTgthr=boolean_16)  # -> out; inputs objs: list, names: list of String, layers: list of String, colors: list of Color, pWidths: list of Double, wiresEach: list of Int32, materials: list, activate: Boolean, groupListTgthr: Boolean; same code as bake_attributes

# ----
brep_9 = Brep(primitivebrepsforprojection)
projection_one_side_3 = ProjectionOneSide(
    one_side_projection=boolean_19,
    project_frame_or_pattern=boolean_21,
    drawingpadcrv=drawing_pad_3,
    projection_pad_crv=projection_pad_6,
    patterncrvs=curve_3,
    targetbreps=brep_9)  # -> curve_6, simplify(s_0)

# ---- group: Random color assignment (continued)
curvesinprojection_3 = Curve(projection_one_side_3.curve_6)
curvesonbreps_3 = Curve(flatten(projection_one_side_3.s_0))
curve_10 = Curve(curvesonbreps_3)

# ----
entwine_11 = Entwine(
    Branch00=projection_pad_6,
    Branch01=drawing_pad_3,
    Branch02=curve_3,
    Branch03=curvesinprojection_3,
    Branch04=curvesonbreps_3,
    FlattenInputs=True)  # -> simplify(Result)
tree_branch_4 = TreeBranch(Tree=entwine_11, Path=integer_2, MaintainPaths=True)

entwine_12 = Entwine(Branch00=curve_6, Branch01=curve_8, Branch02=curve_10, FlattenInputs=True)
move_7 = Move(Geometry=entwine_12, Motion=expr("-x", vector_5))  # -> Geometry, Transform
all_curves_positioned_back = Curve(simplify(move_7.Geometry))

# ---- group: Random color assignment (continued)
custom_preview_4 = CustomPreview(Geometry=tree_branch_4, Shader=colour_xyz_3)

# ---- group: Bakery (continued)
curve_11 = Curve(curvesonbreps_3)
bake_attributes_3 = BakeAttributes(objs=curve_11, layers=concatenate_3, colors=colour_xyz_3, activate=boolean_27, groupListTgthr=boolean_28)  # -> out; inputs objs: list, names: list of String, layers: list of String, colors: list of Color, pWidths: list of Double, wiresEach: list of Int32, materials: list, activate: Boolean, groupListTgthr: Boolean; same code as bake_attributes

# ----
breps_4 = Brep(breps_2)
curve_12 = Curve(all_curves_positioned_back)
insert_items_2 = InsertItems(List=breps_4, Item=stream_filter_8, Indices=-1, Wrap=True)  # -> simplify(List)
brep_site_2 = Geometry(insert_items_2)
entwine_13 = Entwine(Branch0X=simplify(graft(brep_site_2)), Branch1X=curve_12, FlattenInputs=False)
brep_site_curves = Geometry(entwine_13)
move_8 = Move(Geometry=brep_site_curves, Motion=vector_2pt.Vector)  # -> Geometry, Transform
transform = Transform(Geometry=area.Centroid, Transform=move_8.Transform)
reference_points_for_geometries = Point(transform)
selected_geometries = Geometry(move_8.Geometry)

selected_geometries_2 = Data(selected_geometries)
reference_points_for_geometries_2 = Data(reference_points_for_geometries)
cluster = Cluster_2(geoms=selected_geometries_2, dist=vectors_2)  # -> geomstree, disttree
cluster_2 = Cluster_2(geoms=selected_geometries_2, dist=dist)  # -> geomstree, disttree
cluster_3 = Cluster_2(geoms=selected_geometries_2, dist=dist_4)  # -> geomstree, disttree
cluster_4 = Cluster_2(geoms=selected_geometries_2, dist=dist_2)  # -> geomstree, disttree
cluster_5 = Cluster_2(geoms=selected_geometries_2, dist=dist_5)  # -> geomstree, disttree
cluster_6 = Cluster_2(geoms=selected_geometries_2, dist=dist_3)  # -> geomstree, disttree
cluster_7 = Cluster_2(geoms=reference_points_for_geometries_2, dist=vectors_2)  # -> geomstree, disttree
vector_xyz_6 = VectorXYZ(XComponent=cluster_2.disttree, YComponent=cluster_3.disttree, ZComponent=cluster_4.disttree)  # -> Vector, Length
pi = Pi(Factor=cluster_5.disttree)
param_viewer = ParamViewer(cluster.geomstree)
vector_6 = Data(cluster.disttree)
refpts = Point(cluster_7.geomstree)
xy_plane_2 = XYPlane(Origin=refpts)
plane_normal = PlaneNormal(Origin=refpts, ZAxis=vector_xyz_6.Vector)
orient = Orient(Geometry=cluster.geomstree, Source=plane_normal, Target=xy_plane_2)  # -> Geometry, Transform
rotate = Rotate(Geometry=orient.Geometry, Angle=pi, Plane=xy_plane_2)  # -> Geometry, Transform
geometry = Data(rotate.Geometry)
shear_4 = Data(cluster_6.disttree)

# ----
# Shear the Axons
geoms = Data(selected_geometries)
B_5 = Data(shear_4)
tree = Data(geometry)
tree_statistics_4 = TreeStatistics(Tree=tree)  # -> Paths, Length, Count
list_item_10 = ListItem(List=tree_statistics_4.Paths, Index=0, Wrap=True)
deconstruct_path_3 = DeconstructPath(Branch=list_item_10)
list_length_6 = ListLength(List=deconstruct_path_3)
trim_tree = TrimTree(Tree=tree, Depth=expr("x-1", list_length_6))
bounding_box_5 = BoundingBox(Content=trim_tree, Plane=PlaneXY(0, 0, 0), UnionBox=True)  # -> Box, Box_2
cluster_8 = Cluster_2(geoms=geoms, dist=bounding_box_5.Box)  # -> geomstree, disttree
box_corners_2 = BoxCorners(Box=cluster_8.disttree)  # -> CornerA, CornerB, CornerC, CornerD, CornerE, CornerF, CornerG, CornerH
deconstruct_box_2 = DeconstructBox(Box=cluster_8.disttree)  # -> Plane, X, Y, Z
point_6 = Point(box_corners_2.CornerB)
xz_plane = XZPlane(Origin=point_6)
point_7 = Point(box_corners_2.CornerC)
deconstruct = Deconstruct(Point=point_7)  # -> XComponent, YComponent, ZComponent
number_17 = Number(deconstruct_box_2.Y)
multiplication_8 = Multiplication(A=number_17, B=B_5)
addition_3 = Addition(A=deconstruct.ZComponent, B=multiplication_8)
construct_point = ConstructPoint(XCoordinate=deconstruct.XComponent, YCoordinate=deconstruct.YComponent, ZCoordinate=addition_3)
shear_5 = Shear(Geometry=tree, Base=xz_plane, Grip=point_7, Target=construct_point)  # -> Geometry, Transform
geometry_2 = Data(shear_5.Geometry)

# ----
# Output
geometry_3 = Data(vector_6)
geometry_4 = Data(geometry_2)
B_6 = Data(shear_4)
origin = Data(refpts)
pi_2 = Pi(Factor=-0.5)
multiplication_9 = Multiplication(A=pi_2, B=B_6)
yz_plane = YZPlane(Origin=origin)
rotate_2 = Rotate(Geometry=geometry_4, Angle=multiplication_9, Plane=yz_plane)  # -> Geometry, Transform
move_9 = Move(Geometry=rotate_2.Geometry, Motion=geometry_3)  # -> Geometry, Transform
wellpositionedgeometry = Data(move_9.Geometry)

breps_5 = Data(simplify(graft(breps_2)))
brep_wireframe_2 = BrepWireframe(Brep=breps_5, Density=-1)  # -> simplify(Wireframe)
merge_5 = Merge(Data1=line_2, Data2=define_text, Data3=define_text_dot_2, Data4=define_text_dot, Data5=brep_wireframe_2)
custom_preview_5 = CustomPreview(Geometry=merge_5, Shader=shader)

geometry_5 = Geometry(wellpositionedgeometry)
clean_tree_4 = CleanTree(RemoveNulls=False, RemoveInvalid=True, RemoveEmpty=True, Tree=geometry_5)
tree_control = TreeControl(inTree=clean_tree_4, viewNames=text_3, iteration=integer_14, layerNameType=integer_15, adjustment=colorseedadjustment)  # -> names, layers, seeds; inputs inTree: tree, viewNames: list, layerNameType: list
# ---------- tree_control: Python ----------
###### Tree Control ######
# Script written by Addin Cui, June 20th 2017
# Script copyrighted by TESTA & WEISER

#Essential library import
from Grasshopper.Kernel.Data import GH_Path
from Grasshopper import DataTree
from System import Array as ar
import math
import random as ra

layers = DataTree[object]()
names = DataTree[object]()
seeds = DataTree[object]()

for i in range(inTree.BranchCount):
    bList = inTree.Branch(i)
    bPath = inTree.Path(i)
    
    # Modified: June 27th 2017
    # Modified: July 23rd 2017
    view = str(viewNames[bPath[0]]) + 'View'
    if bPath[1] == 0: 
        type = 'Mass'
    else: type = 'Curve'
    part = 'No.' + str("%02d" % (bPath[2]+1))
    itr = 'Iteration' + str("%04d" % iteration)
    names.AddRange([view,type,part,itr],bPath)
    #print [view,type,part,itr]
    
    # Modified June 28th 2017
    seed = 1
    layerName = []
    if len(layerNameType):
        #print i
        for j in layerNameType:
            if j == 0:
                seed *= math.pow(2,bPath[0])
                layerName.append(view)
            elif j == 1:
                seed *= math.pow(3,bPath[1])
                layerName.append(type)
            elif j == 2:
                seed *= math.pow(5,bPath[2])
                layerName.append(part)
            elif j == 3:
                seed += iteration
                layerName.append(itr)
    else: layerName.append('Default')
    #print 'Seed ',seed
    layers.AddRange(layerName, bPath)
    seeds.AddRange([seed+adjustment], bPath)
# ---------- end tree_control ----------
text_join_2 = TextJoin(Text=tree_control.names, Join=comma)
text_join_3 = TextJoin(Text=tree_control.layers, Join=comma)
geometries = Panel(clean_tree_4)
objectname_full_info = Panel(text_join_2)
layername_selected_info = Panel(text_join_3)

number_18 = Number(tree_control.seeds)
number_19 = Number(flatten(number_18))
sort_duplicate_values = SortDuplicateValues(ValueList=number_19)  # -> UniqueValues, simplify(Indices)
panel_7 = Panel(number_18)
list_length_7 = ListLength(List=sort_duplicate_values.Indices)  # -> flatten(Length)
list_length_8 = ListLength(List=sort_duplicate_values.UniqueValues)
series_3 = Series(Start=0, Step=1, Count=list_length_8)
sort_list_2 = SortList(Keys=sort_duplicate_values.UniqueValues, ValuesA=series_3)  # -> Keys, ValuesA
repeat_data = RepeatData(Data=graft(sort_list_2.ValuesA), Length=graft(list_length_7))  # -> simplify(Data)
integer_17 = Integer(flatten(repeat_data))
integer_18 = Integer(flatten(sort_duplicate_values.Indices))
replace_items_2 = ReplaceItems(List=number_19, Item=integer_17, Indices=integer_18, Wrap=False)
matchpaths = MatchPaths(TargetData=flatten(replace_items_2), SourceData=number_18)  # -> RestructuredData, IndexMap
integer_19 = Integer(matchpaths.RestructuredData)
panel_8 = Panel(integer_19)

geometry_6 = Geometry(flatten(clean_tree_4))  # disabled
clean_tree_5 = CleanTree(RemoveNulls=True, RemoveInvalid=True, RemoveEmpty=False, Tree=geometry_6)  # disabled
v_ray_animation = VRayAnimation(
    Geo=clean_tree_5,
    Play=boolean_29,
    Frames=totalframesint,
    Width=multiplication_5,
    Height=multiplication_6,
    Vismat=filepathofvraymaterial,
    Folder=filesavingdestination)  # -> out; inputs Geo: list, Vismat: list; disabled
# ---------- v_ray_animation: VB ----------
    '
    'GH + V-Ray Render Animation.
    'Code written by Daniel Gonzalez Abalde at 23/05/2015.
    '
    component.Name = "V-Ray Animation"
    component.Description = "V-Ray Render Animation" & vbCrLf & "Requires timer component"
    component.Params.Input(0).name = "Geometry"
    component.Params.Input(0).Description = "Geometry to animate"
    component.Params.Input(1).name = "Play"
    component.Params.Input(1).Description = "Start the render animation" & vbCrLf & "Must be a Toggle component and will be returned False automatically when finished animation"
    component.Params.Input(2).name = "Frames"
    component.Params.Input(2).Description = "Number of frames (saved pictures)"
    component.Params.Input(3).name = "Width"
    component.Params.Input(3).Description = "Width of picture frame"
    component.Params.Input(4).name = "Height"
    component.Params.Input(4).Description = "Height of picture frame"
    component.Params.Input(5).name = "Material Files"
    component.Params.Input(5).Description = "FilePath of .vismat or .vrmat materials. One for each geometry"
    component.Params.Input(6).name = "Save Folder"
    component.Params.Input(6).Description = "Folder to save the pictures"
    '
    If vismat.count = 0 Then
      print("Set a material in vismat input")
      Return
    End If
    If (String.IsNullOrEmpty(Folder)) Then
      Folder = System.Environment.GetFolderPath(Environment.SpecialFolder.DesktopDirectory)
      Folder = Folder & "\Animation_GH-VRay"
      print("You have not inputted " & Chr(34) & "Folder" & Chr(34) & ". Frames will be saved in " & Chr(34) & Folder & Chr(34))
    End If
    '
    If Play Then

      'Plugin.
      Dim Vid As guid = rhino.PlugIns.RenderPlugIn.IdFromName("V-Ray for Rhino")

      If (iter < 0) AndAlso (Vid.tostring <> "00000000-0000-0000-0000-000000000000") Then
        log.clear()
        Rhino.RhinoApp.RunScript("_SetCurrentRenderPlugin " & Vid.ToString, False)
        log.add("V-Ray loaded")
        rhino.RhinoApp.WriteLine("")
        rhino.RhinoApp.WriteLine("Starting render animation")
      Else If Vid.tostring = "00000000-0000-0000-0000-000000000000" Then
        log.add("V-Ray failed to load")
        Return
      End If

      Dim VRay = rhino.RhinoApp.GetPlugInObject(Vid)

      Vray.SetRenderOutputSize(Width, Height)
      Vray.SetBatchRenderOn(True)
      ' Vray.SetShadowsOn(True)
      ' Vray.SetDistributedRenderingOn(True)
      ' VRAy.setRTEngineOn(True)
      ' VRay.SetAdaptiveDMCNoiseThreshold(0.1)
      ' VRay.SetAdaptiveDMCMinMaxSubdivs(10, 20)
      ' VRay.SetAdaptiveSubdivisionThreshold(0.1)
      ' VRay.SetAdaptiveSubdivisionNormals(1, 0.0)
      ' VRay.SetAdaptiveSubdivisionSamples(1)
      ' VRay.SetFixedRateSubdivs(10)
      ' VRay.SetDMCAdaptiveAmount(0.01)
      ' VRay.SetDMCMinimumSamples(10)
      ' VRay.SetDMCNoiseThreshold(0.01)
      ' VRay.SetDMCSubdivisionMultiplier(0.01)
      ' VRay.SetDMCPathSampler(0)
      '
      '
      Dim ids As New list(Of Guid)
      Dim idl As New list(Of Integer)
      '
      'Load and apply vismat to baked geometry.
      If ( Not iter > frames) Then

        For i As int32 = 0 To geo.count - 1


          If geo(i).GetType.toString = "Rhino.Geometry.Light" Then

            Dim idxl As int32 = rhino.rhinodoc.ActiveDoc.Lights.Add(geo(i))
            idl.add(idxl)
            Dim luz As rhino.DocObjects.LightObject = rhino.RhinoDoc.ActiveDoc.Lights(idxl)
            ids.add(luz.Id)
          Else

            Dim wV As Integer = GH_MathUtil.WrapInteger(i, vismat.count)

            ''Load vistmat.
            Dim idxof1 As Integer = vismat(wV).LastIndexOf("\")
            Dim idxof2 As Integer = vismat(wV).LastIndexOf(".")
            Dim namematerial As String = vismat(wV).substring(idxof1 + 1, idxof2 - idxof1 - 1)
            '
            Dim storematarr As String() = Nothing
            Dim storemat As New list(Of String)

            VRay.GetSceneMaterialNames(storematarr)

            For j As int32 = 0 To storematarr.count - 1
              storemat.add(storematarr(j).Remove(0, 1))
            Next
            '
            If (Not storemat.contains(namematerial)) Then
              Rhino.RhinoApp.RunScript("_-visLoadVismat " & Chr(34) & vismat(wV) & Chr(34), True)
              Dim result0 As rhino.Commands.Result = rhino.Commands.Command.LastCommandResult
              If result0 = rhino.Commands.Result.Success Then
                'log.add(Chr(34) & namematerial & Chr(34) & " material has been load to material table")
              Else
                log.add(Chr(34) & namematerial & Chr(34) & " material has NOT been load to material table. Try loading it manually first.")
              End If

              storemat.add(namematerial)
            End If
            '
            Dim idxmat As int32 = storemat.IndexOf(namematerial, 0)
            '
            ''Bake geomtery.
            Dim id As guid = rhino.RhinoDoc.ActiveDoc.Objects.Add(Geo(i))
            ids.add(id)

            '
            ''Apply vismat.

            If (iter < Frames) AndAlso (iter <> -1) Then
              Rhino.rhinodoc.ActiveDoc.Objects.UnselectAll(False)
              rhino.RhinoDoc.ActiveDoc.Objects.Select(id, True)
              rhino.RhinoApp.RunScript("_-visApplymaterial " & Chr(34) & "/" & storemat(idxmat) & Chr(34), True)
              Dim result1 As rhino.Commands.Result = rhino.Commands.Command.LastCommandResult
              If result1 = rhino.Commands.Result.Success Then
                'log.add(Chr(34) & namematerial & Chr(34) & " material has been applied to Geometry(" & i & ")")
              Else
                log.add(Chr(34) & namematerial & Chr(34) & " material has NOT been applied to Geometry(" & i & ")")
              End If
              rhino.RhinoDoc.ActiveDoc.Objects.Select(id, False)
              '

            End If
          End If

        Next

      End If

      '
      'Rendering.
      '
      iter += 1
      stopTimer = False
      '
      If  (iter <= frames) AndAlso (iter > 0)  Then
        print("Rendering... Done " & iter & "/" & frames)
        print("")
        rhino.RhinoApp.WriteLine("Rendering frame nº " & iter & "...")
        log.add("Frame_" & iter.toString("D4") & " rendered")
        ''Render.
        Rhino.RhinoApp.RunScript("_-Render", True)
        ''Save picture.
        If(Not System.IO.Directory.Exists(Folder)) Then
          System.IO.Directory.CreateDirectory(Folder)
          log.add("Folder not exists! Created a new: " & Folder)
        End If

        Dim saveDir As String = path.Combine(Folder, "Frame_" & iter.toString("D4") & ".png")

        Rhino.RhinoApp.RunScript("_-SaveRenderWindowAs " & Chr(34) & saveDir & Chr(34), True)
        Dim result2 As rhino.Commands.Result = rhino.Commands.Command.LastCommandResult
        If result2 = rhino.Commands.Result.Success Then
          log.add("Frame_" & iter.toString("D4") & ".png saved")
          savecheck = True
        Else
          log.add("Frame_" & iter.toString("D4") & ".png NOT saved")
          savecheck = False
        End If
        rhino.RhinoApp.WriteLine("")

      End If
      '
      'Delete geometry.
      For i As int32 = 0 To ids.count - 1
        rhino.RhinoDoc.ActiveDoc.Objects.Delete(ids(i), False)
      Next
      '
      'End render.
      If (iter > frames) Then
        stopTimer = True
        If (savecheck) Then
          rhinoapp.WriteLine("Render animation completed succesfully!")
          print("Render animation completed succesfully!")
          log.add("Render animation completed succesfully!")
        Else
          rhinoapp.WriteLine("Render animation completed without saving :/")
          print("Render animation completed without saving :/")
          log.add("Render animation completed without saving :/")
          rhino.RhinoApp.RunScript("_-CloseRenderWindow", False)
        End If
        '
        'Set Play = false
        Dim param As IGH_Param = component.Params.Input(1)
        Dim source As IGH_param = param.Sources(0)
        Dim idt As guid = source.ComponentGuid
        For Each obj As IGH_DocumentObject In owner.OnPingDocument().Objects
          If (TypeOf obj Is Kernel.Special.GH_BooleanToggle) Then
            If obj.NickName = "ProduceAnimation" Then
              'obj.ComponentGuid = idt And 
              Dim toggle As kernel.Special.GH_BooleanToggle = DirectCast(obj, Kernel.Special.GH_BooleanToggle)
              toggle.Value = False
              toggle.ExpireSolution(True)
            End If
          End If
        Next
        '
      End If
      '
    Else 'Play = false
      stopTimer = True
      iter = -1
    End If
    '
    For Each st As String In log
      print(st)
    Next
    '
    'Code of David Rutten to stop timer component.
    Dim ghdoc As GH_Document = owner.OnPingDocument()
    If (ghdoc Is Nothing) Then Return
    'Then, iterate over all objects in the document to find all timers.
    For Each docobj As IGH_DocumentObject In ghdoc.Objects
      'Try to cast the object to a GH_Timer
      Dim timer As Special.GH_Timer = TryCast(docobj, Special.GH_Timer)
      If (timer Is Nothing) Then Continue For
      'If the cast was successful, then see if this component is
      'part of the timer target list.
      If (timer.Targets.Contains(owner.InstanceGuid)) Then
        'If it is, lock the timer.
        timer.Locked = stopTimer
      Else
        print("Connect a Timer component and recompute")
      End If
    Next
    '
# ---------- v_ray_animation: VB additional code ----------
  Dim log As New list(Of String)
  Dim iter As Integer = -1
  Dim timer As New System.Windows.Forms.Timer
  Dim stopTimer As Boolean
  Dim savecheck As New Boolean
# ---------- end v_ray_animation ----------

panel_9 = Panel(v_ray_animation)

packs_of_seeds = Data(integer_19)
stream_gate_2 = StreamGate(Stream=packs_of_seeds, Gate=integer_12)  # -> Target0, Target1, Target2, Target3, Target4, Target5

# ---- group: LAB (continued)
random_6 = Random(Range=construct_domain_4, Number=1, Seed=expr("x*3", stream_gate_2.Target3))
random_7 = Random(Range=construct_domain_3, Number=1, Seed=expr("x*2", stream_gate_2.Target3))
random_8 = Random(Range=construct_domain_2, Number=1, Seed=stream_gate_2.Target3)
entwine_14 = Entwine(Branch00=random_6, Branch01=random_8, Branch02=random_7, FlattenInputs=True)  # -> simplify(Result)
colour_l_ab = ColourLAb(Alpha=1, Luminance=random_6, A=random_8, B=random_7)
split_argb_3 = SplitARGB(Colour=colour_l_ab, IntegerChannels=True)  # -> Alpha, Red, Green, Blue
colour_rgb_3 = ColourRGB(Alpha=255, Red=split_argb_3.Red, Green=split_argb_3.Green, Blue=split_argb_3.Blue)
colour = Colour(colour_rgb_3)

# ---- group: HSL (continued)
random_9 = Random(Range=construct_domain_6, Number=1, Seed=expr("x*2", stream_gate_2.Target0))
random_10 = Random(Range=construct_domain_7, Number=1, Seed=expr("x*3", stream_gate_2.Target0))
random_11 = Random(Range=construct_domain_5, Number=1, Seed=stream_gate_2.Target0)
entwine_15 = Entwine(Branch00=random_11, Branch01=random_9, Branch02=random_10, FlattenInputs=True)  # -> simplify(Result)
colour_hsl = ColourHSL(Alpha=1, Hue=random_11, Saturation=random_9, Luminance=random_10)
colour_2 = Colour(colour_hsl)

# ---- group: RGB (continued)
random_12 = Random(Range=construct_domain_13, Number=1, Seed=expr("x*2", stream_gate_2.Target1))
random_13 = Random(Range=construct_domain_11, Number=1, Seed=expr("x*3", stream_gate_2.Target1))
random_14 = Random(Range=construct_domain_12, Number=1, Seed=stream_gate_2.Target1)
entwine_16 = Entwine(Branch00=random_14, Branch01=random_12, Branch02=random_13, FlattenInputs=True)  # -> simplify(Result)
colour_rgb_4 = ColourRGB(Alpha=255, Red=random_14, Green=random_12, Blue=random_13)
colour_3 = Colour(colour_rgb_4)

# ---- group: LCH (continued)
random_15 = Random(Range=construct_domain_10, Number=1, Seed=expr("x*3", stream_gate_2.Target4))
random_16 = Random(Range=construct_domain_8, Number=1, Seed=expr("x*2", stream_gate_2.Target4))
random_17 = Random(Range=construct_domain_9, Number=1, Seed=stream_gate_2.Target4)
entwine_17 = Entwine(Branch00=random_15, Branch01=random_16, Branch02=random_17, FlattenInputs=True)  # -> simplify(Result)
colour_lch = ColourLCH(Alpha=1, Luminance=random_15, Chroma=random_16, Hue=random_17)
split_argb_4 = SplitARGB(Colour=colour_lch, IntegerChannels=True)  # -> Alpha, Red, Green, Blue
colour_rgb_5 = ColourRGB(Alpha=255, Red=split_argb_4.Red, Green=split_argb_4.Green, Blue=split_argb_4.Blue)
colour_4 = Colour(colour_rgb_5)

# ---- group: CMYK (continued)
random_18 = Random(Range=construct_domain_17, Number=1, Seed=expr("x*2", stream_gate_2.Target5))
random_19 = Random(Range=construct_domain_19, Number=1, Seed=expr("x*3", stream_gate_2.Target5))
random_20 = Random(Range=construct_domain_18, Number=1, Seed=stream_gate_2.Target5)
entwine_18 = Entwine(Branch00=random_20, Branch01=random_18, Branch02=random_19, FlattenInputs=True)  # -> simplify(Result)
colour_cmyk = ColourCMYK(Cyan=random_20, Magenta=random_18, Yellow=random_19, Key=0)
colour_5 = Colour(colour_cmyk)

# ---- group: XYZ (continued)
random_21 = Random(Range=construct_domain_15, Number=1, Seed=expr("x*2", stream_gate_2.Target2))
random_22 = Random(Range=construct_domain_16, Number=1, Seed=expr("x*3", stream_gate_2.Target2))
random_23 = Random(Range=construct_domain_14, Number=1, Seed=stream_gate_2.Target2)
entwine_19 = Entwine(Branch00=random_23, Branch01=random_21, Branch02=random_22, FlattenInputs=True)  # -> simplify(Result)
colour_xyz_4 = ColourXYZ(Alpha=1, X=random_23, Y=random_21, Z=random_22)
colour_6 = Colour(colour_xyz_4)

# ----
stream_filter_17 = StreamFilter(
    Gate=integer_12,
    Stream0=entwine_15,
    Stream1=entwine_16,
    Stream2=entwine_19,
    Stream3=entwine_14,
    Stream4=entwine_17,
    Stream5=entwine_18)
stream_filter_18 = StreamFilter(
    Gate=integer_12,
    Stream0=colour_2,
    Stream1=colour_3,
    Stream2=colour_6,
    Stream3=colour,
    Stream4=colour_4,
    Stream5=colour_5)
colour_7 = Colour(stream_filter_18)

colour_8 = Colour(simplify(colour_7))
list_item_11 = ListItem(List=flatten(colour_8), Index=series_2, Wrap=True)
custom_preview_6 = CustomPreview(Geometry=move_6.Geometry, Shader=list_item_11)

colour_9 = Colour(flatten(colour_7))
list_item_12 = ListItem(List=colour_9, Index=series, Wrap=True)  # -> simplify(graft(Item))

data_4 = Data(stream_filter_17)
explode_tree_6 = ExplodeTree(Data=data_4)  # -> Branch0, Branch1, Branch2
cluster_9 = Cluster(value_list=explode_tree_6.Branch0)  # -> difference_2, length
cluster_10 = Cluster(value_list=explode_tree_6.Branch1)  # -> difference_2, length
cluster_11 = Cluster(value_list=explode_tree_6.Branch2)  # -> difference_2, length
multiplication_10 = Multiplication(A=cluster_9.difference_2, B=explode_tree_5.Branch0)
multiplication_11 = Multiplication(A=cluster_10.difference_2, B=explode_tree_5.Branch1)
multiplication_12 = Multiplication(A=cluster_11.difference_2, B=explode_tree_5.Branch2)
addition_4 = Addition(A=multiplication_10, B=multiplication_11, C=multiplication_12)
difference_indicator_the_larger_the_bett = Panel(cluster_9.difference_2)  # "Difference Indicator, the larger the better"
number_of_unique_colors = Panel(cluster_9.length)
number_of_unique_colors_2 = Panel(cluster_10.length)
difference_indicator_the_larger_the_bett_2 = Panel(cluster_11.difference_2)  # "Difference Indicator, the larger the better"
number_of_unique_colors_3 = Panel(cluster_11.length)
difference_indicator_the_larger_the_bett_3 = Panel(cluster_10.difference_2)  # "Difference Indicator, the larger the better"
difference_indicator_the_larger_the_bett_4 = Panel(addition_4)  # "Difference Indicator, the larger the better"

colour_10 = Colour(colour_7)
path_mapper = PathMapper(colour_10, source="{A;B;C;D}", target="{A;B;C}")
custom_preview_7 = CustomPreview(Geometry=simplify(clean_tree_4), Shader=simplify(colour_10))
bake_attributes_4 = BakeAttributes(
    objs=clean_tree_4,
    names=text_join_2,
    layers=text_join_3,
    colors=path_mapper,
    materials=path_mapper,
    activate=bake,
    groupListTgthr=group)  # -> out; inputs objs: list, names: list of String, layers: list of String, colors: list of Color, pWidths: list of Double, wiresEach: list of Int32, materials: list, activate: Boolean, groupListTgthr: Boolean; same code as bake_attributes
color = Panel(path_mapper)

# ==== cluster ListKeepNull
data = ClusterInput()
selection = ClusterInput()
data_2 = Data(data)
selection_2 = Integer(selection)
item_index = ItemIndex(List=data_2, Item=data_2)
replace_items = ReplaceItems(List=data_2, Indices=selection_2, Wrap=False)
null_item = NullItem(Item=replace_items)  # -> NullFlags, InvalidFlags, Description
dispatch = Dispatch(List=item_index, DispatchPattern=null_item.NullFlags)  # -> ListA, ListB
replace_items_2 = ReplaceItems(List=data_2, Indices=dispatch.ListB, Wrap=False)  # -> simplify(graft(List))
panel = Panel(replace_items_2)
data_3 = Data(replace_items_2)
data_4 = ClusterOutput(data_3)

# ==== cluster ProjectionOneSide
tolerancelevel = Slider(-1, range=-5..0)
project_frame_or_pattern = ClusterInput()
one_side_projection = ClusterInput()
power_of_10 = PowerOf10(Value=tolerancelevel)
patterncrvs = ClusterInput()
projection_pad_crv = ClusterInput()
drawingpadcrv = ClusterInput()
targetbreps = ClusterInput()

one_side_projection_2 = Boolean(one_side_projection)
project_frame_or_pattern_2 = Boolean(project_frame_or_pattern)
curve = Curve(drawingpadcrv)
curve_2 = Curve(projection_pad_crv)
curve_3 = Curve(patterncrvs)
brep = Brep(simplify(graft(targetbreps)))
boundary_surfaces = BoundarySurfaces(Edges=curve)
boundary_surfaces_2 = BoundarySurfaces(Edges=curve_2)
surface = Surface(reparameterize(boundary_surfaces))
surface_2 = Surface(reparameterize(boundary_surfaces_2))
plane = Plane(surface_2)
reverse = Reverse(Vector=plane)
trim_with_region = TrimWithRegion(Curve=[curve_3, curve], Region=curve)  # -> flatten(Inside), Outside
explode = Explode(Curve=curve_2, Recursive=True)  # -> flatten(Segments), Vertices
map_to_surface = MapToSurface(Curve=trim_with_region.Inside, Source=surface, Target=surface_2)  # -> flatten(Curve)
stream_filter = StreamFilter(Gate=project_frame_or_pattern_2, Stream0=explode.Segments, Stream1=map_to_surface)
curve_4 = Curve(stream_filter)
project = Project(Curve=curve_4, Brep=brep, Direction=plane)  # -> simplify(Curve)
simplify_curve = SimplifyCurve(Curve=project, Tolerance=power_of_10)  # -> Curve, Simplified
explode_2 = Explode(Curve=simplify_curve.Curve, Recursive=True)  # -> reparameterize(simplify(Segments)), Vertices
curve_5 = Curve(stream_filter)

custom_preview = CustomPreview(
    Geometry=brep,
    Shader={ambient=RGB(128, 128, 128), diffuse=RGB(0, 255, 255), emission=RGB(0, 0, 255), shine=0.5, specular=RGB(255, 255, 255), transparency=0})
stream_filter_2 = StreamFilter(Gate=one_side_projection_2, Stream1=explode_2.Segments)
# This python component is filtering out the curves that could have both of their end points & [1/3 pt, mid pt, 2/3 pt] projected on them. This would filter most of the cases when a curve is lying behind the brep that could not have its end points projected through the brep.
clean_tree = CleanTree(RemoveNulls=True, RemoveInvalid=True, RemoveEmpty=True, Tree=simplify_curve.Curve)  # -> simplify(Tree)
curve_6 = ClusterOutput(curve_5)

brep_2 = Brep(brep)
vector = Vector(reverse)

curve_7 = Curve(stream_filter_2)
curve_8 = Curve(clean_tree)

point_on_curve = PointOnCurve(curve_7, parameter=0.6666666667)
point_on_curve_2 = PointOnCurve(curve_7, parameter=0.5)
point_on_curve_3 = PointOnCurve(curve_7, parameter=0.3333333333)

merge = Merge(Data1=point_on_curve_3, Data2=point_on_curve_2, Data3=point_on_curve)  # -> simplify(Result)
project_2 = Project(Geometry=merge, Plane=plane)  # -> Geometry, Transform
clean_tree_2 = CleanTree(RemoveNulls=True, RemoveInvalid=True, RemoveEmpty=False, Tree=project_2.Geometry)  # -> simplify(Tree)

curve_9 = Curve(curve_7)
point = Point(clean_tree_2)
tree_statistics = TreeStatistics(Tree=point)  # -> flatten(Paths), Length, Count
deconstruct_path = DeconstructPath(Branch=tree_statistics.Paths)  # -> simplify(Indices)
list_length = ListLength(List=deconstruct_path)
cherry_picker = CherryPicker(list_length, ListIndex=0)
subtraction = Subtraction(A=cherry_picker, B=1)
trim_tree = TrimTree(Tree=point, Depth=subtraction)
project_point = ProjectPoint(Point=trim_tree, Direction=vector, Geometry=brep_2)  # -> Point, Index
matchpaths = MatchPaths(TargetData=flatten(project_point.Point), SourceData=point)  # -> RestructuredData, IndexMap
clean_tree_3 = CleanTree(RemoveNulls=True, RemoveInvalid=True, RemoveEmpty=True, Tree=curve_9)  # -> simplify(Tree)
sort_duplicate_points = SortDuplicatePoints(Points=matchpaths.RestructuredData)  # -> UniquePoints, Indices
python_script = PythonScript(pts=sort_duplicate_points.UniquePoints, crvs=clean_tree_3)  # -> out, simplify(crvSrf); inputs pts: list, crvs: list
# ---------- python_script: Python ----------
import rhinoscriptsyntax as rs
import Rhino as rh
import scriptcontext as sc
import math

print 'length pts = ', len(pts)
print 'length crvs = ', len(crvs)



tol = sc.doc.ModelAbsoluteTolerance
print 'tolerance = ', math.log10(tol)
crvSrf = []

for crv in crvs:
    l = rs.CurveLength(crv)
    print l
    if rs.IsCurve(crv):
        print 'crv loading success'
        i = 0
        for pt in pts:
            ptPara = rs.CurveClosestPoint(crv, pt)
            ptC = rs.EvaluateCurve(crv, ptPara)
            if rs.Distance(pt,ptC) < tol*100:
                bool = True
            else: bool = False
            if bool:
                i += 1
        if i >= 2:
            crvSrf.append(crv)
    else:
        print 'curve loading failed'
# ---------- end python_script ----------
curve_10 = Curve(python_script.crvSrf)
stream_filter_3 = StreamFilter(Gate=one_side_projection_2, Stream0=curve_8, Stream1=curve_10)

s_0 = ClusterOutput(stream_filter_3)
debug = Panel(python_script.out)

# ==== cluster Cluster
value_list = ClusterInput()
sort_duplicate_values = SortDuplicateValues(ValueList=flatten(value_list))  # -> UniqueValues, Indices
sort_list = SortList(Keys=sort_duplicate_values.UniqueValues, ValuesValuesA=sort_duplicate_values.UniqueValues)  # -> Keys, ValuesValuesA
relative_differences = RelativeDifferences(Values=sort_list.Keys)
sort_list_2 = SortList(Keys=relative_differences, ValuesValuesA=relative_differences)  # -> Keys, ValuesValuesA
list_length = ListLength(List=sort_duplicate_values.UniqueValues)
list_item = ListItem(List=sort_list_2.Keys, Index=1, Wrap=True)
length = ClusterOutput(list_length)
difference = Data(list_item)
difference_2 = ClusterOutput(difference)

# ==== cluster Cluster_2
geoms = ClusterInput()
dist = ClusterInput()
tree_control = TreeControl(geoms=geoms, dist=simplify(dist))  # -> out, geomsTree, distTree; inputs geoms: tree, dist: tree
# ---------- tree_control: Python ----------
import Rhino
from Grasshopper.Kernel.Data import GH_Path
from Grasshopper import DataTree
from System import Array as ar

geomsTree = DataTree[object]()
distTree = DataTree[object]()

for d in range(dist.BranchCount):
    distList = dist.Branch(d)
    distPath = dist.Path(d)
    #print distPath
    #print distList
    dp0 = distPath[0]
    le = GH_Path.Length.GetValue(geoms.Path(0))
    for g in range(geoms.BranchCount):
        geomsList = geoms.Branch(g)
        geomsPath = geoms.Path(g)
        p0 = geomsPath[0]
        if le == 2:
            p1 = geomsPath[1]
        else: p1 = 0
        path = GH_Path(ar[int]([dp0, p0, p1]))
        #print type(geomsPath)
        if distList[0] != None:
            for i in range(len(geomsList)):
                geomsTree.Add(geomsList[i], path)
                distTree.Add(distList[0],path)
        else:
            for i in range(len(geomsList)):
                geomsTree.Add(None, path)
                distTree.Add(None,path)
            #print 'No distance'
        #print len(geomsList)

    
#print geomsTree
# ---------- end tree_control ----------
geomstree = ClusterOutput(tree_control.geomsTree)
disttree = ClusterOutput(tree_control.distTree)

# ==== cluster PatternTreatment
distance = ClusterInput()
corners = ClusterInput()
curves = ClusterInput()
sort_duplicate_curves = SortDuplicateCurves(Curves=curves)  # -> UniqueCurves, Indices

offset = Offset(Curve=sort_duplicate_curves.UniqueCurves, Distance=expr("-x", distance), Plane=PlaneXY(0, 0, 0), Corners=corners)  # -> flatten(Curve)
end_points = EndPoints(Curve=offset)  # -> Start, End
curve = Curve(flatten(offset))

offset_2 = Offset(Curve=sort_duplicate_curves.UniqueCurves, Distance=distance, Plane=PlaneXY(0, 0, 0), Corners=corners)  # -> flatten(Curve)
end_points_2 = EndPoints(Curve=offset_2)  # -> Start, End

line = Line(StartPoint=end_points_2.End, EndPoint=end_points.End)
line_2 = Line(StartPoint=end_points_2.Start, EndPoint=end_points.Start)
curve_2 = Curve(curve)
curve_3 = Curve(offset_2)
merge = Merge(Data1=curve_3, Data2=line_2, Data3=curve_2, Data4=line)
join_curves = JoinCurves(Curves=merge, Preserve=False)

vector = Vector(offset_2)
reverse = Reverse(Vector=vector)
vector_2 = Vector(curve)
arc_sed = ArcSED(Start=end_points_2.End, End=end_points.End, Direction=vector_2)  # -> Arc, Plane, Radius
arc_sed_2 = ArcSED(Start=end_points_2.Start, End=end_points.Start, Direction=reverse)  # -> Arc, Plane, Radius
curve_4 = Curve(offset_2)
curve_5 = Curve(curve)
merge_2 = Merge(Data1=curve_4, Data2=arc_sed_2.Arc, Data3=curve_5, Data4=arc_sed.Arc)
join_curves_2 = JoinCurves(Curves=merge_2, Preserve=False)

curve_6 = Curve(join_curves)
curve_7 = Curve(join_curves_2)
stream_filter = StreamFilter(Gate=expr("x-1", corners), Stream0=curve_6, Stream1=curve_7)
curve_8 = Curve(stream_filter)

stream_filter_2 = StreamFilter(Gate=distance, Stream0=sort_duplicate_curves.UniqueCurves, Stream1=curve_8)
s_1 = ClusterOutput(stream_filter_2)

# ==== cluster PatternTreatment_2
distance = ClusterInput()
corners = ClusterInput()
curves = ClusterInput()
sort_duplicate_curves = SortDuplicateCurves(Curves=curves)  # -> UniqueCurves, Indices

offset = Offset(Curve=sort_duplicate_curves.UniqueCurves, Distance=expr("-x", distance), Plane=PlaneXY(0, 0, 0), Corners=corners)  # -> flatten(Curve)
end_points = EndPoints(Curve=offset)  # -> Start, End
curve = Curve(flatten(offset))

offset_2 = Offset(Curve=sort_duplicate_curves.UniqueCurves, Distance=distance, Plane=PlaneXY(0, 0, 0), Corners=corners)  # -> flatten(Curve)
end_points_2 = EndPoints(Curve=offset_2)  # -> Start, End

line = Line(StartPoint=end_points_2.End, EndPoint=end_points.End)
line_2 = Line(StartPoint=end_points_2.Start, EndPoint=end_points.Start)
curve_2 = Curve(curve)
curve_3 = Curve(offset_2)
merge = Merge(Data1=curve_3, Data2=line_2, Data3=curve_2, Data4=line)
join_curves = JoinCurves(Curves=merge, Preserve=False)

vector = Vector(offset_2)
reverse = Reverse(Vector=vector)
vector_2 = Vector(curve)
arc_sed = ArcSED(Start=end_points_2.End, End=end_points.End, Direction=vector_2)  # -> Arc, Plane, Radius
arc_sed_2 = ArcSED(Start=end_points_2.Start, End=end_points.Start, Direction=reverse)  # -> Arc, Plane, Radius
curve_4 = Curve(offset_2)
curve_5 = Curve(curve)
merge_2 = Merge(Data1=curve_4, Data2=arc_sed_2.Arc, Data3=curve_5, Data4=arc_sed.Arc)
join_curves_2 = JoinCurves(Curves=merge_2, Preserve=False)

curve_6 = Curve(join_curves)
curve_7 = Curve(join_curves_2)
stream_filter = StreamFilter(Gate=expr("x-1", corners), Stream0=curve_6, Stream1=curve_7)
curve_8 = Curve(stream_filter)

stream_filter_2 = StreamFilter(Gate=distance, Stream0=sort_duplicate_curves.UniqueCurves, Stream1=curve_8)
s_0 = ClusterOutput(stream_filter_2)

# ==== cluster Adjustment
selectedgeoindex = ClusterInput()
initialgeometry = ClusterInput()
resultgeometry = ClusterInput()
initialgeometry_2 = Geometry(initialgeometry)
resultgeometry_2 = Geometry(resultgeometry)
selectedgeoindex_2 = Integer(selectedgeoindex)
sort_list = SortList(Keys=resultgeometry_2, ValuesValuesA=resultgeometry_2)  # -> Keys, ValuesValuesA
sort_list_2 = SortList(Keys=initialgeometry_2, ValuesValuesA=initialgeometry_2)  # -> Keys, ValuesValuesA
adjustment = ClusterInput()
list_item = ListItem(List=sort_list_2.ValuesValuesA, Index=selectedgeoindex_2, Wrap=False)
list_item_2 = ListItem(List=sort_list.ValuesValuesA, Index=selectedgeoindex_2, Wrap=True)
deconstruct_brep = DeconstructBrep(Brep=list_item)  # -> Faces, Edges, Vertices
area = Area(Geometry=list_item)  # -> Area, Centroid
area_2 = Area(Geometry=list_item_2)  # -> Area, Centroid
deconstruct_brep_2 = DeconstructBrep(Brep=list_item_2)  # -> Faces, Edges, Vertices
area_3 = Area(Geometry=deconstruct_brep.Faces)  # -> Area, Centroid
deconstruct = Deconstruct(Point=area_3.Centroid)  # -> XComponent, YComponent, ZComponent
sort_list_3 = SortList(Keys=deconstruct.ZComponent, ValuesValuesA=deconstruct_brep.Faces)  # -> Keys, ValuesValuesA
list_item_3 = ListItem(List=sort_list_3.ValuesValuesA, Index=0, Wrap=True)
item_index = ItemIndex(List=deconstruct_brep.Faces, Item=list_item_3)
list_item_4 = ListItem(List=deconstruct_brep_2.Faces, Index=item_index, Wrap=True)
area_4 = Area(Geometry=list_item_3)  # -> Area, Centroid
area_5 = Area(Geometry=list_item_4)  # -> Area, Centroid
surface_closest_point = SurfaceClosestPoint(Point=area_4.Centroid, Surface=list_item_3)  # -> Point, UVPoint, Distance
surface_closest_point_2 = SurfaceClosestPoint(Point=area_5.Centroid, Surface=list_item_4)  # -> Point, UVPoint, Distance
evaluate_surface = EvaluateSurface(Surface=list_item_3, Point=surface_closest_point.UVPoint)  # -> Point, Normal, Frame
evaluate_surface_2 = EvaluateSurface(Surface=list_item_4, Point=surface_closest_point_2.UVPoint)  # -> Point, Normal, Frame
deconstruct_plane = DeconstructPlane(Plane=evaluate_surface.Frame)  # -> Origin, XAxis, YAxis, ZAxis
deconstruct_plane_2 = DeconstructPlane(Plane=evaluate_surface_2.Frame)  # -> Origin, XAxis, YAxis, ZAxis
rotate = Rotate(Geometry=list_item_2, Center=area_5.Centroid, From=deconstruct_plane_2.XAxis, To=deconstruct_plane_2.XAxis)  # -> Geometry, Transform
geometry = Geometry(list_item_2)
rotate_2 = Rotate(Geometry=list_item_2, Center=area_5.Centroid, From=deconstruct_plane_2.XAxis, To=deconstruct_plane.XAxis)  # -> Geometry, Transform
rotate_3 = Rotate(Geometry=list_item_2, Center=area_5.Centroid, From=deconstruct_plane_2.YAxis, To=deconstruct_plane.YAxis)  # -> Geometry, Transform
rotate_4 = Rotate(Geometry=list_item_2, Center=area_5.Centroid, From=deconstruct_plane_2.ZAxis, To=deconstruct_plane.ZAxis)  # -> Geometry, Transform
stream_filter = StreamFilter(
    Adjustment=adjustment,
    Stream0=rotate.Transform,
    Stream1=rotate_2.Transform,
    Stream2=rotate_3.Transform,
    Stream3=rotate_4.Transform)
transform = Transform(Geometry=geometry, Transform=stream_filter)
initialstatus = Geometry(list_item)
geometryadjusted = ClusterOutput(transform)
initialstatus_2 = ClusterOutput(initialstatus)
