# Grasshopper definition 20171105_DS_WireframeToDrawings.gh (Grasshopper 0.9.76)

beamz = Slider(3, range=0..10)
beamscurves = Curve([<curve referenced from the Rhino model> x124])
control_points = ControlPoints(Curve=beamscurves)  # -> Points, Weights, Knots
shatter = Shatter(Curve=graft(beamscurves), Parameters=control_points.Points)  # -> simplify(Segments)
unit_z = UnitZ(Factor=beamz)
extrude = Extrude(Base=shatter, Direction=unit_z)
zbeamsrf = Brep(extrude)

curve = Curve(shatter)
control_points_2 = ControlPoints(Curve=curve)  # -> Points, Weights, Knots
list_length = ListLength(List=flatten(control_points_2.Points))
panel = Panel(list_length)

colunmcurves = Curve([<curve referenced from the Rhino model> x277])
colunmxy = Slider(2, range=0..10)
control_points_3 = ControlPoints(Curve=colunmcurves)  # -> Points, Weights, Knots
shatter_2 = Shatter(Curve=graft(colunmcurves), Parameters=control_points_3.Points)  # -> simplify(Segments)

division = Division(A=colunmxy, B=2)
negative = Negative(Value=division)
end_points = EndPoints(Curve=shatter_2)  # -> Start, End
construct_domain = ConstructDomain(DomainStart=negative, DomainEnd=division)
plane_surface = PlaneSurface(Plane=[end_points.Start, end_points.End], XSize=construct_domain, YSize=construct_domain)

unit_x = UnitX(Factor=colunmxy)
extrude_2 = Extrude(Base=shatter_2, Direction=unit_x)
division_2 = Division(A=unit_x, B=2)
negative_2 = Negative(Value=division_2)
move = Move(Geometry=extrude_2, Motion=negative_2)  # -> Geometry, Transform

unit_y = UnitY(Factor=colunmxy)
extrude_3 = Extrude(Base=shatter_2, Direction=unit_y)
division_3 = Division(A=unit_y, B=2)
negative_3 = Negative(Value=division_3)
move_2 = Move(Geometry=extrude_3, Motion=negative_3)  # -> Geometry, Transform

longitudecolsrf = Brep(move.Geometry)
traversalcolsrf = Brep(move_2.Geometry)
plancolsrf = Brep(plane_surface)

angle_tolerance = Slider(1, range=0..5)
beamxy = Slider(1, range=0..10)
division_4 = Division(A=beamxy, B=2)

offset = Offset(Curve=shatter, Distance=division_4, Plane=PlaneXY(0, 0, 0), Corners=1)
tolerance = Slider(0, range=0..20)
negative_4 = Negative(Value=tolerance)
power_of_10 = PowerOf10(Value=negative_4)
simplify_curve = SimplifyCurve(Curve=offset, Tolerance=power_of_10, AngleTolerance=angle_tolerance)  # -> simplify(Curve), Simplified
control_points_4 = ControlPoints(Curve=simplify_curve.Curve)  # -> Points, Weights, Knots
list_length_2 = ListLength(List=flatten(control_points_4.Points))
panel_2 = Panel(list_length_2)
panel_3 = Panel(simplify_curve.Simplified)

offset_2 = Offset(Curve=shatter, Distance=expr("-x", division_4), Plane=PlaneXY(0, 0, 0), Corners=1)
tolerance_2 = Slider(0, range=0..20)
negative_5 = Negative(Value=tolerance_2)
power_of_10_2 = PowerOf10(Value=negative_5)
simplify_curve_2 = SimplifyCurve(Curve=offset_2, Tolerance=power_of_10_2, AngleTolerance=angle_tolerance)  # -> simplify(Curve), Simplified
control_points_5 = ControlPoints(Curve=simplify_curve_2.Curve)  # -> Points, Weights, Knots
list_length_3 = ListLength(List=flatten(control_points_5.Points))
panel_4 = Panel(list_length_3)
panel_5 = Panel(simplify_curve_2.Simplified)

ruled_surface = RuledSurface(CurveA=simplify_curve.Curve, CurveB=simplify_curve_2.Curve)
