# Grasshopper definition 20171116_VS_Strips.gh (Grasshopper 0.9.76)

curve = Curve(<curve referenced from the Rhino model>)
multiplier = Slider(1.2, range=0..10)
totallength = Slider(50, range=0..100)
interval = Slider(0.1, range=0.1..10)
y_count = Slider(10, range=0..10)
length = Length(Curve=curve)
rectangle = Rectangle(Plane=PlaneXY(0, 0, 0), XSize=totallength, YSize=length, Radius=0)  # -> Rectangle, Length
multiplication = Multiplication(A=interval, B=multiplier)
unit_y = UnitY(Factor=length)
series = Series(Start=interval, Step=multiplication, Count=y_count)
division = Division(A=totallength, B=series)
linear_array = LinearArray(Geometry=curve, Direction=unit_y, Count=y_count)  # -> Geometry, Transform
unit_x = UnitX(Factor=series)
addition = Addition(A=division, B=1)
linear_array_2 = LinearArray(Geometry=linear_array.Geometry, Direction=unit_x, Count=addition)  # -> Geometry, Transform
transform = Transform(Geometry=rectangle.Rectangle, Transform=linear_array.Transform)
curve_2 = Curve(linear_array_2.Geometry)
curve_3 = Curve(transform)
