# Grasshopper definition 20180123_DS_VolumeRatio.gh (Grasshopper 1.0.4)

volume = Brep(<brep referenced from the Rhino model>)
bounding_box = BoundingBox(Content=volume, Plane=PlaneXY(0, 0, 0), UnionBox=False)  # -> Box, Box_2
solid_union = SolidUnion(Breps=volume)
bounding_box_2 = BoundingBox(Content=volume, Plane=PlaneXY(0, 0, 0), UnionBox=True)  # -> Box, Box_2

targetvoid = Brep(<brep referenced from the Rhino model>)
volume_2 = Volume(Geometry=targetvoid)  # -> Volume, Centroid
panel = Panel(volume_2.Volume)

targetvolume = Brep(<brep referenced from the Rhino model>)
volume_3 = Volume(Geometry=targetvolume, UseTasks=True)  # -> Volume, Centroid
panel_2 = Panel(volume_3.Volume)

volume_4 = Volume(Geometry=volume)  # -> Volume, Centroid
volume_5 = Volume(Geometry=bounding_box_2.Box)  # -> Volume, Centroid
mass_addition = MassAddition(Input=volume_4.Volume)  # -> Result, PartialResults
subtraction = Subtraction(A=volume_5.Volume, B=mass_addition.Result)
panel_3 = Panel(subtraction)
panel_4 = Panel(mass_addition.Result)
