# Grasshopper definition 20180201_BeamDevelopment.gh (Grasshopper 1.0.4)

primtivebreps = Brep()
brep_wireframe = BrepWireframe(Brep=primtivebreps, Density=-1)  # -> flatten(Wireframe)

profile = Surface(<surface referenced from the Rhino model>)
path = Curve([<curve referenced from the Rhino model> x108])

floorsrf = Surface([<surface referenced from the Rhino model> x35])  # disabled

surface = Surface(floorsrf)  # disabled
xy_plane = XYPlane(Origin=Point(0, 0, 0))  # disabled
bounding_box = BoundingBox(Content=surface, Plane=xy_plane, UnionBox=True)  # -> Box, Box_2; disabled

number_slider = Slider(0, range=0..1)  # disabled
number_slider_2 = Slider(0, range=0..1)  # disabled
number_slider_3 = Slider(0, range=0..1)  # disabled
number_slider_4 = Slider(0, range=0..1)  # disabled
number_slider_5 = Slider(0, range=0..1)  # disabled
number_slider_6 = Slider(0, range=0..1)  # disabled
number_slider_7 = Slider(1, range=0..1)  # disabled
number_slider_8 = Slider(1, range=0..1)  # disabled
number_slider_9 = Slider(0, range=0..1)  # disabled
evaluate_box = EvaluateBox(Box=bounding_box.Box, UParameter=number_slider_2, VParameter=number_slider_3, WParameter=number_slider)  # -> Plane, Point, Include; disabled
evaluate_box_2 = EvaluateBox(Box=bounding_box.Box, UParameter=number_slider_6, VParameter=number_slider_8, WParameter=number_slider_5)  # -> Plane, Point, Include; disabled
evaluate_box_3 = EvaluateBox(Box=bounding_box.Box, UParameter=number_slider_7, VParameter=number_slider_9, WParameter=number_slider_4)  # -> Plane, Point, Include; disabled
line = Line(StartPoint=evaluate_box.Point, EndPoint=evaluate_box_3.Point)  # disabled
line_2 = Line(StartPoint=evaluate_box.Point, EndPoint=evaluate_box_2.Point)  # disabled

span = Slider(10, range=0..100)  # disabled
length = Length(Curve=line)  # disabled
length_2 = Length(Curve=line_2)  # disabled
unit_y = UnitY(Factor=span)  # disabled
division = Division(A=length, B=span)  # disabled
unit_x = UnitX(Factor=span)  # disabled
division_2 = Division(A=length_2, B=span)  # disabled
linear_array = LinearArray(Geometry=line, Direction=unit_y, Count=expr("x+1", division_2))  # -> Geometry, Transform; disabled
linear_array_2 = LinearArray(Geometry=line_2, Direction=unit_x, Count=expr("x+1", division))  # -> Geometry, Transform; disabled

project = Project(Curve=linear_array.Geometry, Brep=simplify(graft(surface)), Direction=Vector(0, 0, 1))  # -> simplify(Curve); disabled
project_2 = Project(Curve=linear_array_2.Geometry, Brep=simplify(graft(surface)), Direction=Vector(0, 0, 1))  # -> simplify(Curve); disabled
merge = Merge(Data1=project_2, Data2=project)  # disabled

curve = Curve(merge)  # disabled

custom_preview = CustomPreview(
    Geometry=curve,
    Material={diffuse=RGB(221, 160, 221), emission=RGB(66, 48, 66), shine=0.5, specular=RGB(255, 255, 255), transparency=0})  # disabled

curve_2 = Curve(path)
surface_2 = Surface(profile)
explode = Explode(Curve=curve_2, Recursive=True)  # -> Segments, Vertices
end_points = EndPoints(Curve=explode.Segments)  # -> Start, End
unit_z = UnitZ(Factor=1)
plane_normal = PlaneNormal(Origin=end_points.Start, ZAxis=explode.Segments)
xy_plane_2 = XYPlane(Origin=Point(0, 0, 0))

align_plane = AlignPlane(Plane=plane_normal, Direction=unit_z)  # -> Plane, Angle

orient = Orient(Geometry=surface_2, Source=xy_plane_2, Target=align_plane.Plane)  # -> Geometry, Transform
extrude_along = ExtrudeAlong(Base=orient.Geometry, Curve=explode.Segments)
brep = Brep(extrude_along)

brep_2 = Brep(brep)
custom_preview_2 = CustomPreview(
    Geometry=brep_2,
    Material={diffuse=RGB(221, 160, 221), emission=RGB(66, 48, 66), shine=0.5, specular=RGB(255, 255, 255), transparency=0})
