# Grasshopper definition 20180204_DD_FacadeDevelopment.gh (Grasshopper 1.0.4)
# plug-ins: Human, LunchBox

direction = ValueList({"EW": 0, "NS": 1, "UpDown": 2}, selected="EW")
bake = Button()
gap = Slider(10, range=0..20)
width = Slider(3, range=0..10)
number_slider = Slider(100, range=0..100)
facadethickness = Slider(6, range=0..12)
thickness_unit = Panel("inch")
merge = Merge(Data1=facadethickness, Data2=thickness_unit)

stripdirection = ValueList({"EW": 0, "NS": 1, "UpDown": 2}, selected="UpDown")
bake_2 = Button()
srfdirselection = ValueList({"EW": 0, "NS": 1, "UpDown": 2}, selected="NS")
gap_2 = Slider(10, range=0..20)
width_2 = Slider(3, range=0..10)
facadethickness_2 = Slider(3, range=0..12)
thickness_unit_2 = Panel("inch")
merge_2 = Merge(Data1=facadethickness_2, Data2=thickness_unit_2)

brep = Brep(flatten([<brep referenced from the Rhino model> x4]))

# ---- group: SrfSelection
deconstruct_brep = DeconstructBrep(Brep=flatten(brep))  # -> flatten(Faces), Edges, Vertices; disabled
area = Area(Geometry=deconstruct_brep.Faces)  # -> Area, Centroid; disabled
surface_closest_point = SurfaceClosestPoint(Point=area.Centroid, Surface=deconstruct_brep.Faces)  # -> Point, UVPoint, Distance; disabled
evaluate_surface = EvaluateSurface(Surface=deconstruct_brep.Faces, Point=surface_closest_point.UVPoint)  # -> Point, Normal, UDirection, VDirection, Frame; disabled
deconstruct_vector = DeconstructVector(Vector=evaluate_surface.Normal)  # -> XComponent, YComponent, ZComponent; disabled
larger_than = LargerThan(FirstNumber=deconstruct_vector.XComponent, SecondNumber=0)  # -> LargerThan, OrEqualTo; disabled
larger_than_2 = LargerThan(FirstNumber=deconstruct_vector.YComponent, SecondNumber=0)  # -> LargerThan, OrEqualTo; disabled
larger_than_3 = LargerThan(FirstNumber=deconstruct_vector.ZComponent, SecondNumber=0)  # -> LargerThan, OrEqualTo; disabled
dispatch = Dispatch(List=deconstruct_brep.Faces, DispatchPattern=larger_than.LargerThan)  # -> ListA, ListB; disabled
dispatch_2 = Dispatch(List=deconstruct_brep.Faces, DispatchPattern=larger_than_2.LargerThan)  # -> ListA, ListB; disabled
dispatch_3 = Dispatch(List=deconstruct_brep.Faces, DispatchPattern=larger_than_3.LargerThan)  # -> ListA, ListB; disabled
westsurface = Surface(dispatch.ListB)  # disabled
southsurface = Surface(dispatch_2.ListB)  # disabled
upsurface = Surface(dispatch_3.ListA)  # disabled
downsurface = Surface(dispatch_3.ListB)  # disabled
eastsurface = Surface(dispatch.ListA)  # disabled
northsurface = Surface(dispatch_2.ListA)  # disabled
entwine = Entwine(Branch00=eastsurface, Branch01=northsurface, Branch02=downsurface, FlattenInputs=True)  # -> simplify(SmallCover); disabled
entwine_2 = Entwine(Branch00=westsurface, Branch01=southsurface, Branch02=upsurface, FlattenInputs=True)  # -> simplify(LargeCover); disabled

# ----
number = Number(width)  # disabled
number_2 = Number(number_slider)  # disabled

# ---- group: 3DGrids
bounding_box = BoundingBox(Content=flatten(brep), Plane=PlaneXY(0, 0, 0), UnionBox=True)  # -> Box, Box_2; disabled
number_3 = Number(gap)  # disabled
area_2 = Area(Geometry=bounding_box.Box)  # -> Area, Centroid; disabled
scale = Scale(Geometry=bounding_box.Box, Center=area_2.Centroid, Factor=2)  # -> Geometry, Transform; disabled
deconstruct_brep_2 = DeconstructBrep(Brep=scale.Geometry)  # -> Faces, Edges, Vertices; disabled
area_3 = Area(Geometry=deconstruct_brep_2.Faces)  # -> Area, Centroid; disabled
deconstruct_vector_2 = DeconstructVector(Vector=area_3.Centroid)  # -> flatten(XComponent), YComponent, ZComponent; disabled
subtraction = Subtraction(A=number_3, B=number)  # disabled
sort_list = SortList(Keys=deconstruct_vector_2.ZComponent, ValuesValuesA=deconstruct_brep_2.Faces)  # -> Keys, ValuesValuesA; disabled
sort_list_2 = SortList(Keys=deconstruct_vector_2.XComponent, ValuesValuesA=deconstruct_brep_2.Faces)  # -> Keys, ValuesValuesA; disabled
sort_list_3 = SortList(Keys=deconstruct_vector_2.YComponent, ValuesValuesA=deconstruct_brep_2.Faces)  # -> Keys, ValuesValuesA; disabled
unit_y = UnitY(Factor=number_3)  # disabled
unit_z = UnitZ(Factor=number_3)  # disabled
unit_x = UnitX(Factor=number_3)  # disabled
list_item = ListItem(List=sort_list_2.ValuesValuesA, Index=0, Wrap=True)  # disabled
list_item_2 = ListItem(List=sort_list_3.ValuesValuesA, Index=0, Wrap=True)  # disabled
list_item_3 = ListItem(List=sort_list.ValuesValuesA, Index=0, Wrap=True)  # disabled
merge_3 = Merge(Data1=list_item, Data2=list_item_2, Data3=list_item_3)  # disabled
merge_4 = Merge(Data1=unit_x, Data2=unit_y, Data3=unit_z)  # disabled
amplitude = Amplitude(Vector=merge_4, Amplitude=number)  # disabled
amplitude_2 = Amplitude(Vector=merge_4, Amplitude=subtraction)  # disabled
reverse = Reverse(Vector=amplitude_2)  # disabled
linear_array = LinearArray(Geometry=merge_3, Direction=merge_4, Count=number_2)  # -> Geometry, Transform; disabled
extrude = Extrude(Base=linear_array.Geometry, Direction=graft(amplitude))  # -> simplify(SmallExtrusion); disabled
extrude_2 = Extrude(Base=linear_array.Geometry, Direction=graft(reverse))  # -> simplify(LargeExtrusion); disabled

# ----
cluster = Cluster(content=brep, text=merge, setdirectionint=direction, number_3=gap, number=width, number_2=number_slider, brep=brep)  # -> result, result_2
brep_2 = Brep(cluster.result)
surface = Surface(cluster.result_2)

cluster_2 = Cluster_2(
    srfdirselection=srfdirselection,
    setcuttingdirint=stripdirection,
    content=brep,
    text=merge_2,
    number_2=gap_2,
    number=width_2,
    number_3=Slider(100, range=0..100),
    brep=brep)  # -> result, result_2
surface_2 = Surface(cluster_2.result_2)
brep_3 = Brep(cluster_2.result)

bake_attributes = BakeAttributes(activate=False, groupListTgthr=False)  # -> out; inputs objs: list, names: list of String, layers: list of String, colors: list of Color, pWidths: list of Double, wiresEach: list of Int32, materials: list, activate: Boolean, groupListTgthr: Boolean
# ---------- bake_attributes: C# ----------
    //Inserts geometry into the Rhino document, with custom attributes
    //Written by Giulio Piacentino
    //Version written 2011 10 18 - for Grasshopper 0.8.52

    if (activate)
    {
      int groupIndex = -1;
      if(groupListTgthr)
        groupIndex = doc.Groups.Add();

      for(int i = 0; i < objs.Count; i++)
      {
        object obj = objs[i];
        if(obj == null)
        {
          Print("No object to bake");
          return;
        }

        //Make new attribute to set name
        Rhino.DocObjects.ObjectAttributes att = new Rhino.DocObjects.ObjectAttributes();

        string name = names.Count > 0 ? names[i % names.Count] : null;
        //Set object name
        if(!string.IsNullOrEmpty(name))
        {
          att.Name = name;
        }

        Color color = colors.Count > 0 ? colors[i % colors.Count] : new Color();
        //Set color
        if(!color.IsEmpty)
        {
          att.ColorSource = Rhino.DocObjects.ObjectColorSource.ColorFromObject; //Make the color type "by object"
          att.ObjectColor = color;

          att.PlotColorSource = Rhino.DocObjects.ObjectPlotColorSource.PlotColorFromObject; //Make the plot color type "by object"
          att.PlotColor = color;
        }

        string layer = layers.Count > 0 ? layers[i % layers.Count] : null;
        //Set layer
        if(!string.IsNullOrEmpty(layer) && Rhino.DocObjects.Layer.IsValidName(layer))
        {
          //Get the current layer index
          Rhino.DocObjects.Tables.LayerTable layerTable = doc.Layers;
          int layerIndex = layerTable.Find(layer, true);

          if(layerIndex < 0) //This layer does not exist, we add it
          {
            Rhino.DocObjects.Layer onlayer = new Rhino.DocObjects.Layer(); //Make a new layer
            onlayer.Name = layer;

            layerIndex = layerTable.Add(onlayer); //Add the layer to the layer table
            if (layerIndex > -1) //We manged to add layer!
            {
              att.LayerIndex = layerIndex;
              Print("Added new layer to the document at position " + layerIndex + " named " + layer + ". ");
            } else
              Print("Layer did not add. Try cleaning up your layers."); //This never happened to me.
          }
          else
            att.LayerIndex = layerIndex; //We simply add to the existing layer
        }


        double pWidth = pWidths.Count > 0 ? pWidths[i % pWidths.Count] : 0;
        //Set plotweight
        if(pWidth > 0)
        {
          att.PlotWeightSource = Rhino.DocObjects.ObjectPlotWeightSource.PlotWeightFromObject;
          att.PlotWeight = pWidth;
        }


        object material = materials.Count > 0 ? materials[i % materials.Count] : null;
        //Set material
        bool materialByName = !string.IsNullOrEmpty(material as string);
        Rhino.Display.DisplayMaterial inMaterial = material as Rhino.Display.DisplayMaterial;
        if(material is Color)
        {
          inMaterial = new Rhino.Display.DisplayMaterial((Color) material);
        }
        if(material != null && inMaterial == null && !materialByName)
        {
          if(!(material is string))
          {
            try //We also resort to try with IConvertible
            {
              inMaterial = (Rhino.Display.DisplayMaterial) Convert.ChangeType(material, typeof(Rhino.Display.DisplayMaterial));
            }
            catch(InvalidCastException)
            {
            }
          }
        }
        if(inMaterial != null || materialByName)
        {
          string matName;

          if(!materialByName)
          {
            matName = string.Format("A:{0}-D:{1}-E:{2}-S:{3},{4}-T:{5}",
              Format(inMaterial.Ambient),
              Format(inMaterial.Diffuse),
              Format(inMaterial.Emission),
              Format(inMaterial.Specular),
              inMaterial.Shine.ToString(),
              inMaterial.Transparency.ToString()
              );
          }
          else
          {
            matName = (string) material;
          }

          int materialIndex = doc.Materials.Find(matName, true);
          if(materialIndex < 0 && !materialByName) //Material does not exist and we have its specs
          {
            materialIndex = doc.Materials.Add(); //Let's add it
            if(materialIndex > -1)
            {
              Print("Added new material at position " + materialIndex + " named \"" + matName + "\". ");
              Rhino.DocObjects.Material m = doc.Materials[materialIndex];
              m.Name = matName;
              m.AmbientColor = inMaterial.Ambient;
              m.DiffuseColor = inMaterial.Diffuse;
              m.EmissionColor = inMaterial.Emission;
              //m.ReflectionColor = no equivalent
              m.SpecularColor = inMaterial.Specular;
              m.Shine = inMaterial.Shine;
              m.Transparency = inMaterial.Transparency;
              //m.TransparentColor = no equivalent
              m.CommitChanges();

              att.MaterialSource = Rhino.DocObjects.ObjectMaterialSource.MaterialFromObject;
              att.MaterialIndex = materialIndex;
            }
            else
              Print("Material did not add. Try cleaning up your materials."); //This never happened to me.
          }
          else if(materialIndex < 0 && materialByName) //Material does not exist and we do not have its specs. We do nothing
          {
            Print("Warning: material name not found. I cannot set the source to this material name. Add a material with name: " + matName);
          }
          else
          {
            //If this material exists, we do not replace it!
            att.MaterialSource = Rhino.DocObjects.ObjectMaterialSource.MaterialFromObject;
            att.MaterialIndex = materialIndex;
          }
        }


        int wires = wiresEach.Count > 0 ? wiresEach[i % wiresEach.Count] : 0;
        //Set wire density
        if(wires == -1 || wires > 0)
        {
          att.WireDensity = wires;
        }

        Bake(obj, att, groupIndex);
      }
    }
    else
    {
      Print("Inactive");
    }

  }

  //<Custom additional code>

  void Bake(object obj, Rhino.DocObjects.ObjectAttributes att, int groupIndex)
  {
    if(obj == null)
      return;

    Guid id;

    //Bake to the right type of object
    if(obj is GeometryBase)
    {
      GeometryBase geomObj = obj as GeometryBase;

      switch(geomObj.ObjectType)
      {
        case Rhino.DocObjects.ObjectType.Brep:
          id = doc.Objects.AddBrep(obj as Brep, att);
          break;
        case Rhino.DocObjects.ObjectType.Curve:
          id = doc.Objects.AddCurve(obj as Curve, att);
          break;
        case Rhino.DocObjects.ObjectType.Point:
          id = doc.Objects.AddPoint((obj as Rhino.Geometry.Point).Location, att);
          break;
        case Rhino.DocObjects.ObjectType.Surface:
          id = doc.Objects.AddSurface(obj as Surface, att);
          break;
        case Rhino.DocObjects.ObjectType.Mesh:
          id = doc.Objects.AddMesh(obj as Mesh, att);
          break;
        case (Rhino.DocObjects.ObjectType) 1073741824://Rhino.DocObjects.ObjectType.Extrusion:
          id = (Guid) typeof(Rhino.DocObjects.Tables.ObjectTable).InvokeMember("AddExtrusion", BindingFlags.Instance | BindingFlags.InvokeMethod, null, doc.Objects, new object[]{obj, att});
          break;
        case Rhino.DocObjects.ObjectType.PointSet:
          id = doc.Objects.AddPointCloud(obj as Rhino.Geometry.PointCloud, att); //This is a speculative entry
          break;
        default:
          Print("The script does not know how to handle this type of geometry: " + obj.GetType().FullName);
          return;
      }
    }
    else
    {
      Type objectType = obj.GetType();

      if(objectType == typeof(Arc))
      {
        id = doc.Objects.AddArc((Arc) obj, att);
      }
      else if(objectType == typeof(Box))
      {
        id = doc.Objects.AddBrep(((Box) obj).ToBrep(), att);
      }
      else if(objectType == typeof(Circle))
      {
        id = doc.Objects.AddCircle((Circle) obj, att);
      }
      else if(objectType == typeof(Ellipse))
      {
        id = doc.Objects.AddEllipse((Ellipse) obj, att);
      }
      else if(objectType == typeof(Polyline))
      {
        id = doc.Objects.AddPolyline((Polyline) obj, att);
      }
      else if(objectType == typeof(Sphere))
      {
        id = doc.Objects.AddSphere((Sphere) obj, att);
      }
      else if(objectType == typeof(Point3d))
      {
        id = doc.Objects.AddPoint((Point3d) obj, att);
      }
      else if(objectType == typeof(Line))
      {
        id = doc.Objects.AddLine((Line) obj, att);
      }
      else if(objectType == typeof(Vector3d))
      {
        Print("Impossible to bake vectors");
        return;
      }
      else if(obj is IEnumerable)
      {
        int newGroupIndex;
        if(groupIndex == -1)
          newGroupIndex = doc.Groups.Add();
        else
          newGroupIndex = groupIndex;
        foreach(object o in obj as IEnumerable)
        {
          Bake(o, att, newGroupIndex);
        }
        return;
      }
      else
      {
        Print("Unhandled type: " + objectType.FullName);
        return;
      }
    }

    if(groupIndex != -1)
    {
      doc.Groups.AddToGroup(groupIndex, id);
      Print("Added " + obj.GetType().Name + " to group number " + groupIndex);
    }
    else
      Print("Added " + obj.GetType().Name);
  }

  static string Format(Color c)
  {
    return (new System.Text.StringBuilder("A")).Append(c.A.ToString()).Append("R").Append(c.R.ToString()).Append("G")
      .Append(c.G.ToString()).Append("B").Append(c.B.ToString()).ToString();
# ---------- end bake_attributes ----------

object_bake = ObjectBake(
    BakeToggle=bake_2,
    GeometryObjects=brep_3,
    Layer=stripdirection,
    ObjectName=facadethickness_2,
    ObjectColor=RGB(255, 255, 255),
    LayerColor=RGB(255, 255, 255))
brep_4 = Brep(brep_3)
colour_picker = ColourPicker(PickedColour=RGB(255, 162, 0))
custom_preview = CustomPreview(Geometry=brep_4, Shader=colour_picker)

object_bake_2 = ObjectBake(
    BakeToggle=bake,
    GeometryObjects=brep_2,
    Layer=direction,
    ObjectName=facadethickness,
    ObjectColor=RGB(255, 255, 255),
    LayerColor=RGB(255, 255, 255))
brep_5 = Brep(brep_2)
colour_picker_2 = ColourPicker(PickedColour=RGB(255, 0, 0))
custom_preview_2 = CustomPreview(Geometry=brep_5, Shader=colour_picker_2)

panel = Panel(" ")  # disabled
text_join = TextJoin(Text=merge, Join=panel)  # disabled
convert_to_document_units = ConvertToDocumentUnits(ValueString=text_join)  # disabled

fcadethickness = Number(convert_to_document_units)  # disabled
setdirectionint = Integer(direction)  # disabled

tree_branch = TreeBranch(Tree=entwine, Path=setdirectionint, MaintainPaths=True)  # -> simplify(graft(Branch)); disabled
tree_branch_2 = TreeBranch(Tree=extrude_2, Path=setdirectionint, MaintainPaths=True)  # disabled
brep_6 = Brep(tree_branch_2)  # disabled
surface_3 = Surface(tree_branch)  # disabled

tree_branch_3 = TreeBranch(Tree=entwine_2, Path=setdirectionint, MaintainPaths=True)  # -> simplify(graft(Branch)); disabled
tree_branch_4 = TreeBranch(Tree=extrude, Path=setdirectionint, MaintainPaths=True)  # disabled
surface_4 = Surface(tree_branch_3)  # disabled
brep_7 = Brep(tree_branch_4)  # disabled

trim_solid = TrimSolid(Shape=surface_4, Cutters=brep_7)  # disabled
evaluate_surface_2 = EvaluateSurface(Surface=trim_solid, Point=Point(0, 0, 0))  # -> Point, Normal, UDirection, VDirection, Frame; disabled
amplitude_3 = Amplitude(Vector=evaluate_surface_2.Normal, Amplitude=fcadethickness)  # disabled
extrude_3 = Extrude(Base=trim_solid, Direction=amplitude_3)  # disabled
brep_8 = Brep(extrude_3)  # disabled

trim_solid_2 = TrimSolid(Shape=surface_3, Cutters=brep_6)  # disabled
evaluate_surface_3 = EvaluateSurface(Surface=trim_solid_2, Point=Point(0, 0, 0))  # -> Point, Normal, UDirection, VDirection, Frame; disabled
amplitude_4 = Amplitude(Vector=evaluate_surface_3.Normal, Amplitude=fcadethickness)  # disabled
extrude_4 = Extrude(Base=trim_solid_2, Direction=amplitude_4)  # disabled
brep_9 = Brep(extrude_4)  # disabled

entwine_3 = Entwine(Branch0X=brep_8, Branch1X=brep_9, FlattenInputs=False)  # -> simplify(Result); disabled

brep_10 = Brep(entwine_3)  # disabled

# ==== cluster Cluster
number = ClusterInput()
content = ClusterInput()
number_2 = ClusterInput()
brep = ClusterInput()
number_3 = ClusterInput()

# ---- group: SrfSelection
deconstruct_brep = DeconstructBrep(Brep=flatten(brep))  # -> flatten(Faces), Edges, Vertices
area = Area(Geometry=deconstruct_brep.Faces)  # -> Area, Centroid
surface_closest_point = SurfaceClosestPoint(Point=area.Centroid, Surface=deconstruct_brep.Faces)  # -> Point, UVPoint, Distance
evaluate_surface = EvaluateSurface(Surface=deconstruct_brep.Faces, Point=surface_closest_point.UVPoint)  # -> Point, Normal, UDirection, VDirection, Frame
deconstruct_vector = DeconstructVector(Vector=evaluate_surface.Normal)  # -> XComponent, YComponent, ZComponent
larger_than = LargerThan(FirstNumber=deconstruct_vector.XComponent, SecondNumber=0)  # -> LargerThan, OrEqualTo
larger_than_2 = LargerThan(FirstNumber=deconstruct_vector.YComponent, SecondNumber=0)  # -> LargerThan, OrEqualTo
larger_than_3 = LargerThan(FirstNumber=deconstruct_vector.ZComponent, SecondNumber=0)  # -> LargerThan, OrEqualTo
dispatch = Dispatch(List=deconstruct_brep.Faces, DispatchPattern=larger_than.LargerThan)  # -> ListA, ListB
dispatch_2 = Dispatch(List=deconstruct_brep.Faces, DispatchPattern=larger_than_2.LargerThan)  # -> ListA, ListB
dispatch_3 = Dispatch(List=deconstruct_brep.Faces, DispatchPattern=larger_than_3.LargerThan)  # -> ListA, ListB
westsurface = Surface(dispatch.ListB)
southsurface = Surface(dispatch_2.ListB)
upsurface = Surface(dispatch_3.ListA)
eastsurface = Surface(dispatch.ListA)
northsurface = Surface(dispatch_2.ListA)
downsurface = Surface(dispatch_3.ListB)
entwine = Entwine(Branch00=eastsurface, Branch01=northsurface, Branch02=downsurface, FlattenInputs=True)  # -> simplify(SmallCover)
entwine_2 = Entwine(Branch00=westsurface, Branch01=southsurface, Branch02=upsurface, FlattenInputs=True)  # -> simplify(LargeCover)

# ----
number_4 = Number(number)
number_5 = Number(number_2)

# ---- group: 3DGrids
bounding_box = BoundingBox(Content=flatten(content), Plane=PlaneXY(0, 0, 0), UnionBox=True)  # -> Box, Box_2
number_6 = Number(number_3)
area_2 = Area(Geometry=bounding_box.Box)  # -> Area, Centroid
scale = Scale(Geometry=bounding_box.Box, Center=area_2.Centroid, Factor=2)  # -> Geometry, Transform
deconstruct_brep_2 = DeconstructBrep(Brep=scale.Geometry)  # -> Faces, Edges, Vertices
area_3 = Area(Geometry=deconstruct_brep_2.Faces)  # -> Area, Centroid
deconstruct_vector_2 = DeconstructVector(Vector=area_3.Centroid)  # -> flatten(XComponent), YComponent, ZComponent
subtraction = Subtraction(A=number_6, B=number_4)
sort_list = SortList(Keys=deconstruct_vector_2.ZComponent, ValuesValuesA=deconstruct_brep_2.Faces)  # -> Keys, ValuesValuesA
sort_list_2 = SortList(Keys=deconstruct_vector_2.XComponent, ValuesValuesA=deconstruct_brep_2.Faces)  # -> Keys, ValuesValuesA
sort_list_3 = SortList(Keys=deconstruct_vector_2.YComponent, ValuesValuesA=deconstruct_brep_2.Faces)  # -> Keys, ValuesValuesA
unit_y = UnitY(Factor=number_6)
unit_z = UnitZ(Factor=number_6)
unit_x = UnitX(Factor=number_6)
list_item = ListItem(List=sort_list_2.ValuesValuesA, Index=0, Wrap=True)
list_item_2 = ListItem(List=sort_list_3.ValuesValuesA, Index=0, Wrap=True)
list_item_3 = ListItem(List=sort_list.ValuesValuesA, Index=0, Wrap=True)
merge = Merge(Data1=list_item, Data2=list_item_2, Data3=list_item_3)
merge_2 = Merge(Data1=unit_x, Data2=unit_y, Data3=unit_z)
amplitude = Amplitude(Vector=merge_2, Amplitude=number_4)
amplitude_2 = Amplitude(Vector=merge_2, Amplitude=subtraction)
reverse = Reverse(Vector=amplitude_2)
linear_array = LinearArray(Geometry=merge, Direction=merge_2, Count=number_5)  # -> Geometry, Transform
extrude = Extrude(Base=linear_array.Geometry, Direction=graft(amplitude))  # -> simplify(SmallExtrusion)
extrude_2 = Extrude(Base=linear_array.Geometry, Direction=graft(reverse))  # -> simplify(LargeExtrusion)

# ----
setdirectionint = ClusterInput()
text = ClusterInput()

text_join = TextJoin(Text=text, Join=" ")
convert_to_document_units = ConvertToDocumentUnits(ValueString=text_join)

fcadethickness = Number(convert_to_document_units)
setdirectionint_2 = Integer(setdirectionint)

tree_branch = TreeBranch(Tree=entwine, Path=setdirectionint_2, MaintainPaths=True)  # -> simplify(graft(Branch))
tree_branch_2 = TreeBranch(Tree=extrude_2, Path=setdirectionint_2, MaintainPaths=True)
brep_2 = Brep(tree_branch_2)
surface = Surface(tree_branch)

tree_branch_3 = TreeBranch(Tree=entwine_2, Path=setdirectionint_2, MaintainPaths=True)  # -> simplify(graft(Branch))
tree_branch_4 = TreeBranch(Tree=extrude, Path=setdirectionint_2, MaintainPaths=True)
surface_2 = Surface(tree_branch_3)
brep_3 = Brep(tree_branch_4)

trim_solid = TrimSolid(Shape=surface_2, Cutters=brep_3)
evaluate_surface_2 = EvaluateSurface(Surface=trim_solid, Point=Point(0, 0, 0))  # -> Point, Normal, UDirection, VDirection, Frame
amplitude_3 = Amplitude(Vector=evaluate_surface_2.Normal, Amplitude=fcadethickness)
extrude_3 = Extrude(Base=trim_solid, Direction=amplitude_3)
surface_3 = Surface(trim_solid)
brep_4 = Brep(extrude_3)

trim_solid_2 = TrimSolid(Shape=surface, Cutters=brep_2)
evaluate_surface_3 = EvaluateSurface(Surface=trim_solid_2, Point=Point(0, 0, 0))  # -> Point, Normal, UDirection, VDirection, Frame
amplitude_4 = Amplitude(Vector=evaluate_surface_3.Normal, Amplitude=fcadethickness)
extrude_4 = Extrude(Base=trim_solid_2, Direction=amplitude_4)
surface_4 = Surface(trim_solid_2)
brep_5 = Brep(extrude_4)

entwine_3 = Entwine(Branch0X=brep_4, Branch1X=brep_5, FlattenInputs=False)  # -> simplify(Result)
entwine_4 = Entwine(Branch0X=surface_3, Branch1X=surface_4, FlattenInputs=False)  # -> simplify(Result)

result = ClusterOutput(entwine_3)
result_2 = ClusterOutput(entwine_4)

# ==== cluster Cluster_2
number = ClusterInput()
number_2 = ClusterInput()
number_3 = ClusterInput()
content = ClusterInput()
brep = ClusterInput()

# ---- group: 3DGrids
bounding_box = BoundingBox(Content=flatten(content), Plane=PlaneXY(0, 0, 0), UnionBox=True)  # -> Box, Box_2
number_4 = Number(number_2)
number_5 = Number(number)
number_6 = Number(number_3)
area = Area(Geometry=bounding_box.Box)  # -> Area, Centroid
scale = Scale(Geometry=bounding_box.Box, Center=area.Centroid, Factor=2)  # -> Geometry, Transform
deconstruct_brep = DeconstructBrep(Brep=scale.Geometry)  # -> Faces, Edges, Vertices
area_2 = Area(Geometry=deconstruct_brep.Faces)  # -> Area, Centroid
deconstruct_vector = DeconstructVector(Vector=area_2.Centroid)  # -> flatten(XComponent), YComponent, ZComponent
subtraction = Subtraction(A=number_4, B=number_5)
sort_list = SortList(Keys=deconstruct_vector.ZComponent, ValuesValuesA=deconstruct_brep.Faces)  # -> Keys, ValuesValuesA
sort_list_2 = SortList(Keys=deconstruct_vector.XComponent, ValuesValuesA=deconstruct_brep.Faces)  # -> Keys, ValuesValuesA
sort_list_3 = SortList(Keys=deconstruct_vector.YComponent, ValuesValuesA=deconstruct_brep.Faces)  # -> Keys, ValuesValuesA
unit_y = UnitY(Factor=number_4)
unit_z = UnitZ(Factor=number_4)
unit_x = UnitX(Factor=number_4)
list_item = ListItem(List=sort_list_2.ValuesValuesA, Index=0, Wrap=True)
list_item_2 = ListItem(List=sort_list_3.ValuesValuesA, Index=0, Wrap=True)
list_item_3 = ListItem(List=sort_list.ValuesValuesA, Index=0, Wrap=True)
merge = Merge(Data1=list_item, Data2=list_item_2, Data3=list_item_3)
merge_2 = Merge(Data1=unit_x, Data2=unit_y, Data3=unit_z)
amplitude = Amplitude(Vector=merge_2, Amplitude=number_5)
amplitude_2 = Amplitude(Vector=merge_2, Amplitude=subtraction)
reverse = Reverse(Vector=amplitude_2)
linear_array = LinearArray(Geometry=merge, Direction=merge_2, Count=number_6)  # -> Geometry, Transform
extrude = Extrude(Base=linear_array.Geometry, Direction=graft(amplitude))  # -> simplify(SmallExtrusion)
extrude_2 = Extrude(Base=linear_array.Geometry, Direction=graft(reverse))  # -> simplify(LargeExtrusion)

# ---- group: SrfSelection
deconstruct_brep_2 = DeconstructBrep(Brep=flatten(brep))  # -> flatten(Faces), Edges, Vertices
area_3 = Area(Geometry=deconstruct_brep_2.Faces)  # -> Area, Centroid
surface_closest_point = SurfaceClosestPoint(Point=area_3.Centroid, Surface=deconstruct_brep_2.Faces)  # -> Point, UVPoint, Distance
evaluate_surface = EvaluateSurface(Surface=deconstruct_brep_2.Faces, Point=surface_closest_point.UVPoint)  # -> Point, Normal, UDirection, VDirection, Frame
deconstruct_vector_2 = DeconstructVector(Vector=evaluate_surface.Normal)  # -> XComponent, YComponent, ZComponent
larger_than = LargerThan(FirstNumber=deconstruct_vector_2.XComponent, SecondNumber=0)  # -> LargerThan, OrEqualTo
larger_than_2 = LargerThan(FirstNumber=deconstruct_vector_2.YComponent, SecondNumber=0)  # -> LargerThan, OrEqualTo
larger_than_3 = LargerThan(FirstNumber=deconstruct_vector_2.ZComponent, SecondNumber=0)  # -> LargerThan, OrEqualTo
dispatch = Dispatch(List=deconstruct_brep_2.Faces, DispatchPattern=larger_than.LargerThan)  # -> ListA, ListB
dispatch_2 = Dispatch(List=deconstruct_brep_2.Faces, DispatchPattern=larger_than_2.LargerThan)  # -> ListA, ListB
dispatch_3 = Dispatch(List=deconstruct_brep_2.Faces, DispatchPattern=larger_than_3.LargerThan)  # -> ListA, ListB
westsurface = Surface(dispatch.ListB)
southsurface = Surface(dispatch_2.ListB)
upsurface = Surface(dispatch_3.ListA)
eastsurface = Surface(dispatch.ListA)
northsurface = Surface(dispatch_2.ListA)
downsurface = Surface(dispatch_3.ListB)
entwine = Entwine(Branch00=eastsurface, Branch01=northsurface, Branch02=downsurface, FlattenInputs=True)  # -> simplify(SmallCover)
entwine_2 = Entwine(Branch00=westsurface, Branch01=southsurface, Branch02=upsurface, FlattenInputs=True)  # -> simplify(LargeCover)

# ----
setcuttingdirint = ClusterInput()
srfdirselection = ClusterInput()
text = ClusterInput()

text_join = TextJoin(Text=text, Join=" ")
convert_to_document_units = ConvertToDocumentUnits(ValueString=text_join)

srfdirselection_2 = Integer(srfdirselection)
fcadethickness = Number(convert_to_document_units)
setcuttingdirint_2 = Integer(setcuttingdirint)

tree_branch = TreeBranch(Tree=entwine, Path=srfdirselection_2, MaintainPaths=True)  # -> simplify(graft(Branch))
tree_branch_2 = TreeBranch(Tree=extrude_2, Path=setcuttingdirint_2, MaintainPaths=True)
brep_2 = Brep(tree_branch_2)
surface = Surface(tree_branch)

tree_branch_3 = TreeBranch(Tree=entwine_2, Path=srfdirselection_2, MaintainPaths=True)  # -> simplify(graft(Branch))
tree_branch_4 = TreeBranch(Tree=extrude, Path=setcuttingdirint_2, MaintainPaths=True)
surface_2 = Surface(tree_branch_3)
brep_3 = Brep(tree_branch_4)

trim_solid = TrimSolid(Shape=surface_2, Cutters=brep_3)
evaluate_surface_2 = EvaluateSurface(Surface=trim_solid, Point=Point(0, 0, 0))  # -> Point, Normal, UDirection, VDirection, Frame
amplitude_3 = Amplitude(Vector=evaluate_surface_2.Normal, Amplitude=fcadethickness)
extrude_3 = Extrude(Base=trim_solid, Direction=amplitude_3)
surface_3 = Surface(trim_solid)
brep_4 = Brep(extrude_3)

trim_solid_2 = TrimSolid(Shape=surface, Cutters=brep_2)
evaluate_surface_3 = EvaluateSurface(Surface=trim_solid_2, Point=Point(0, 0, 0))  # -> Point, Normal, UDirection, VDirection, Frame
amplitude_4 = Amplitude(Vector=evaluate_surface_3.Normal, Amplitude=fcadethickness)
extrude_4 = Extrude(Base=trim_solid_2, Direction=amplitude_4)
surface_4 = Surface(trim_solid_2)
brep_5 = Brep(extrude_4)

entwine_3 = Entwine(Branch0X=brep_4, Branch1X=brep_5, FlattenInputs=False)  # -> simplify(Result)
entwine_4 = Entwine(Branch0X=surface_3, Branch1X=surface_4, FlattenInputs=False)  # -> simplify(Result)

result = ClusterOutput(entwine_3)
result_2 = ClusterOutput(entwine_4)
