# Grasshopper definition 20180216_DS_Kangaroo_ProgramManagement.gh (Grasshopper 1.0.4)
# plug-ins: Human, EleFront, FalseStartToggle, Kangaroo2 Components, HDTTreeUtils

colour_picker = ColourPicker(PickedColour=RGB(0, 89, 255))
colour_picker_2 = ColourPicker(PickedColour=RGB(255, 0, 0))
colour_picker_3 = ColourPicker(PickedColour=RGB(0, 246, 255))
colour_picker_4 = ColourPicker(PickedColour=RGB(255, 200, 0))
colour_picker_5 = ColourPicker(PickedColour=RGB(247, 0, 255))
colour_picker_6 = ColourPicker(PickedColour=RGB(60, 255, 0))
merge = Merge(
    Data1=colour_picker_2,
    Data2=colour_picker_4,
    Data3=colour_picker_6,
    Data4=colour_picker,
    Data5=colour_picker_3,
    Data6=colour_picker_5)

wire_display = WireDisplay(wire=Slider(3, range=0..4), selected=Toggle(False), trig=Button())  # -> out, A
# ---------- wire_display: VB ----------
    Dim document As GH_Document = owner.OnPingDocument()
    If (document Is Nothing) Then Return

    For Each att As IGH_Attributes In document.Attributes
      Dim param As IGH_Param = TryCast(att.DocObject, IGH_Param)
      If (param Is Nothing) Then Continue For
      If (trig) Then
        If (selected And Not param.Attributes.GetTopLevel.Selected) Then Continue For
        Select Case wire
          Case 2
            param.WireDisplay = GH_ParamWireDisplay.faint
          Case 3
            param.WireDisplay = GH_ParamWireDisplay.hidden
          Case Else
            param.WireDisplay = GH_ParamWireDisplay.Default
        End Select
      End If
    Next
# ---------- end wire_display ----------

audituriompt = Point(<point referenced from the Rhino model>)
gallerypt = Point(<point referenced from the Rhino model>)
retailpt = Point(<point referenced from the Rhino model>)
officecommpt = Point(<point referenced from the Rhino model>)
officegovpt = Point(<point referenced from the Rhino model>)
hotelpt = Point(<point referenced from the Rhino model>)
program = Panel("""Auditorium
Gallery
Offices (Gov.)
Retail 
Offices (Comm.)
Hotel""")
sphere_radius = Panel("""52
29
141
89
120
105""")
merge_2 = Merge(Data1=audituriompt, Data2=gallerypt, Data3=officegovpt, Data4=retailpt, Data5=officecommpt, Data6=hotelpt)

number_slider = Slider(6, range=0..10)  # disabled
xz_plane = XZPlane(Origin=Point(0, 0, 0))  # disabled
yz_plane = YZPlane(Origin=Point(0, 0, 0))  # disabled
xy_plane = XYPlane(Origin=Point(0, 0, 0))  # disabled
number_slider_2 = Slider(600, range=150..600)  # disabled
plane = Plane(yz_plane)  # disabled
polygon = Polygon(Plane=plane, Radius=number_slider_2, Segments=number_slider, FilletRadius=0)  # -> Polygon, Length; disabled
control_points = ControlPoints(Curve=polygon.Polygon)  # -> Points, Weights, Knots; disabled
split_list = SplitList(List=control_points.Points, Index=1)  # -> ListA, ListB; disabled

number_slider_3 = Slider(5, range=0..10)  # disabled
xy_plane_2 = XYPlane(Origin=Point(0, 0, 0))  # disabled
number_slider_4 = Slider(37, range=1..300)  # disabled
plane_offset = PlaneOffset(BasePlane=xy_plane_2, Offset=1)  # disabled
polygon_2 = Polygon(Plane=plane_offset, Radius=number_slider_4, Segments=number_slider_3, FilletRadius=0)  # -> Polygon, Length; disabled
control_points_2 = ControlPoints(Curve=polygon_2.Polygon)  # -> Points, Weights, Knots; disabled
split_list_2 = SplitList(List=control_points_2.Points, Index=1)  # -> ListA, ListB; disabled

_2_gallery_retail = Slider(108, range=0..600)  # disabled
vector = Vector(plane)  # disabled
_5_commoffice = Slider(402, range=0..600)  # disabled
_1_auditorium = Slider(0, range=0..600)  # disabled
_3_govoffice = Slider(199, range=0..600)  # disabled
_4_retail = Slider(296, range=0..600)  # disabled
_6_hotel = Slider(504, range=0..600)  # disabled
merge_3 = Merge(Data1=_1_auditorium, Data2=_2_gallery_retail, Data3=_3_govoffice, Data4=_4_retail, Data5=_5_commoffice, Data6=_6_hotel)  # disabled
amplitude = Amplitude(Vector=vector, Amplitude=merge_3)  # disabled
move = Move(Geometry=split_list.ListB, Motion=amplitude)  # -> Geometry, Transform; disabled

number_slider_5 = Slider(5, range=0..10)  # disabled

connect = Panel("""1
1
2
2
4""")  # disabled
panel = Panel("""2
4
4
6
6""")  # disabled

boundingbrep = Brep(<brep referenced from the Rhino model>)
extractpoint = Point([Point(13.18946303, 39.44674043, 51.23362966), Point(-33.08791798, 12.12565576, 1.208442208), Point(-124.8720606, 21.17210407, 182.5741186), Point(1.717851109, 80.62284787, -76.12203816), Point(117.5501222, -74.96380618, 190.7610526), Point(40.22758686, -91.51731708, -18.76711046)])
radius = Number([52, 29, 141, 89, 120, 105])
radius_2 = Number(sphere_radius)  # disabled

entwine = Entwine(Branch0X=flatten(extractpoint), Branch1X=boundingbrep, FlattenInputs=False)  # -> simplify(Result)
scaleoverall = Slider(120, range=0..1000)
division = Division(A=1, B=scaleoverall)
xy_plane_3 = XYPlane(Origin=Point(0, 0, 0))
scale = Scale(Geometry=entwine, Center=xy_plane_3, Factor=division)  # -> Geometry, Transform
division_2 = Division(A=radius, B=scaleoverall)
explode_tree = ExplodeTree(Data=scale.Geometry)  # -> Branch0, Branch1
boundingbrep_2 = Brep(explode_tree.Branch1)
extractpoint_2 = Point(explode_tree.Branch0)
radius_3 = Number(division_2)

area = Area(Geometry=boundingbrep_2)  # -> Area, Centroid
scalebounding = Slider(0.655, range=0.01..2)
scale_2 = Scale(Geometry=boundingbrep_2, Center=area.Centroid, Factor=scalebounding)  # -> Geometry, Transform
volume = Volume(Geometry=scale_2.Geometry)  # -> Volume, Centroid
brep_wireframe = BrepWireframe(Brep=scale_2.Geometry, Density=-1)
custom_preview_lineweights = CustomPreviewLineweights(
    Geometry=brep_wireframe,
    Shader={diffuse=RGB(0, 0, 0), emission=RGB(0, 0, 0), shine=0, specular=RGB(255, 255, 255), transparency=0},
    Absolute=False)

collider = Collider(Objects=extractpoint_2, Radii=radius_3, Strength=Slider(15, range=0..50))

lobby2_gallery_retail = Slider(0, range=0..600)  # disabled
lobby4_commoffice = Slider(151, range=0..600)  # disabled
vector_2 = Vector(xy_plane_2)  # disabled
lobby1_auditorium = Slider(50, range=0..600)  # disabled
lobby3_govoffice = Slider(150, range=0..600)  # disabled
lobby5_hotel = Slider(101, range=0..600)  # disabled
merge_4 = Merge(
    Data1=lobby1_auditorium,
    Data2=lobby2_gallery_retail,
    Data3=lobby3_govoffice,
    Data4=lobby4_commoffice,
    Data5=lobby5_hotel)  # disabled

amplitude_2 = Amplitude(Vector=vector_2, Amplitude=merge_4)  # disabled

move_2 = Move(Geometry=split_list_2.ListB, Motion=amplitude_2)  # -> Geometry, Transform; disabled

programpts = Point(move.Geometry)  # disabled
lobbypts = Point(move_2.Geometry)  # disabled

list_item = ListItem(List=programpts, Index=expr("x-1", connect), Wrap=True)  # disabled
list_item_2 = ListItem(List=programpts, Index=expr("x-1", panel), Wrap=True)  # disabled

cluster = Cluster(data=programpts)  # disabled
line = Line(StartPoint=cluster, EndPoint=graft(lobbypts))  # -> flatten(Line); disabled
line_2 = Line(StartPoint=flatten(list_item), EndPoint=flatten(list_item_2))  # disabled
merge_5 = Merge(Data1=line_2, Data2=line)  # disabled
custom_preview_lineweights_2 = CustomPreviewLineweights(Geometry=merge_5, Shader=colour_picker_5, Thickness=number_slider_5, Absolute=False)  # disabled

somehowconnect = Panel("""1
1
1
2
5""")  # disabled
panel_2 = Panel("""3
5
6
3
6""")  # disabled
list_item_3 = ListItem(List=programpts, Index=expr("x-1", somehowconnect), Wrap=True)  # disabled
list_item_4 = ListItem(List=programpts, Index=expr("x-1", panel_2), Wrap=True)  # disabled

number_slider_6 = Slider(3, range=0..10)  # disabled
line_3 = Line(StartPoint=flatten(list_item_3), EndPoint=flatten(list_item_4))  # disabled
custom_preview_lineweights_3 = CustomPreviewLineweights(Geometry=line_3, Shader=colour_picker_3, Thickness=number_slider_6, Absolute=False)  # disabled

divided = Panel("""2
3
3
3
4""")  # disabled
panel_3 = Panel("""5
4
5
6
5""")  # disabled
list_item_5 = ListItem(List=programpts, Index=expr("x-1", divided), Wrap=True)  # disabled
list_item_6 = ListItem(List=programpts, Index=expr("x-1", panel_3), Wrap=True)  # disabled

number_slider_7 = Slider(3, range=0..10)  # disabled
line_4 = Line(StartPoint=flatten(list_item_5), EndPoint=flatten(list_item_6))  # disabled
custom_preview_lineweights_4 = CustomPreviewLineweights(Geometry=line_4, Shader=colour_picker_4, Thickness=number_slider_7, Absolute=False)  # disabled

number_slider_8 = Slider(3, range=0..10)  # disabled
collider_2 = Collider(Objects=programpts, Radii=sphere_radius, Strength=number_slider_8)  # disabled

number_slider_9 = Slider(10, range=0..10)  # disabled
connectcrv = Curve(line_2)  # disabled
constanttension = ConstantTension(Line=connectcrv, Strength=number_slider_9)  # disabled

number_slider_10 = Slider(4, range=0..10)  # disabled
lobbyconnectcrv = Curve(line)  # disabled
constanttension_2 = ConstantTension(Line=lobbyconnectcrv, Strength=number_slider_10)  # disabled

exitpts = Point(lobbypts)  # disabled
boolean_toggle = BooleanToggle(True)  # disabled
boolean_toggle_2 = BooleanToggle(True)  # disabled
boolean_toggle_3 = BooleanToggle(True)  # disabled
anchorxyz = AnchorXYZ(Point=exitpts, X=boolean_toggle, Y=boolean_toggle_2, Z=boolean_toggle_3, Strength=1000)  # disabled

number_slider_11 = Slider(-2, range=-10..0)  # disabled
dividecrv = Curve(line_4)  # disabled
constanttension_3 = ConstantTension(Line=dividecrv, Strength=number_slider_11)  # disabled

somehowconnectcrv = Curve(line_3)  # disabled
number_slider_12 = Slider(2, range=0..10)  # disabled
constanttension_4 = ConstantTension(Line=somehowconnectcrv, Strength=number_slider_12)  # disabled

number_slider_13 = Slider(5, range=0..1000)  # disabled
number_slider_14 = Slider(10, range=0..10)  # disabled
timer = Timer(TimerInterval=20, Target=[solver, bouncysolver])  # disabled
number_slider_15 = Slider(1, range=0..20)  # disabled
false_start_toggle = FalseStartToggle(False)  # disabled
entwine_2 = Entwine(
    Branch0X=flatten(collider_2),
    Branch1X=flatten(anchorxyz),
    Branch2X=constanttension,
    Branch3X=constanttension_2,
    Branch4X=constanttension_4,
    Branch5X=constanttension_3,
    FlattenInputs=False)  # -> simplify(Result); disabled
button = Button()  # disabled
solver = Solver(GoalObjects=entwine_2, Reset=button, Threshold=number_slider_13, Tolerance=number_slider_14, On=false_start_toggle)  # -> I, V, O; disabled
bouncysolver = BouncySolver(
    GoalObjects=entwine_2,
    Reset=button,
    Threshold=number_slider_13,
    Tolerance=number_slider_14,
    Damping=0.99,
    Iterations=number_slider_15,
    On=false_start_toggle)  # -> I, V, O; disabled
panel_4 = Panel(bouncysolver.I)  # disabled

matchpaths = MatchPaths(TargetData=flatten(bouncysolver.O), SourceData=entwine_2)  # -> RestructuredData, IndexMap; disabled
number_slider_16 = Slider(5, range=0..10)  # disabled
explode_tree_2 = ExplodeTree(Data=matchpaths.RestructuredData)  # -> Branch0, Branch1, Branch2, Branch3, Branch4, Branch5; disabled
connectcrv_2 = Curve(explode_tree_2.Branch2)  # disabled
colour_picker_7 = ColourPicker(PickedColour=RGB(3, 3, 3))  # disabled
custom_preview_lineweights_5 = CustomPreviewLineweights(Geometry=connectcrv_2, Shader=colour_picker_7, Thickness=number_slider_16, Absolute=False)  # disabled
lobbyconnection = Curve(explode_tree_2.Branch3)  # disabled
colour_picker_8 = ColourPicker(PickedColour=RGB(102, 102, 102))  # disabled
custom_preview_lineweights_6 = CustomPreviewLineweights(Geometry=lobbyconnection, Shader=colour_picker_8, Thickness=number_slider_16, Absolute=False)  # disabled
somehowconnect_2 = Curve(explode_tree_2.Branch4)  # disabled
colour_picker_9 = ColourPicker(PickedColour=RGB(204, 204, 204))  # disabled
custom_preview_lineweights_7 = CustomPreviewLineweights(Geometry=somehowconnect_2, Shader=colour_picker_9, Thickness=number_slider_16, Absolute=False)  # disabled
divide = Curve(explode_tree_2.Branch5)  # disabled
colour_picker_10 = ColourPicker(PickedColour=RGB(255, 0, 0))  # disabled
custom_preview_lineweights_8 = CustomPreviewLineweights(Geometry=divide, Shader=colour_picker_10, Thickness=number_slider_16, Absolute=False)  # disabled

list_length = ListLength(List=programpts)  # disabled
split_list_3 = SplitList(List=bouncysolver.V, Index=list_length)  # -> ListA, ListB; disabled
sphere = Sphere(Base=split_list_3.ListA, Radius=sphere_radius)  # -> reparameterize(Sphere); disabled
settings_speed = SettingsSpeed()  # disabled
mesh_brep = MeshBrep(Brep=sphere, Settings=settings_speed)  # disabled
custom_preview = CustomPreview(Geometry=sphere, Material=merge)  # disabled

list_length_2 = ListLength(List=exitpts)  # disabled
exit = Panel("Lobby ")  # disabled
series = Series(Start=1, Step=1, Count=list_length_2)  # -> simplify(graft(Series)); disabled
concatenate = Concatenate(FragmentA=exit, FragmentB=series)  # -> flatten(Result); disabled
define_text_dot = DefineTextDot(Text=program, Location=split_list_3.ListA, Font="Arial", Size=14)  # disabled
define_text_dot_2 = DefineTextDot(Text=concatenate, Location=lobbypts, Font="Arial", Size=14)  # disabled

cluster_2 = Cluster(data=sphere)  # disabled
surface_closest_point = SurfaceClosestPoint(Point=graft(lobbypts), Surface=cluster_2)  # -> Point, UVPoint, Distance; disabled
osculating_circles = OsculatingCircles(Surface=cluster_2, Point=simplify(surface_closest_point.UVPoint))  # -> Point, FirstCircle, SecondCircle; disabled
cluster_3 = Cluster(data=merge)  # disabled
custom_preview_2 = CustomPreview(Geometry=osculating_circles.FirstCircle, Material=cluster_3)  # disabled
custom_preview_3 = CustomPreview(Geometry=osculating_circles.SecondCircle, Material=cluster_3)  # disabled

xy_plane_4 = XYPlane(Origin=Point(0, 0, 0))  # disabled
average = Average(Input=bouncysolver.V)  # disabled
distance = Distance(PointA=average, PointB=xy_plane_4)  # disabled
value_tracker = ValueTracker(
    distance,
    TrackerAutoDomain=True,
    TrackerColour=RGB(255, 155, 0),
    TrackerPeriod=60,
    TrackerUpdate=25,
    TrackerDomain=[0, 1])  # disabled
panel_5 = Panel(value_tracker)  # disabled

extractpoint_3 = Point(split_list_3.ListA)  # disabled

mesh_sphere_ex = MeshSphereEx(Base=extractpoint_2, Radius=radius_3, Count=Slider(5, range=0..100))
mesh = Mesh(mesh_sphere_ex)
panel_6 = Panel(mesh)
active = FalseStartToggle(False)

number_slider_17 = Slider(3, range=0..10)
mesh_edges = MeshEdges(Mesh=mesh)  # -> NakedEdges, InteriorEdges, NonManifoldEdges
deconstruct_mesh = DeconstructMesh(Mesh=mesh)  # -> Vertices, Faces, Colours, Normals
length = Length(Curve=mesh_edges.InteriorEdges)
rigidpointset = RigidPointSet(Points=deconstruct_mesh.Vertices, Strength=number_slider_17)  # -> RigidBody, Planes
clamplength = ClampLength(Line=mesh_edges.InteriorEdges, LowerLimit=0, UpperLimit=length, Strength=number_slider_17)
length_line = LengthLine(Line=mesh_edges.InteriorEdges, Strength=number_slider_17)

deconstruct_mesh_2 = DeconstructMesh(Mesh=mesh)  # -> Vertices, Faces, Colours, Normals
settings_speed_2 = SettingsSpeed()
mesh_brep_2 = MeshBrep(Brep=scale_2.Geometry, Settings=settings_speed_2)
int = BooleanToggle(True)
solidpointcollide = SolidPointCollide(
    Points=deconstruct_mesh_2.Vertices,
    Solid=mesh_brep_2,
    Interior=int,
    Unidirectional=True,
    Strength=Slider(10, range=0..50))  # -> flatten(S)

number_slider_18 = Slider(2, range=0..20)
smooth = Smooth(M=mesh, Strength=number_slider_18)
tangentialsmooth = TangentialSmooth(M=mesh, Strength=number_slider_18)  # disabled

volume_2 = Volume(Mesh=mesh, Strength=Slider(20, range=0..50))

gate_or = GateOr(A=Button(), B=active)

show = Show(G=mesh_sphere_ex)

reset = Button()
entwine_3 = Entwine(
    Branch0X=show,
    Branch1X=volume_2,
    Branch2X=rigidpointset.RigidBody,
    Branch3X=solidpointcollide,
    Branch4X=smooth,
    Branch5X=collider,
    FlattenInputs=False)
solver_2 = Solver(
    GoalObjects=entwine_3,
    Reset=reset,
    Restart=False,
    Parallel=True,
    Threshold=Slider(100, range=0..100),
    Tolerance=0.0001,
    AddCurrent=False,
    On=gate_or)  # -> V, O
sort_objects_by_type = SortObjectsByType(RhinoObjects=solver_2.O)  # -> Points, Curves, Surfaces, Breps, Meshes, TextObjects, HatchObjects, LightObjects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
timer_2 = Timer(TimerInterval=200, Target=solver_2)
mesh_2 = Mesh(sort_objects_by_type.Meshes)

checkvalid = Panel(mesh_2)

volume_3 = Volume(Geometry=mesh_2)  # -> Volume, Centroid
volume_4 = Volume(Geometry=mesh)  # -> Volume, Centroid
subtraction = Subtraction(A=flatten(volume_4.Volume), B=flatten(volume_3.Volume))
absolute = Absolute(Value=subtraction)
logarithm = Logarithm(Value=absolute)

bake_attributes = BakeAttributes(objs=mesh_2, names=program, layers="Temp", colors=merge, activate=Button(), groupListTgthr=False)  # -> out; inputs objs: list, names: list of String, layers: list of String, colors: list of Color, pWidths: list of Double, wiresEach: list of Int32, materials: list, activate: Boolean, groupListTgthr: Boolean
# ---------- bake_attributes: C# ----------
    //Inserts geometry into the Rhino document, with custom attributes
    //Written by Giulio Piacentino
    //Version written 2011 10 18 - for Grasshopper 0.8.52

    if (activate)
    {
      int groupIndex = -1;
      if(groupListTgthr)
        groupIndex = doc.Groups.Add();

      for(int i = 0; i < objs.Count; i++)
      {
        object obj = objs[i];
        if(obj == null)
        {
          Print("No object to bake");
          return;
        }

        //Make new attribute to set name
        Rhino.DocObjects.ObjectAttributes att = new Rhino.DocObjects.ObjectAttributes();

        string name = names.Count > 0 ? names[i % names.Count] : null;
        //Set object name
        if(!string.IsNullOrEmpty(name))
        {
          att.Name = name;
        }

        Color color = colors.Count > 0 ? colors[i % colors.Count] : new Color();
        //Set color
        if(!color.IsEmpty)
        {
          att.ColorSource = Rhino.DocObjects.ObjectColorSource.ColorFromObject; //Make the color type "by object"
          att.ObjectColor = color;

          att.PlotColorSource = Rhino.DocObjects.ObjectPlotColorSource.PlotColorFromObject; //Make the plot color type "by object"
          att.PlotColor = color;
        }

        string layer = layers.Count > 0 ? layers[i % layers.Count] : null;
        //Set layer
        if(!string.IsNullOrEmpty(layer) && Rhino.DocObjects.Layer.IsValidName(layer))
        {
          //Get the current layer index
          Rhino.DocObjects.Tables.LayerTable layerTable = doc.Layers;
          int layerIndex = layerTable.Find(layer, true);

          if(layerIndex < 0) //This layer does not exist, we add it
          {
            Rhino.DocObjects.Layer onlayer = new Rhino.DocObjects.Layer(); //Make a new layer
            onlayer.Name = layer;

            layerIndex = layerTable.Add(onlayer); //Add the layer to the layer table
            if (layerIndex > -1) //We manged to add layer!
            {
              att.LayerIndex = layerIndex;
              Print("Added new layer to the document at position " + layerIndex + " named " + layer + ". ");
            } else
              Print("Layer did not add. Try cleaning up your layers."); //This never happened to me.
          }
          else
            att.LayerIndex = layerIndex; //We simply add to the existing layer
        }


        double pWidth = pWidths.Count > 0 ? pWidths[i % pWidths.Count] : 0;
        //Set plotweight
        if(pWidth > 0)
        {
          att.PlotWeightSource = Rhino.DocObjects.ObjectPlotWeightSource.PlotWeightFromObject;
          att.PlotWeight = pWidth;
        }


        object material = materials.Count > 0 ? materials[i % materials.Count] : null;
        //Set material
        bool materialByName = !string.IsNullOrEmpty(material as string);
        Rhino.Display.DisplayMaterial inMaterial = material as Rhino.Display.DisplayMaterial;
        if(material is Color)
        {
          inMaterial = new Rhino.Display.DisplayMaterial((Color) material);
        }
        if(material != null && inMaterial == null && !materialByName)
        {
          if(!(material is string))
          {
            try //We also resort to try with IConvertible
            {
              inMaterial = (Rhino.Display.DisplayMaterial) Convert.ChangeType(material, typeof(Rhino.Display.DisplayMaterial));
            }
            catch(InvalidCastException)
            {
            }
          }
        }
        if(inMaterial != null || materialByName)
        {
          string matName;

          if(!materialByName)
          {
            matName = string.Format("A:{0}-D:{1}-E:{2}-S:{3},{4}-T:{5}",
              Format(inMaterial.Ambient),
              Format(inMaterial.Diffuse),
              Format(inMaterial.Emission),
              Format(inMaterial.Specular),
              inMaterial.Shine.ToString(),
              inMaterial.Transparency.ToString()
              );
          }
          else
          {
            matName = (string) material;
          }

          int materialIndex = doc.Materials.Find(matName, true);
          if(materialIndex < 0 && !materialByName) //Material does not exist and we have its specs
          {
            materialIndex = doc.Materials.Add(); //Let's add it
            if(materialIndex > -1)
            {
              Print("Added new material at position " + materialIndex + " named \"" + matName + "\". ");
              Rhino.DocObjects.Material m = doc.Materials[materialIndex];
              m.Name = matName;
              m.AmbientColor = inMaterial.Ambient;
              m.DiffuseColor = inMaterial.Diffuse;
              m.EmissionColor = inMaterial.Emission;
              //m.ReflectionColor = no equivalent
              m.SpecularColor = inMaterial.Specular;
              m.Shine = inMaterial.Shine;
              m.Transparency = inMaterial.Transparency;
              //m.TransparentColor = no equivalent
              m.CommitChanges();

              att.MaterialSource = Rhino.DocObjects.ObjectMaterialSource.MaterialFromObject;
              att.MaterialIndex = materialIndex;
            }
            else
              Print("Material did not add. Try cleaning up your materials."); //This never happened to me.
          }
          else if(materialIndex < 0 && materialByName) //Material does not exist and we do not have its specs. We do nothing
          {
            Print("Warning: material name not found. I cannot set the source to this material name. Add a material with name: " + matName);
          }
          else
          {
            //If this material exists, we do not replace it!
            att.MaterialSource = Rhino.DocObjects.ObjectMaterialSource.MaterialFromObject;
            att.MaterialIndex = materialIndex;
          }
        }


        int wires = wiresEach.Count > 0 ? wiresEach[i % wiresEach.Count] : 0;
        //Set wire density
        if(wires == -1 || wires > 0)
        {
          att.WireDensity = wires;
        }

        Bake(obj, att, groupIndex);
      }
    }
    else
    {
      Print("Inactive");
    }

  }

  //<Custom additional code>

  void Bake(object obj, Rhino.DocObjects.ObjectAttributes att, int groupIndex)
  {
    if(obj == null)
      return;

    Guid id;

    //Bake to the right type of object
    if(obj is GeometryBase)
    {
      GeometryBase geomObj = obj as GeometryBase;

      switch(geomObj.ObjectType)
      {
        case Rhino.DocObjects.ObjectType.Brep:
          id = doc.Objects.AddBrep(obj as Brep, att);
          break;
        case Rhino.DocObjects.ObjectType.Curve:
          id = doc.Objects.AddCurve(obj as Curve, att);
          break;
        case Rhino.DocObjects.ObjectType.Point:
          id = doc.Objects.AddPoint((obj as Rhino.Geometry.Point).Location, att);
          break;
        case Rhino.DocObjects.ObjectType.Surface:
          id = doc.Objects.AddSurface(obj as Surface, att);
          break;
        case Rhino.DocObjects.ObjectType.Mesh:
          id = doc.Objects.AddMesh(obj as Mesh, att);
          break;
        case (Rhino.DocObjects.ObjectType) 1073741824://Rhino.DocObjects.ObjectType.Extrusion:
          id = (Guid) typeof(Rhino.DocObjects.Tables.ObjectTable).InvokeMember("AddExtrusion", BindingFlags.Instance | BindingFlags.InvokeMethod, null, doc.Objects, new object[]{obj, att});
          break;
        case Rhino.DocObjects.ObjectType.PointSet:
          id = doc.Objects.AddPointCloud(obj as Rhino.Geometry.PointCloud, att); //This is a speculative entry
          break;
        default:
          Print("The script does not know how to handle this type of geometry: " + obj.GetType().FullName);
          return;
      }
    }
    else
    {
      Type objectType = obj.GetType();

      if(objectType == typeof(Arc))
      {
        id = doc.Objects.AddArc((Arc) obj, att);
      }
      else if(objectType == typeof(Box))
      {
        id = doc.Objects.AddBrep(((Box) obj).ToBrep(), att);
      }
      else if(objectType == typeof(Circle))
      {
        id = doc.Objects.AddCircle((Circle) obj, att);
      }
      else if(objectType == typeof(Ellipse))
      {
        id = doc.Objects.AddEllipse((Ellipse) obj, att);
      }
      else if(objectType == typeof(Polyline))
      {
        id = doc.Objects.AddPolyline((Polyline) obj, att);
      }
      else if(objectType == typeof(Sphere))
      {
        id = doc.Objects.AddSphere((Sphere) obj, att);
      }
      else if(objectType == typeof(Point3d))
      {
        id = doc.Objects.AddPoint((Point3d) obj, att);
      }
      else if(objectType == typeof(Line))
      {
        id = doc.Objects.AddLine((Line) obj, att);
      }
      else if(objectType == typeof(Vector3d))
      {
        Print("Impossible to bake vectors");
        return;
      }
      else if(obj is IEnumerable)
      {
        int newGroupIndex;
        if(groupIndex == -1)
          newGroupIndex = doc.Groups.Add();
        else
          newGroupIndex = groupIndex;
        foreach(object o in obj as IEnumerable)
        {
          Bake(o, att, newGroupIndex);
        }
        return;
      }
      else
      {
        Print("Unhandled type: " + objectType.FullName);
        return;
      }
    }

    if(groupIndex != -1)
    {
      doc.Groups.AddToGroup(groupIndex, id);
      Print("Added " + obj.GetType().Name + " to group number " + groupIndex);
    }
    else
      Print("Added " + obj.GetType().Name);
  }

  static string Format(Color c)
  {
    return (new System.Text.StringBuilder("A")).Append(c.A.ToString()).Append("R").Append(c.R.ToString()).Append("G")
      .Append(c.G.ToString()).Append("B").Append(c.B.ToString()).ToString();
# ---------- end bake_attributes ----------

value_tracker_2 = ValueTracker(
    logarithm,
    TrackerAutoDomain=True,
    TrackerColour=RGB(255, 155, 0),
    TrackerPeriod=120,
    TrackerUpdate=25,
    TrackerDomain=[0, 1])
value_tracker_3 = ValueTracker(
    volume.Volume,
    TrackerAutoDomain=True,
    TrackerColour=RGB(255, 155, 0),
    TrackerPeriod=120,
    TrackerUpdate=100,
    TrackerDomain=[0, 1])
volumedifflog = Panel(value_tracker_2)
boundingvolume = Panel(value_tracker_3)

mesh_edges_2 = MeshEdges(Mesh=mesh_2)  # -> NakedEdges, InteriorEdges, NonManifoldEdges
length_2 = Length(Curve=mesh_edges_2.InteriorEdges)
mass_addition = MassAddition(Input=length_2)  # -> flatten(Result), PartialResults
custom_preview_4 = CustomPreview(Geometry=mesh_edges_2.InteriorEdges, Material=graft(merge))

absolute_2 = Absolute(Value=mass_addition.Result)

logarithm_2 = Logarithm(Value=absolute_2)

value_tracker_4 = ValueTracker(
    logarithm_2,
    TrackerAutoDomain=True,
    TrackerColour=RGB(255, 155, 0),
    TrackerPeriod=120,
    TrackerUpdate=25,
    TrackerDomain=[0, 1])
linelengthdifflog = Panel(value_tracker_4)

# ==== cluster Cluster
data = ClusterInput()
explode_tree = ExplodeTree(Data=simplify(graft(data)))  # -> flatten(Branch0), flatten(Branch1), flatten(Branch2), flatten(Branch3), flatten(Branch4), flatten(Branch5)
merge = Merge(Data1=explode_tree.Branch1, Data2=explode_tree.Branch3)
entwine = Entwine(
    Branch00=explode_tree.Branch0,
    Branch01=merge,
    Branch02=explode_tree.Branch2,
    Branch03=explode_tree.Branch4,
    Branch04=explode_tree.Branch5,
    FlattenInputs=True)  # -> simplify(Result)
result = ClusterOutput(entwine)
