# Grasshopper definition 20180218_DS_SlicePlane+VolumeCheck.gh (Grasshopper 1.0.4)
# Copyright: SCIArc AddinCui

# ----
# Program: Auditorium
# Gallery
# Offices (Gov.)
# Retail
# Offices (Comm.)
# Hotel
officecommbreps = Brep(<brep referenced from the Rhino model>)
auditoriumbrep = Brep(<brep referenced from the Rhino model>)
officegovbreps = Brep([<brep referenced from the Rhino model> x2])
gallerybrep = Brep(<brep referenced from the Rhino model>)
retailbreps = Brep(<brep referenced from the Rhino model>)
hotelbreps = Brep(<brep referenced from the Rhino model>)
entwine = Entwine(
    Branch0X=auditoriumbrep,
    Branch1X=gallerybrep,
    Branch2X=officegovbreps,
    Branch3X=retailbreps,
    Branch4X=officecommbreps,
    Branch5X=hotelbreps,
    FlattenInputs=False)  # -> simplify(Result)
volume = Volume(Geometry=entwine)  # -> Volume, Centroid
mass_addition = MassAddition(Input=volume.Volume)  # -> Result, PartialResults
targetvol = Panel("""600000
100000
11796000
3000000
7200000
4800000""")
number = Number(graft(targetvol))
subtraction = Subtraction(A=mass_addition.Result, B=number)  # -> flatten(Result)
division = Division(A=graft(subtraction), B=mass_addition.Result)  # -> flatten(Result)
diff = Panel(subtraction)
ratio = Panel(division)

brep = Brep([<brep referenced from the Rhino model> x6])
cross_reference = CrossReference(ListListA=brep, ListListB=brep, CrossMode=2)  # -> ListListA, ListListB
brep_brep = BrepBrep(BrepA=cross_reference.ListListA, BrepB=cross_reference.ListListB)  # -> Curves, Points
curve = Curve(brep_brep.Curves)
control_points = ControlPoints(Curve=curve)  # -> Points, Weights, Knots
plane_fit = PlaneFit(Points=control_points.Points)  # -> Plane, Deviation
number_slider = Slider(50, range=0..100)
plane_surface = PlaneSurface(Plane=plane_fit.Plane, XSize=number_slider, YSize=number_slider)
deconstruct_brep = DeconstructBrep(Brep=plane_surface)  # -> Faces, Edges, Vertices
list_item = ListItem(List=control_points.Points, Index=0, Wrap=True)
list_item_2 = ListItem(List=deconstruct_brep.Vertices, Index=0, Wrap=True)
vector_2pt = Vector2Pt(PointA=list_item_2, PointB=list_item, Unitize=False)  # -> Vector, Length
move = Move(Geometry=plane_surface, Motion=vector_2pt.Vector)  # -> Geometry, Transform
scale = Scale(Geometry=move.Geometry, Center=list_item, Factor=Slider(2, range=0..10))  # -> Geometry, Transform
