# Grasshopper definition 20180304_GuanMuGong.gh (Grasshopper 1.0.4)

multiplication = Multiplication(A=Slider(4, range=2..5), B="3")
multiplication_2 = Multiplication(A=Slider(4, range=2..5), B="3")
addition = Addition(A=multiplication, B="1")
panel = Panel(multiplication_2)
panel_2 = Panel(addition)
subtraction = Subtraction(A=panel, B="1")

colour_picker = ColourPicker(PickedColour=RGB(13, 13, 13))
colour_picker_2 = ColourPicker(PickedColour=RGB(255, 0, 0))
unit_z = UnitZ(Factor=Slider(-300, range=-500..500))

number_slider = Slider(1, range=0..2)

input_controlcureve = Curve([<curve referenced from the Rhino model> x3])
loft = Loft(
    Curves=input_controlcureve,
    Options={Adjust=False, Closed=False, LoftEnds=0, LoftSimp=0, LoftType=0, Rebuild=10, Refit=0.01})

divide_surface = DivideSurface(Surface=loft, UCount=subtraction, VCount=multiplication)  # -> simplify(Points), unitize(simplify(Normals)), Parameters
dispatch = Dispatch(List=divide_surface.Points, DispatchPattern=[True, False, False])  # -> ListA, ListB
dispatch_2 = Dispatch(List=dispatch.ListB, DispatchPattern=[True, False])  # -> ListA, ListB
point = Point(dispatch.ListA)
point_2 = Point(dispatch_2.ListA)
point_3 = Point(dispatch_2.ListB)
flip_matrix = FlipMatrix(Data=point)
flip_matrix_2 = FlipMatrix(Data=point_2)
flip_matrix_3 = FlipMatrix(Data=point_3)
dispatch_3 = Dispatch(List=flip_matrix, DispatchPattern=[True, False, True])  # -> ListA, ListB
dispatch_4 = Dispatch(List=flip_matrix_2, DispatchPattern=[True, True, False])  # -> ListA, ListB
dispatch_5 = Dispatch(List=flip_matrix_3, DispatchPattern=[False, True, True])  # -> ListA, ListB
point_4 = Point(dispatch_4.ListA)
point_5 = Point(dispatch_3.ListA)
point_6 = Point(dispatch_5.ListA)
polyline = PolyLine(Vertices=point_5, Closed=False)
polyline_2 = PolyLine(Vertices=point_4, Closed=False)
polyline_3 = PolyLine(Vertices=point_6, Closed=False)
explode = Explode(Curve=polyline, Recursive=True)  # -> Segments, Vertices
explode_2 = Explode(Curve=polyline_2, Recursive=True)  # -> Segments, Vertices
explode_3 = Explode(Curve=polyline_3, Recursive=True)  # -> Segments, Vertices
dispatch_6 = Dispatch(List=explode_2.Segments, DispatchPattern=[True, False])  # -> ListA, ListB
dispatch_7 = Dispatch(List=explode.Segments, DispatchPattern=[True, False])  # -> ListA, ListB
dispatch_8 = Dispatch(List=explode_3.Segments, DispatchPattern=[True, False])  # -> ListA, ListB
curve = Curve(dispatch_7.ListA)
curve_2 = Curve(dispatch_6.ListB)
curve_3 = Curve(dispatch_8.ListB)

interpolate = Interpolate(Vertices=divide_surface.Points, Degree=3, Periodic=False, KnotStyle=1)  # -> Curve, Length, Domain
point_on_curve = PointOnCurve(dispatch_7.ListA, parameter=0.5)
surface_closest_point = SurfaceClosestPoint(Point=point_on_curve, Surface=loft)  # -> Point, UVPoint, Distance
point_on_curve_2 = PointOnCurve(curve_2, parameter=0.5)
surface_closest_point_2 = SurfaceClosestPoint(Point=point_on_curve_2, Surface=loft)  # -> Point, UVPoint, Distance
point_on_curve_3 = PointOnCurve(curve_3, parameter=0.5)
surface_closest_point_3 = SurfaceClosestPoint(Point=point_on_curve_3, Surface=loft)  # -> Point, UVPoint, Distance
line = Line(StartPoint=point_on_curve, EndPoint=surface_closest_point.Point)
line_2 = Line(StartPoint=point_on_curve_2, EndPoint=surface_closest_point_2.Point)
line_3 = Line(StartPoint=point_on_curve_3, EndPoint=surface_closest_point_3.Point)
point_on_curve_4 = PointOnCurve(line, parameter=0.5)
point_on_curve_5 = PointOnCurve(line_2, parameter=0.5)
point_on_curve_6 = PointOnCurve(line_3, parameter=0.5)
vector_2pt = Vector2Pt(PointA=point_on_curve, PointB=point_on_curve_4, Unitize=False)  # -> Vector, Length
vector_2pt_2 = Vector2Pt(PointA=point_on_curve_2, PointB=point_on_curve_5, Unitize=False)  # -> Vector, Length
vector_2pt_3 = Vector2Pt(PointA=point_on_curve_3, PointB=point_on_curve_6, Unitize=False)  # -> Vector, Length
move = Move(Geometry=curve, Motion=vector_2pt.Vector)  # -> Geometry, Transform
move_2 = Move(Geometry=curve_2, Motion=vector_2pt_2.Vector)  # -> Geometry, Transform
move_3 = Move(Geometry=curve_3, Motion=vector_2pt_3.Vector)  # -> Geometry, Transform

surface = Surface(reparameterize(loft))
iso_curve = IsoCurve(Surface=surface, UVPoint=".5,.5")  # -> UIsocurve, VIsocurve
brep_wireframe = BrepWireframe(Brep=surface, Density=-1)

entwine = Entwine(Branch00=vector_2pt.Length, Branch01=vector_2pt_2.Length, Branch02=vector_2pt_3.Length, FlattenInputs=True)  # -> flatten(Result)
sort_list = SortList(Keys=entwine)  # -> Keys, ValuesValuesA
list_length = ListLength(List=sort_list.Keys)

merge = Merge(Data1=move.Geometry, Data2=move_2.Geometry, Data3=move_3.Geometry)

subtraction_2 = Subtraction(A=list_length, B="1")

list_item = ListItem(List=sort_list.Keys, Index=subtraction_2, Wrap=True)
division = Division(A=list_item, B="2")

multiplication_3 = Multiplication(A=division, B=Slider(3, range=1..3))

extend_curve = ExtendCurve(Curve=merge, Type=0, Start=multiplication_3, End=multiplication_3)
extend_curve_2 = ExtendCurve(Curve=interpolate.Curve, Type=0, Start=multiplication_3, End=multiplication_3)
pipe = Pipe(Curve=extend_curve, Radius=division, Caps=number_slider)
pipe_2 = Pipe(Curve=extend_curve_2, Radius=division, Caps=number_slider)

output_brep = Brep([pipe_2, pipe])
move_4 = Move(Geometry=pipe, Motion=unit_z)  # -> Geometry, Transform
custom_preview = CustomPreview(Geometry=move_4.Geometry, Material=colour_picker)
move_5 = Move(Geometry=pipe_2, Motion=unit_z)  # -> Geometry, Transform
custom_preview_2 = CustomPreview(Geometry=move_5.Geometry, Material=colour_picker_2)
brep_brep = BrepBrep(BrepA=move_4.Geometry, BrepB=flatten(move_5.Geometry))  # -> Curves, Points
