# Grasshopper definition 20180305_DD_GridStructureFacade.gh (Grasshopper 1.0.4)
# plug-ins: G E N E R A T I O N, LunchBox, MetaHopper

panel = Panel("-1")  # disabled
panel_2 = Panel("1")  # disabled
next = Button()  # disabled
srf_no = Slider(68, range=0..100)  # disabled
counter = Counter(Start=0, Step=panel, Pause=next, Reset=False)  # disabled
panel_3 = Panel(counter)  # disabled

number_slider = Slider(1, range=0..10)  # disabled

brep = Brep([<brep referenced from the Rhino model> x4])  # disabled
deconstruct_brep = DeconstructBrep(Brep=brep)  # -> flatten(Faces), Edges, Vertices; disabled

surface = Surface([<surface referenced from the Rhino model> x14])  # disabled
is_planar = IsPlanar(Surface=surface, Interior=True)  # -> Planar, Plane; disabled
failedsomehow = Panel("""8
19
21
22
56
66
67
68
73
74
75
77""")  # disabled
amplitude = Amplitude(Vector=is_planar.Plane, Amplitude=number_slider)  # disabled
extrude = Extrude(Base=surface, Direction=amplitude)  # disabled

number_slider_2 = Slider(1, range=0..4)  # disabled
control_wire_display = ControlWireDisplay(WireDisplay=number_slider_2)  # disabled

number_slider_3 = Slider(500, range=0..500)  # disabled
construct_domain = ConstructDomain(DomainStart=number_slider_3, DomainEnd=expr("-x", number_slider_3))  # disabled

inputsurfaces = Surface(deconstruct_brep.Faces)  # disabled
layername = Panel("Temp")  # disabled
bake = Button()  # disabled
negativeex = BooleanToggle(False)  # disabled
negativein = BooleanToggle(False)  # disabled
shiftex = BooleanToggle(False)  # disabled
brep_2 = BooleanToggle(True)  # disabled
integer = Integer(srf_no)  # disabled
list_item = ListItem(List=inputsurfaces, Index=integer, Wrap=True)  # disabled
custom_preview = CustomPreview(
    Geometry=list_item,
    Material={diffuse=RGB(221, 160, 221), emission=RGB(66, 48, 66), shine=0.5, specular=RGB(255, 255, 255), transparency=0})  # disabled
stream_filter = StreamFilter(Gate=brep_2, Stream0=1, Stream1=0)  # disabled

is_planar_2 = IsPlanar(Surface=list_item, Interior=True)  # -> Planar, Plane; disabled
plane_surface = PlaneSurface(Plane=is_planar_2.Plane, XSize=construct_domain, YSize=construct_domain)  # disabled
surface_split = SurfaceSplit(Surface=plane_surface, Curves=list_item)  # disabled
list_item_2 = ListItem(List=surface_split, Index=1, Wrap=True)  # disabled
flip = Flip(Surface=list_item_2, Guide=list_item)  # -> Surface, Result; disabled

panel_4 = Panel("0, 0")  # disabled

mullionwidth = Slider(0.1, range=-2..2)  # disabled
negative = Negative(Value=mullionwidth)  # disabled
stream_filter_2 = StreamFilter(Gate=negativeex, Stream0=mullionwidth, Stream1=negative)  # disabled

singlesurface = Surface(reparameterize(flip.Surface))  # disabled
stream_filter_3 = StreamFilter(Gate=negativein, Stream0=mullionwidth, Stream1=negative)  # disabled
number = Number(stream_filter_2)  # disabled

surface_2 = Surface(singlesurface)  # disabled
evaluate_surface = EvaluateSurface(Surface=surface_2, Point=panel_4)  # -> Point, Normal, UDirection, VDirection, Frame; disabled
deconstruct_brep_2 = DeconstructBrep(Brep=surface_2)  # -> Faces, simplify(Edges), Vertices; disabled
plane_normal = PlaneNormal(Origin=evaluate_surface.Point, ZAxis=evaluate_surface.Normal)  # disabled
join_curves = JoinCurves(Curves=deconstruct_brep_2.Edges, Preserve=False)  # -> simplify(Curves); disabled
project = Project(Geometry=join_curves, Plane=plane_normal)  # -> Geometry, Transform; disabled
curve = Curve(project.Geometry)  # disabled
offset_curve = OffsetCurve(Curve=curve, Distance=expr("-x", number), Plane=PlaneXY(0, 0, 0), Corners=1)  # -> simplify(Curve); disabled

number_2 = Number(stream_filter_3)  # disabled

surface_3 = Surface(singlesurface)  # disabled
usize = Slider(8, range=0..10)  # disabled
vsize = Slider(12, range=0..15)  # disabled
dimensions = Dimensions(Surface=surface_3)  # -> UDimension, VDimension; disabled
is_planar_3 = IsPlanar(Surface=surface_3, Interior=True)  # -> Planar, Plane; disabled
division = Division(A=dimensions.UDimension, B=usize)  # disabled
division_2 = Division(A=dimensions.VDimension, B=vsize)  # disabled
quad_panels = QuadPanels(Surface=surface_3, UDivisions=division, VDivisions=division_2)  # disabled
curve_2 = Curve(quad_panels)  # disabled
offset_curve_2 = OffsetCurve(Curve=curve_2, Distance=expr("-x/2", number_2), Plane=is_planar_3.Plane, Corners=1)  # -> simplify(Curve); disabled

curve_3 = Curve(offset_curve_2)  # disabled
curve_4 = Curve(curve)  # disabled
curve_5 = Curve(offset_curve)  # disabled

curve_6 = Curve(curve_3)  # disabled
extercurve = Curve(curve_4)  # disabled
exteriorcurve = Curve(flatten(extercurve))  # disabled
trim_with_regions = TrimWithRegions(Curve=curve_6, Regions=exteriorcurve)  # -> Inside, Outside; disabled
curve_7 = Curve(flatten(trim_with_regions.Inside))  # disabled
curve_8 = Curve(extercurve)  # disabled
curve_9 = Curve(curve_5)  # disabled

cherry_picker = CherryPicker(curve, ListIndex=0, TreePath_path="{29}")  # disabled
surface_4 = Surface(cherry_picker)  # disabled

merge = Merge(Data1=curve_7, Data2=curve_8, Data3=curve_9)  # -> flatten(Result); disabled
curve_10 = Curve(merge)  # disabled

curve_curve = CurveCurve(CurveA=flatten(curve_7), CurveB=curve_8)  # -> Points, ParamsA, flatten(ParamsB); disabled
shatter = Shatter(Curve=curve_8, Parameters=curve_curve.ParamsB)  # disabled
dispatch = Dispatch(List=shatter, DispatchPattern=[True, False])  # -> ListA, ListB; disabled
stream_filter_4 = StreamFilter(Gate=shiftex, Stream0=dispatch.ListB, Stream1=dispatch.ListA)  # disabled
curve_11 = Curve(stream_filter_4)  # disabled
curve_12 = Curve(curve_9)  # disabled
curve_13 = Curve(curve_7)  # disabled

merge_2 = Merge(Data1=curve_13, Data2=curve_11)  # -> flatten(Result); disabled
join_curves_2 = JoinCurves(Curves=merge_2, Preserve=False)  # disabled
insert_items = InsertItems(List=join_curves_2, Item=curve_12, Indices=0, Wrap=True)  # disabled
project_2 = Project(Geometry=insert_items, Plane=plane_normal)  # -> Geometry, Transform; disabled
curve_14 = Curve(project_2.Geometry)  # disabled

surface_5 = Surface(curve_14)  # disabled
bounding_box = BoundingBox(Content=surface_5, Plane=PlaneXY(0, 0, 0))  # -> Box, Box_2; disabled
area = Area(Geometry=bounding_box.Box)  # -> Area, Centroid; disabled
sort_list = SortList(Keys=area.Area, ValuesValuesA=surface_5)  # -> Keys, reverse(ValuesValuesA); disabled
split_list = SplitList(List=sort_list.ValuesValuesA, Index=1)  # -> ListA, ListB; disabled
surface_split_2 = SurfaceSplit(Surface=split_list.ListA, Curves=split_list.ListB)  # disabled

planar = Planar(Curve=curve_14)  # -> Planar, Plane, Deviation; disabled
mass_multiplication = MassMultiplication(Input=planar.Planar)  # -> Result, PartialResults; disabled
planar_2 = Panel(mass_multiplication.Result)  # disabled

closed = Closed(Curve=curve_14)  # -> Closed, Periodic; disabled
mass_multiplication_2 = MassMultiplication(Input=closed.Closed)  # -> Result, PartialResults; disabled
closed_2 = Panel(mass_multiplication_2.Result)  # disabled

surface_6 = Surface(surface_split_2)  # disabled
bounding_box_2 = BoundingBox(Content=surface_6, Plane=PlaneXY(0, 0, 0))  # -> Box, Box_2; disabled
area_2 = Area(Geometry=bounding_box_2.Box)  # -> Area, Centroid; disabled
sort_list_2 = SortList(Keys=area_2.Area, ValuesValuesA=surface_6)  # -> Keys, reverse(ValuesValuesA); disabled
list_item_3 = ListItem(List=sort_list_2.ValuesValuesA, Index=0, Wrap=True)  # disabled
surface_7 = Surface(list_item_3)  # disabled

vector = Vector(evaluate_surface.Normal)  # disabled
number_3 = Number(mullionwidth)  # disabled
colour_picker = ColourPicker(PickedColour=RGB(255, 0, 0))  # disabled
amplitude_2 = Amplitude(Vector=vector, Amplitude=number_3)  # disabled
reverse = Reverse(Vector=amplitude_2)  # disabled
extrude_2 = Extrude(Base=surface_7, Direction=reverse)  # disabled
brep_3 = Brep(extrude_2)  # disabled

stream_filter_5 = StreamFilter(Gate=brep_2, Stream0=curve_14, Stream1=brep_3)  # disabled
bake_attributes = BakeAttributes(objs=stream_filter_5, names=integer, layers=layername, activate=bake, groupListTgthr=stream_filter)  # -> out; inputs objs: list, names: list of String, layers: list of String, colors: list of Color, pWidths: list of Double, wiresEach: list of Int32, materials: list, activate: Boolean, groupListTgthr: Boolean; disabled
# ---------- bake_attributes: C# ----------
    //Inserts geometry into the Rhino document, with custom attributes
    //Written by Giulio Piacentino
    //Version written 2011 10 18 - for Grasshopper 0.8.52

    if (activate)
    {
      int groupIndex = -1;
      if(groupListTgthr)
        groupIndex = doc.Groups.Add();

      for(int i = 0; i < objs.Count; i++)
      {
        object obj = objs[i];
        if(obj == null)
        {
          Print("No object to bake");
          return;
        }

        //Make new attribute to set name
        Rhino.DocObjects.ObjectAttributes att = new Rhino.DocObjects.ObjectAttributes();

        string name = names.Count > 0 ? names[i % names.Count] : null;
        //Set object name
        if(!string.IsNullOrEmpty(name))
        {
          att.Name = name;
        }

        Color color = colors.Count > 0 ? colors[i % colors.Count] : new Color();
        //Set color
        if(!color.IsEmpty)
        {
          att.ColorSource = Rhino.DocObjects.ObjectColorSource.ColorFromObject; //Make the color type "by object"
          att.ObjectColor = color;

          att.PlotColorSource = Rhino.DocObjects.ObjectPlotColorSource.PlotColorFromObject; //Make the plot color type "by object"
          att.PlotColor = color;
        }

        string layer = layers.Count > 0 ? layers[i % layers.Count] : null;
        //Set layer
        if(!string.IsNullOrEmpty(layer) && Rhino.DocObjects.Layer.IsValidName(layer))
        {
          //Get the current layer index
          Rhino.DocObjects.Tables.LayerTable layerTable = doc.Layers;
          int layerIndex = layerTable.Find(layer, true);

          if(layerIndex < 0) //This layer does not exist, we add it
          {
            Rhino.DocObjects.Layer onlayer = new Rhino.DocObjects.Layer(); //Make a new layer
            onlayer.Name = layer;

            layerIndex = layerTable.Add(onlayer); //Add the layer to the layer table
            if (layerIndex > -1) //We manged to add layer!
            {
              att.LayerIndex = layerIndex;
              Print("Added new layer to the document at position " + layerIndex + " named " + layer + ". ");
            } else
              Print("Layer did not add. Try cleaning up your layers."); //This never happened to me.
          }
          else
            att.LayerIndex = layerIndex; //We simply add to the existing layer
        }


        double pWidth = pWidths.Count > 0 ? pWidths[i % pWidths.Count] : 0;
        //Set plotweight
        if(pWidth > 0)
        {
          att.PlotWeightSource = Rhino.DocObjects.ObjectPlotWeightSource.PlotWeightFromObject;
          att.PlotWeight = pWidth;
        }


        object material = materials.Count > 0 ? materials[i % materials.Count] : null;
        //Set material
        bool materialByName = !string.IsNullOrEmpty(material as string);
        Rhino.Display.DisplayMaterial inMaterial = material as Rhino.Display.DisplayMaterial;
        if(material is Color)
        {
          inMaterial = new Rhino.Display.DisplayMaterial((Color) material);
        }
        if(material != null && inMaterial == null && !materialByName)
        {
          if(!(material is string))
          {
            try //We also resort to try with IConvertible
            {
              inMaterial = (Rhino.Display.DisplayMaterial) Convert.ChangeType(material, typeof(Rhino.Display.DisplayMaterial));
            }
            catch(InvalidCastException)
            {
            }
          }
        }
        if(inMaterial != null || materialByName)
        {
          string matName;

          if(!materialByName)
          {
            matName = string.Format("A:{0}-D:{1}-E:{2}-S:{3},{4}-T:{5}",
              Format(inMaterial.Ambient),
              Format(inMaterial.Diffuse),
              Format(inMaterial.Emission),
              Format(inMaterial.Specular),
              inMaterial.Shine.ToString(),
              inMaterial.Transparency.ToString()
              );
          }
          else
          {
            matName = (string) material;
          }

          int materialIndex = doc.Materials.Find(matName, true);
          if(materialIndex < 0 && !materialByName) //Material does not exist and we have its specs
          {
            materialIndex = doc.Materials.Add(); //Let's add it
            if(materialIndex > -1)
            {
              Print("Added new material at position " + materialIndex + " named \"" + matName + "\". ");
              Rhino.DocObjects.Material m = doc.Materials[materialIndex];
              m.Name = matName;
              m.AmbientColor = inMaterial.Ambient;
              m.DiffuseColor = inMaterial.Diffuse;
              m.EmissionColor = inMaterial.Emission;
              //m.ReflectionColor = no equivalent
              m.SpecularColor = inMaterial.Specular;
              m.Shine = inMaterial.Shine;
              m.Transparency = inMaterial.Transparency;
              //m.TransparentColor = no equivalent
              m.CommitChanges();

              att.MaterialSource = Rhino.DocObjects.ObjectMaterialSource.MaterialFromObject;
              att.MaterialIndex = materialIndex;
            }
            else
              Print("Material did not add. Try cleaning up your materials."); //This never happened to me.
          }
          else if(materialIndex < 0 && materialByName) //Material does not exist and we do not have its specs. We do nothing
          {
            Print("Warning: material name not found. I cannot set the source to this material name. Add a material with name: " + matName);
          }
          else
          {
            //If this material exists, we do not replace it!
            att.MaterialSource = Rhino.DocObjects.ObjectMaterialSource.MaterialFromObject;
            att.MaterialIndex = materialIndex;
          }
        }


        int wires = wiresEach.Count > 0 ? wiresEach[i % wiresEach.Count] : 0;
        //Set wire density
        if(wires == -1 || wires > 0)
        {
          att.WireDensity = wires;
        }

        Bake(obj, att, groupIndex);
      }
    }
    else
    {
      Print("Inactive");
    }

  }

  //<Custom additional code>

  void Bake(object obj, Rhino.DocObjects.ObjectAttributes att, int groupIndex)
  {
    if(obj == null)
      return;

    Guid id;

    //Bake to the right type of object
    if(obj is GeometryBase)
    {
      GeometryBase geomObj = obj as GeometryBase;

      switch(geomObj.ObjectType)
      {
        case Rhino.DocObjects.ObjectType.Brep:
          id = doc.Objects.AddBrep(obj as Brep, att);
          break;
        case Rhino.DocObjects.ObjectType.Curve:
          id = doc.Objects.AddCurve(obj as Curve, att);
          break;
        case Rhino.DocObjects.ObjectType.Point:
          id = doc.Objects.AddPoint((obj as Rhino.Geometry.Point).Location, att);
          break;
        case Rhino.DocObjects.ObjectType.Surface:
          id = doc.Objects.AddSurface(obj as Surface, att);
          break;
        case Rhino.DocObjects.ObjectType.Mesh:
          id = doc.Objects.AddMesh(obj as Mesh, att);
          break;
        case (Rhino.DocObjects.ObjectType) 1073741824://Rhino.DocObjects.ObjectType.Extrusion:
          id = (Guid) typeof(Rhino.DocObjects.Tables.ObjectTable).InvokeMember("AddExtrusion", BindingFlags.Instance | BindingFlags.InvokeMethod, null, doc.Objects, new object[]{obj, att});
          break;
        case Rhino.DocObjects.ObjectType.PointSet:
          id = doc.Objects.AddPointCloud(obj as Rhino.Geometry.PointCloud, att); //This is a speculative entry
          break;
        default:
          Print("The script does not know how to handle this type of geometry: " + obj.GetType().FullName);
          return;
      }
    }
    else
    {
      Type objectType = obj.GetType();

      if(objectType == typeof(Arc))
      {
        id = doc.Objects.AddArc((Arc) obj, att);
      }
      else if(objectType == typeof(Box))
      {
        id = doc.Objects.AddBrep(((Box) obj).ToBrep(), att);
      }
      else if(objectType == typeof(Circle))
      {
        id = doc.Objects.AddCircle((Circle) obj, att);
      }
      else if(objectType == typeof(Ellipse))
      {
        id = doc.Objects.AddEllipse((Ellipse) obj, att);
      }
      else if(objectType == typeof(Polyline))
      {
        id = doc.Objects.AddPolyline((Polyline) obj, att);
      }
      else if(objectType == typeof(Sphere))
      {
        id = doc.Objects.AddSphere((Sphere) obj, att);
      }
      else if(objectType == typeof(Point3d))
      {
        id = doc.Objects.AddPoint((Point3d) obj, att);
      }
      else if(objectType == typeof(Line))
      {
        id = doc.Objects.AddLine((Line) obj, att);
      }
      else if(objectType == typeof(Vector3d))
      {
        Print("Impossible to bake vectors");
        return;
      }
      else if(obj is IEnumerable)
      {
        int newGroupIndex;
        if(groupIndex == -1)
          newGroupIndex = doc.Groups.Add();
        else
          newGroupIndex = groupIndex;
        foreach(object o in obj as IEnumerable)
        {
          Bake(o, att, newGroupIndex);
        }
        return;
      }
      else
      {
        Print("Unhandled type: " + objectType.FullName);
        return;
      }
    }

    if(groupIndex != -1)
    {
      doc.Groups.AddToGroup(groupIndex, id);
      Print("Added " + obj.GetType().Name + " to group number " + groupIndex);
    }
    else
      Print("Added " + obj.GetType().Name);
  }

  static string Format(Color c)
  {
    return (new System.Text.StringBuilder("A")).Append(c.A.ToString()).Append("R").Append(c.R.ToString()).Append("G")
      .Append(c.G.ToString()).Append("B").Append(c.B.ToString()).ToString();
# ---------- end bake_attributes ----------

custom_preview_2 = CustomPreview(Geometry=stream_filter_5, Material=colour_picker)  # disabled
